# Grasshopper definition main_change.gh (Grasshopper 1.0.7)

tube_inner_tolerance = Slider(0.2, range=0..1)
panel = Panel("required tube_length = tube_holder_height+1")
panel_2 = Panel("peizo_height(2.5mm)+minimum(1.5mm*2)")
silicone_ring_thickness = Slider(0.8, range=0..10)
piezo_height = Slider(2.5, range=0..10)
# 10mm piezo 5.2mm, 16mm piezo 8.2mm
peizo_radius = Slider(5.2, range=0..10)
peizo_holder_lock_height = Slider(8, range=0..10)
piezo_holder_thickness = Slider(2, range=0..10)
lock_thickness = Slider(2, range=0..10)
lock_height = Slider(3, range=0..10)
lock_scale_factor = Slider(1.05, range=0..10)
constraint_fix_tolerance = Slider(0.5, range=-1..1)
constraint_wall_thickness = Slider(1.5, range=0..2)
# Vertical: Piezo 10/16mm
tube_radius = Slider(4, range=0..10)
tube_holder_height = Slider(42, range=15..150)
piezo_holder_cap_height = Slider(6, range=0..10)
tube_holder_tolerance = Slider(0.2, range=0..1)
# Horizontal: Piezo 10/16mm
tube_radius_2 = Slider(6, range=0..10)  # disabled
tube_inner_tolerance_2 = Slider(0.2, range=0..1)  # disabled
tube_holder_height_2 = Slider(19, range=9..30)  # disabled
piezo_holder_cap_height_2 = Slider(6, range=0..100)  # disabled
panel_3 = Panel("peizo_height(2mm)+minimum(1.5mm*2)")  # disabled
silicone_ring_thickness_2 = Slider(0.8, range=0..10)  # disabled
tube_holder_tolerance_2 = Slider(0.2, range=0..1)  # disabled
piezo_height_2 = Slider(2.5, range=0..10)  # disabled
# 10mm piezo, radius=5mm, 0.2mm tolerance
peizo_radius_2 = Slider(8.2, range=0..10)  # disabled
additonal_seal_thickness = Slider(1.5, range=0..10)  # disabled
peizo_holder_lock_height_2 = Slider(8, range=0..10)  # disabled
panel_4 = Panel("3mm lock_height + 4mm")  # disabled
piezo_holder_thickness_2 = Slider(2, range=0..10)  # disabled
lock_thickness_2 = Slider(2, range=0..10)  # disabled
lock_height_2 = Slider(3, range=0..10)  # disabled
lock_scale_factor_2 = Slider(1.05, range=0..10)  # disabled
horizontal_tube_radius = Slider(3, range=2..3)  # disabled
tube_fix_tolerance = Slider(0.1, range=-1..1)  # disabled
extended_tube_holder_length = Slider(10, range=0..100)  # disabled
addition = Addition(Tube_holder_height=tube_holder_height, Silicone_ring_thickness=silicone_ring_thickness)
addition_2 = Addition(Tube_radius=tube_radius, Tube_radius_tolerance=tube_inner_tolerance)
addition_3 = Addition(Tube_radius=addition_2, Piezo_holder_thickness=piezo_holder_thickness)
addition_4 = Addition(A=addition_3, Tolerance=tube_holder_tolerance)
addition_5 = Addition(A=addition_3, Lock_thickness=lock_thickness)
addition_6 = Addition(Tube_radius=tube_radius, Constraint_fix_tolerance=constraint_fix_tolerance)
addition_7 = Addition(A=addition_6, Constraint_wall_thickness=constraint_wall_thickness)
unit_z = UnitZ(Factor=peizo_holder_lock_height)
reverse = Reverse(Vector=unit_z)
addition_8 = Addition(Tube_holder_height=tube_holder_height_2, Silicone_ring_thickness=silicone_ring_thickness_2)  # disabled
addition_9 = Addition(Tube_radius=tube_radius_2, Tube_radius_tolerance=tube_inner_tolerance_2)  # disabled
addition_10 = Addition(Tube_radius=addition_9, Piezo_holder_thickness=piezo_holder_thickness_2)  # disabled
addition_11 = Addition(A=addition_10, Lock_thickness=lock_thickness_2)  # disabled
addition_12 = Addition(A=addition_11, Additonal_seal_thickness=additonal_seal_thickness)  # disabled
addition_13 = Addition(Extended_tube_holder_length=extended_tube_holder_length, B=addition_12)  # disabled
addition_14 = Addition(A=addition_10, Tolerance=tube_holder_tolerance_2)  # disabled
addition_15 = Addition(A=addition_10, Lock_thickness=lock_thickness_2)  # disabled
addition_16 = Addition(A=addition_15, Additonal_seal_thickness=additonal_seal_thickness)  # disabled
addition_17 = Addition(Horizontal_tube_radius=horizontal_tube_radius, Tube_fix_tolerance=tube_fix_tolerance)  # disabled
addition_18 = Addition(Radius_inner_clylinder=addition_17, Additonal_seal_thickness=additonal_seal_thickness)  # disabled
addition_19 = Addition(Extended_tube_holder_length=extended_tube_holder_length, Additonal_seal_thickness=additonal_seal_thickness)  # disabled
divide_count = Slider(8, range=0..10)
bottom_thickness = Panel("1.5")
cylinder = Cylinder(Base=PlaneXY(0, 0, 0), Radius=addition_2, Length=piezo_holder_cap_height)
cylinder_2 = Cylinder(Base=PlaneXY(0, 0, 0), Radius=addition_5, Length=piezo_holder_cap_height)
cylinder_3 = Cylinder(Base=PlaneXY(0, 0, 0), Radius=addition_4, Length=tube_holder_height)
cylinder_4 = Cylinder(Base=PlaneXY(0, 0, 0), Radius=addition_5, Length=tube_holder_height)
bottom_cylinder = Cylinder(Base=PlaneXY(0, 0, 0), Radius=addition_5, Length=bottom_thickness)
cylinder_5 = Cylinder(Base=PlaneXY(0, 0, 0), Radius=addition_6, Length=peizo_holder_lock_height)
cylinder_6 = Cylinder(Base=PlaneXY(0, 0, 0), Radius=addition_4, Length=peizo_holder_lock_height)
cylinder_7 = Cylinder(Base=PlaneXY(0, 0, 0), Radius=addition_9, Length=piezo_holder_cap_height_2)  # disabled
cylinder_8 = Cylinder(Base=PlaneXY(0, 0, 0), Radius=addition_15, Length=piezo_holder_cap_height_2)  # disabled
cylinder_9 = Cylinder(Base=PlaneXY(0, 0, 0), Radius=addition_14, Length=tube_holder_height_2)  # disabled
cylinder_10 = Cylinder(Base=PlaneXY(0, 0, 0), Radius=addition_16, Length=tube_holder_height_2)  # disabled
cylinder_11 = Cylinder(Base=PlaneXY(0, 0, 0), Radius=addition_17, Length=addition_13)  # disabled
unit_z_2 = UnitZ(Factor=peizo_holder_lock_height_2)  # disabled
reverse_2 = Reverse(Vector=unit_z_2)  # disabled
cap_holes = CapHoles(Brep=cylinder_3)
cap_holes_2 = CapHoles(Brep=cylinder_4)
cap_holes_3 = CapHoles(Brep=bottom_cylinder)
cap_holes_4 = CapHoles(Brep=cylinder_5)
cap_holes_5 = CapHoles(Brep=cylinder_6)
unit_z_3 = UnitZ(Factor=addition)
unit_z_4 = UnitZ(Factor=addition)
move = Move(Geometry=cylinder, Motion=unit_z_3)  # -> Geometry, Transform
move_2 = Move(Geometry=cylinder_2, Motion=unit_z_4)  # -> Geometry, Transform
divide_count_2 = Slider(8, range=0..10)  # disabled
cap_holes_6 = CapHoles(Brep=cylinder_9)  # disabled
cap_holes_7 = CapHoles(Brep=cylinder_10)  # disabled
cap_holes_8 = CapHoles(Brep=cylinder_11)  # disabled
unit_z_5 = UnitZ(Factor=addition_8)  # disabled
unit_z_6 = UnitZ(Factor=addition_8)  # disabled
move_3 = Move(Geometry=cylinder_7, Motion=unit_z_5)  # -> Geometry, Transform; disabled
move_4 = Move(Geometry=cylinder_8, Motion=unit_z_6)  # -> Geometry, Transform; disabled
unit_z_7 = UnitZ(Factor=peizo_holder_lock_height)
unit_z_8 = UnitZ(Factor=peizo_holder_lock_height)
reverse_3 = Reverse(Vector=unit_z_7)
reverse_4 = Reverse(Vector=unit_z_8)
cap_holes_9 = CapHoles(Brep=move.Geometry)
deconstruct_brep = DeconstructBrep(Brep=cap_holes_9)  # -> Faces, Edges, Vertices
list_item = ListItem(List=deconstruct_brep.Faces, Index="1", Wrap=True)
deconstruct_arc = DeconstructArc(Arc=list_item)  # -> BasePlane, Tube_radius, Angle
addition_20 = Addition(Tube_radius=deconstruct_arc.Tube_radius, Peizo_holder_thickness=piezo_holder_thickness)
addition_21 = Addition(A=addition_20, Lock_thickness=lock_thickness)
circle = Circle(Plane=list_item, Radius=addition_20)
move_5 = Move(Geometry=circle, Motion=reverse)  # -> Geometry, Transform
circle_2 = Circle(Plane=move_5.Geometry, Radius=addition_21)
divide_curve = DivideCurve(Curve=move_5.Geometry, Count=divide_count, Kinks=False)  # -> Points, Tangents, Parameters
divide_curve_2 = DivideCurve(Curve=circle_2, Count=divide_count, Kinks=False)  # -> Points, Tangents, Parameters
list_item_2 = ListItem(List=divide_curve.Parameters, Index="0", Wrap=True)
list_item_3 = ListItem(List=divide_curve.Parameters, Index="1", Wrap=True)
list_item_4 = ListItem(List=divide_curve_2.Parameters, Index="0", Wrap=True)
list_item_5 = ListItem(List=divide_curve_2.Parameters, Index="1", Wrap=True)
list_item_6 = ListItem(List=divide_curve.Parameters, Index="4", Wrap=True)
list_item_7 = ListItem(List=divide_curve.Parameters, Index="5", Wrap=True)
list_item_8 = ListItem(List=divide_curve_2.Parameters, Index="4", Wrap=True)
list_item_9 = ListItem(List=divide_curve_2.Parameters, Index="5", Wrap=True)
boundary_surfaces = BoundarySurfaces(Edges=circle)
extrude = Extrude(Base=list_item, Direction=reverse_3)
extrude_2 = Extrude(Base=boundary_surfaces, Direction=reverse_4)
construct_domain = ConstructDomain(DomainStart=list_item_2, DomainEnd=list_item_3)
sub_curve = SubCurve(BaseCurve=move_5.Geometry, Domain=construct_domain)
construct_domain_2 = ConstructDomain(DomainStart=list_item_4, DomainEnd=list_item_5)
sub_curve_2 = SubCurve(BaseCurve=circle_2, Domain=construct_domain_2)
construct_domain_3 = ConstructDomain(DomainStart=list_item_6, DomainEnd=list_item_7)
sub_curve_3 = SubCurve(BaseCurve=move_5.Geometry, Domain=construct_domain_3)
construct_domain_4 = ConstructDomain(DomainStart=list_item_8, DomainEnd=list_item_9)
sub_curve_4 = SubCurve(BaseCurve=circle_2, Domain=construct_domain_4)
cap_holes_10 = CapHoles(Brep=move_2.Geometry)
solid_difference = SolidDifference(BrepsA=cap_holes_5, BrepsB=cap_holes_4)
volume = Volume(Geometry=cap_holes_9)  # -> Volume, Centroid
unit_z_9 = UnitZ(Factor=peizo_holder_lock_height_2)  # disabled
unit_z_10 = UnitZ(Factor=peizo_holder_lock_height_2)  # disabled
reverse_5 = Reverse(Vector=unit_z_9)  # disabled
reverse_6 = Reverse(Vector=unit_z_10)  # disabled
solid_difference_2 = SolidDifference(BrepsA=extrude_2, BrepsB=extrude)
cap_holes_11 = CapHoles(Brep=move_3.Geometry)  # disabled
deconstruct_brep_2 = DeconstructBrep(Brep=cap_holes_11)  # -> Faces, Edges, Vertices; disabled
list_item_10 = ListItem(List=deconstruct_brep_2.Faces, Index=0, Wrap=True)  # disabled
deconstruct_arc_2 = DeconstructArc(Arc=list_item_10)  # -> BasePlane, Tube_radius, Angle; disabled
addition_22 = Addition(Tube_radius=deconstruct_arc_2.Tube_radius, Peizo_holder_thickness=piezo_holder_thickness_2)  # disabled
addition_23 = Addition(A=addition_22, Lock_thickness=lock_thickness_2)  # disabled
circle_3 = Circle(Plane=list_item_10, Radius=addition_22)  # disabled
move_6 = Move(Geometry=circle_3, Motion=reverse_2)  # -> Geometry, Transform; disabled
circle_4 = Circle(Plane=move_6.Geometry, Radius=addition_23)  # disabled
divide_curve_3 = DivideCurve(Curve=move_6.Geometry, Count=divide_count_2, Kinks=False)  # -> Points, Tangents, Parameters; disabled
divide_curve_4 = DivideCurve(Curve=circle_4, Count=divide_count_2, Kinks=False)  # -> Points, Tangents, Parameters; disabled
boundary_surfaces_2 = BoundarySurfaces(Edges=circle_3)  # disabled
extrude_3 = Extrude(Base=list_item_10, Direction=reverse_5)  # disabled
extrude_4 = Extrude(Base=boundary_surfaces_2, Direction=reverse_6)  # disabled
cap_holes_12 = CapHoles(Brep=move_4.Geometry)  # disabled
volume_2 = Volume(Geometry=cap_holes_11)  # -> Volume, Centroid; disabled
panel_5 = Panel("0")  # disabled
panel_6 = Panel("1")  # disabled
panel_7 = Panel("0")  # disabled
panel_8 = Panel("1")  # disabled
panel_9 = Panel("4")  # disabled
panel_10 = Panel("5")  # disabled
panel_11 = Panel("4")  # disabled
panel_12 = Panel("5")  # disabled
list_item_11 = ListItem(List=divide_curve_3.Parameters, Index=panel_7, Wrap=True)  # disabled
list_item_12 = ListItem(List=divide_curve_3.Parameters, Index=panel_8, Wrap=True)  # disabled
list_item_13 = ListItem(List=divide_curve_4.Parameters, Index=panel_5, Wrap=True)  # disabled
list_item_14 = ListItem(List=divide_curve_4.Parameters, Index=panel_6, Wrap=True)  # disabled
list_item_15 = ListItem(List=divide_curve_3.Parameters, Index=panel_9, Wrap=True)  # disabled
list_item_16 = ListItem(List=divide_curve_3.Parameters, Index=panel_10, Wrap=True)  # disabled
list_item_17 = ListItem(List=divide_curve_4.Parameters, Index=panel_11, Wrap=True)  # disabled
list_item_18 = ListItem(List=divide_curve_4.Parameters, Index=panel_12, Wrap=True)  # disabled
# Bottom Part
solid_union = SolidUnion(Breps=[solid_difference, cap_holes_3])
piezo_holder_cap = SolidDifference(BrepsA=cap_holes_10, BrepsB=cap_holes_9)
cylinder_12 = Cylinder(Base=volume.Centroid, Piezo_radius=peizo_radius, Piezo_height=piezo_height)
cap_holes_13 = CapHoles(Brep=cylinder_12)
deconstruct_brep_3 = DeconstructBrep(Brep=cap_holes_13)  # -> Faces, Edges, Vertices
list_item_19 = ListItem(List=deconstruct_brep_3.Edges, Index=0, Wrap=True)
divide_curve_5 = DivideCurve(Curve=list_item_19, Count=expr("x*2", divide_count), Kinks=False)  # -> Points, Tangents, Parameters
point_on_curve = PointOnCurve(sub_curve, parameter=0)
point_on_curve_2 = PointOnCurve(sub_curve, parameter=1)
point_on_curve_3 = PointOnCurve(sub_curve_2, parameter=0)
point_on_curve_4 = PointOnCurve(sub_curve_2, parameter=1)
point_on_curve_5 = PointOnCurve(sub_curve_3, parameter=0)
point_on_curve_6 = PointOnCurve(sub_curve_3, parameter=1)
point_on_curve_7 = PointOnCurve(sub_curve_4, parameter=0)
point_on_curve_8 = PointOnCurve(sub_curve_4, parameter=1)
solid_difference_3 = SolidDifference(BrepsA=extrude_4, BrepsB=extrude_3)  # disabled
piezo_holder_cap_2 = SolidDifference(BrepsA=cap_holes_12, BrepsB=cap_holes_11)  # disabled
unit_y = UnitY(Factor=1)  # disabled
rotate_3d = Rotate3D(Geometry=cap_holes_8, Angle=1.570796327, Center=Point(0, 0, 0), Axis=unit_y)  # -> Geometry, Transform; disabled
cylinder_13 = Cylinder(Base=volume_2.Centroid, Piezo_radius=peizo_radius_2, Piezo_height=piezo_height_2)  # disabled
cap_holes_14 = CapHoles(Brep=cylinder_13)  # disabled
deconstruct_brep_4 = DeconstructBrep(Brep=cap_holes_14)  # -> Faces, Edges, Vertices; disabled
list_item_20 = ListItem(List=deconstruct_brep_4.Edges, Index=0, Wrap=True)  # disabled
divide_curve_6 = DivideCurve(Curve=list_item_20, Count=expr("x*2", divide_count_2), Kinks=False)  # -> Points, Tangents, Parameters; disabled
construct_domain_5 = ConstructDomain(DomainStart=list_item_11, DomainEnd=list_item_12)  # disabled
sub_curve_5 = SubCurve(BaseCurve=move_6.Geometry, Domain=construct_domain_5)  # disabled
construct_domain_6 = ConstructDomain(DomainStart=list_item_13, DomainEnd=list_item_14)  # disabled
sub_curve_6 = SubCurve(BaseCurve=circle_4, Domain=construct_domain_6)  # disabled
construct_domain_7 = ConstructDomain(DomainStart=list_item_15, DomainEnd=list_item_16)  # disabled
sub_curve_7 = SubCurve(BaseCurve=move_6.Geometry, Domain=construct_domain_7)  # disabled
construct_domain_8 = ConstructDomain(DomainStart=list_item_17, DomainEnd=list_item_18)  # disabled
sub_curve_8 = SubCurve(BaseCurve=circle_4, Domain=construct_domain_8)  # disabled
list_item_21 = ListItem(List=deconstruct_brep_3.Faces, Index="1", Wrap=True)
area = Area(Geometry=list_item_21)  # -> Area, Centroid
line = Line(StartPoint=point_on_curve, EndPoint=point_on_curve_3)
line_2 = Line(StartPoint=point_on_curve_4, EndPoint=point_on_curve_2)
line_3 = Line(StartPoint=point_on_curve_5, EndPoint=point_on_curve_7)
line_4 = Line(StartPoint=point_on_curve_8, EndPoint=point_on_curve_6)
list_item_22 = ListItem(List=divide_curve_5.Points, Index="1", Wrap=True)
panel_13 = Panel("1")  # disabled
list_item_23 = ListItem(List=deconstruct_brep_4.Faces, Index=0, Wrap=True)  # disabled
area_2 = Area(Geometry=list_item_23)  # -> Area, Centroid; disabled
list_item_24 = ListItem(List=divide_curve_6.Points, Index=panel_13, Wrap=True)  # disabled
point_on_curve_9 = PointOnCurve(sub_curve_5, parameter=0)  # disabled
point_on_curve_10 = PointOnCurve(sub_curve_5, parameter=1)  # disabled
point_on_curve_11 = PointOnCurve(sub_curve_6, parameter=0)  # disabled
point_on_curve_12 = PointOnCurve(sub_curve_6, parameter=1)  # disabled
point_on_curve_13 = PointOnCurve(sub_curve_7, parameter=0)  # disabled
point_on_curve_14 = PointOnCurve(sub_curve_7, parameter=1)  # disabled
point_on_curve_15 = PointOnCurve(sub_curve_8, parameter=0)  # disabled
point_on_curve_16 = PointOnCurve(sub_curve_8, parameter=1)  # disabled
volume_3 = Volume(Geometry=cap_holes_13)  # -> Volume, Centroid
vector_2pt = Vector2Pt(PointA=area.Centroid, PointB=list_item_22, Unitize=False)  # -> Vector, Length
plane_normal = PlaneNormal(Origin=area.Centroid, ZAxis=vector_2pt.Vector)
brep_plane = BrepPlane(Brep=cap_holes_13, Plane=plane_normal)  # -> Curves, Points
amplitude = Amplitude(Vector=vector_2pt.Vector, Amplitude=addition_5)
join_curves = JoinCurves(Curves=[sub_curve, line, sub_curve_2, line_2], Preserve=False)
# Lock Right
boundary_surfaces_3 = BoundarySurfaces(Edges=join_curves)
unit_z_11 = UnitZ(Factor=lock_height)
join_curves_2 = JoinCurves(Curves=[sub_curve_3, line_3, sub_curve_4, line_4], Preserve=False)
boundary_surfaces_4 = BoundarySurfaces(Edges=join_curves_2)
unit_z_12 = UnitZ(Factor=lock_height)
extrude_5 = Extrude(Base=boundary_surfaces_3, Direction=unit_z_11)
# Lock Left
extrude_6 = Extrude(Base=boundary_surfaces_4, Direction=unit_z_12)
volume_4 = Volume(Geometry=cap_holes_14)  # -> Volume, Centroid; disabled
vector_2pt_2 = Vector2Pt(PointA=area_2.Centroid, PointB=list_item_24, Unitize=False)  # -> Vector, Length; disabled
plane_normal_2 = PlaneNormal(Origin=area_2.Centroid, ZAxis=vector_2pt_2.Vector)  # disabled
brep_plane_2 = BrepPlane(Brep=cap_holes_14, Plane=plane_normal_2)  # -> Curves, Points; disabled
amplitude_2 = Amplitude(Vector=vector_2pt_2.Vector, Amplitude=addition_15)  # disabled
line_5 = Line(StartPoint=point_on_curve_9, EndPoint=point_on_curve_11)  # disabled
line_6 = Line(StartPoint=point_on_curve_12, EndPoint=point_on_curve_10)  # disabled
line_7 = Line(StartPoint=point_on_curve_13, EndPoint=point_on_curve_15)  # disabled
line_8 = Line(StartPoint=point_on_curve_16, EndPoint=point_on_curve_14)  # disabled
vector_2pt_3 = Vector2Pt(PointA=volume_3.Centroid, PointB=area.Centroid, Unitize=False)  # -> Vector, Length
extrude_7 = Extrude(Base=brep_plane.Curves, Direction=amplitude)
cap_holes_15 = CapHoles(Brep=extrude_7)
solid_union_2 = SolidUnion(Breps=flatten([cap_holes_15, cap_holes_13]))
move_7 = Move(Geometry=solid_union_2, Motion=vector_2pt_3.Vector)  # -> Geometry, Transform
port_rotating_angle = Slider(16, range=0..100)  # disabled
# Piezo Holder Lock Part
solid_union_3 = SolidUnion(Breps=flatten([solid_difference_2, extrude_5, extrude_6]))
distance_between_port_piezo = Slider(4, range=0..10)  # disabled
panel_14 = Panel("4.7")  # disabled
panel_15 = Panel("3.2")  # disabled
panel_16 = Panel("4.2")  # disabled
lift_tolerance_boolean = Slider(0.01, range=0..0.01)  # disabled
# Piezo Two-Way Port
rectangle = Rectangle(Plane=PlaneXY(0, 0, 0), XSize=panel_16, YSize=panel_14, Radius=0)  # -> Rectangle, Length; disabled
unit_z_13 = UnitZ(Factor=lift_tolerance_boolean)  # disabled
vector_2pt_4 = Vector2Pt(PointA=volume_4.Centroid, PointB=area_2.Centroid, Unitize=False)  # -> Vector, Length; disabled
extrude_8 = Extrude(Base=brep_plane_2.Curves, Direction=amplitude_2)  # disabled
cap_holes_16 = CapHoles(Brep=extrude_8)  # disabled
solid_union_4 = SolidUnion(Breps=flatten([cap_holes_16, cap_holes_14]))  # disabled
move_8 = Move(Geometry=solid_union_4, Motion=vector_2pt_4.Vector)  # -> Geometry, Transform; disabled
unit_z_14 = UnitZ(Factor=lift_tolerance_boolean)  # disabled
join_curves_3 = JoinCurves(Curves=[sub_curve_5, line_5, sub_curve_6, line_6], Preserve=False)  # disabled
boundary_surfaces_5 = BoundarySurfaces(Edges=join_curves_3)  # disabled
unit_z_15 = UnitZ(Factor=lock_height_2)  # disabled
join_curves_4 = JoinCurves(Curves=[sub_curve_7, line_7, sub_curve_8, line_8], Preserve=False)  # disabled
boundary_surfaces_6 = BoundarySurfaces(Edges=join_curves_4)  # disabled
unit_z_16 = UnitZ(Factor=lock_height_2)  # disabled
# Lock Right
extrude_9 = Extrude(Base=boundary_surfaces_5, Direction=unit_z_15)  # disabled
# Lock Left
extrude_10 = Extrude(Base=boundary_surfaces_6, Direction=unit_z_16)  # disabled
# Piezo Holder Lock Part
solid_union_5 = SolidUnion(Breps=flatten([solid_difference_3, extrude_9, extrude_10]))  # disabled
# Piezo Holder Cap
solid_difference_4 = SolidDifference(BrepsA=piezo_holder_cap, BrepsB=move_7.Geometry)
box_rectangle = BoxRectangle(Rectangle=rectangle.Rectangle, Height=panel_15)  # disabled
volume_5 = Volume(Geometry=box_rectangle)  # -> Volume, Centroid; disabled
subtraction = Subtraction(A=peizo_holder_lock_height, B=silicone_ring_thickness)
solid_difference_5 = SolidDifference(BrepsA=piezo_holder_cap_2, BrepsB=move_8.Geometry)  # disabled
subtraction_2 = Subtraction(Peizo_holder_height=subtraction, Lock_height=lock_height)
subtraction_3 = Subtraction(A=subtraction_2, Tube_holder_tolerance=tube_holder_tolerance)
subtraction_4 = Subtraction(Tube_holder_height=tube_holder_height, B=subtraction_3)
addition_24 = Addition(Lock_height=lock_height, Tube_holder_tolerance=tube_holder_tolerance)
subtraction_5 = Subtraction(Piezo_holder_height=peizo_holder_lock_height, Silicone_ring_thickness=silicone_ring_thickness)
vector_2pt_5 = Vector2Pt(PointA=volume_5.Centroid, PointB=area_2.Centroid, Unitize=False)  # -> Vector, Length; disabled
move_9 = Move(Geometry=box_rectangle, Motion=vector_2pt_5.Vector)  # -> Geometry, Transform; disabled
subtraction_6 = Subtraction(A=peizo_holder_lock_height_2, B=silicone_ring_thickness_2)  # disabled
pi = Pi(Factor="2")
scent_number = Slider(4, range=1..20)
interval = Slider(2, range=0..50)
solid_difference_6 = SolidDifference(BrepsA=cap_holes_7, BrepsB=cap_holes_6)  # disabled
subtraction_7 = Subtraction(Peizo_holder_height=subtraction_6, Lock_height=lock_height_2)  # disabled
subtraction_8 = Subtraction(A=subtraction_7, Tube_holder_tolerance=tube_holder_tolerance_2)  # disabled
subtraction_9 = Subtraction(Tube_holder_height=tube_holder_height_2, B=subtraction_8)  # disabled
addition_25 = Addition(Lock_height=lock_height_2, Tube_holder_tolerance=tube_holder_tolerance_2)  # disabled
subtraction_10 = Subtraction(Piezo_holder_height=peizo_holder_lock_height_2, Silicone_ring_thickness=silicone_ring_thickness_2)  # disabled
radians = Radians(Degrees=port_rotating_angle)  # disabled
division = Division(A=pi, B=divide_count)
permutation_pattern = ValueList({"Line Pattern", "Rectangle Pattern", "Circle Pattern", "Centralized Pattern"}, selected="Rectangle Pattern")
addition_26 = Addition(Piezo_radius=peizo_radius_2, Distance_between_port_piezo=distance_between_port_piezo)  # disabled
unit_y_2 = UnitY(Factor=addition_26)  # disabled
move_10 = Move(Geometry=move_9.Geometry, Motion=unit_y_2)  # -> Geometry, Transform; disabled
rotate = Rotate(Geometry=move_10.Geometry, Angle=expr("x*-1", radians), Plane=PlaneXY(0, 0, 0))  # -> Geometry, Transform; disabled
plane_offset = PlaneOffset(BasePlane=PlaneXY(0, 0, 0), Offset=tube_holder_height)
plane_offset_2 = PlaneOffset(BasePlane=PlaneXY(0, 0, 0), Offset=tube_holder_height)
project = Project(Geometry=boundary_surfaces_3, Plane=plane_offset)  # -> Geometry, Transform
project_2 = Project(Geometry=boundary_surfaces_4, Plane=plane_offset_2)  # -> Geometry, Transform
plane_offset_3 = PlaneOffset(BasePlane=PlaneXY(0, 0, 0), Offset=subtraction_4)
plane_offset_4 = PlaneOffset(BasePlane=PlaneXY(0, 0, 0), Offset=subtraction_4)
project_3 = Project(Geometry=boundary_surfaces_3, Plane=plane_offset_3)  # -> Geometry, Transform
project_4 = Project(Geometry=boundary_surfaces_4, Plane=plane_offset_4)  # -> Geometry, Transform
pcb_guide_position = ValueList({"Back": "back", "Side": "side", "No_Guide": "no_guide"}, selected="Side")
add_attachments_tood = BooleanToggle(True)
od_pcb_integration = BooleanToggle(False)
# Piezo Holder
solid_union_6 = SolidUnion(Breps=flatten([solid_difference_4, solid_union_3]))
rotate_2 = Rotate(Geometry=solid_union_6, Angle=expr("0.5*pi - x", division), Plane=PlaneXY(0, 0, 0))  # -> Geometry, Transform
pcb_guide = Geometry(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)
plane_offset_5 = PlaneOffset(BasePlane=PlaneXY(0, 0, 0), Offset=tube_holder_height_2)  # disabled
plane_offset_6 = PlaneOffset(BasePlane=PlaneXY(0, 0, 0), Offset=tube_holder_height_2)  # disabled
project_5 = Project(Geometry=boundary_surfaces_5, Plane=plane_offset_5)  # -> Geometry, Transform; disabled
project_6 = Project(Geometry=boundary_surfaces_6, Plane=plane_offset_6)  # -> Geometry, Transform; disabled
plane_offset_7 = PlaneOffset(BasePlane=PlaneXY(0, 0, 0), Offset=subtraction_9)  # disabled
plane_offset_8 = PlaneOffset(BasePlane=PlaneXY(0, 0, 0), Offset=subtraction_9)  # disabled
project_7 = Project(Geometry=boundary_surfaces_5, Plane=plane_offset_7)  # -> Geometry, Transform; disabled
project_8 = Project(Geometry=boundary_surfaces_6, Plane=plane_offset_8)  # -> Geometry, Transform; disabled
unit_z_17 = UnitZ(Factor=subtraction_5)
unit_z_18 = UnitZ(Factor=subtraction_5)
reverse_7 = Reverse(Vector=unit_z_17)
reverse_8 = Reverse(Vector=unit_z_18)
unit_z_19 = UnitZ(Factor=addition_24)
unit_z_20 = UnitZ(Factor=addition_24)
pcb_case = Geometry(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)
extrude_11 = Extrude(Base=project.Geometry, Direction=reverse_7)
extrude_12 = Extrude(Base=project_2.Geometry, Direction=reverse_8)
reverse_9 = Reverse(Vector=unit_z_19)
reverse_10 = Reverse(Vector=unit_z_20)
extrude_13 = Extrude(Base=project_3.Geometry, Direction=reverse_9)
extrude_14 = Extrude(Base=project_4.Geometry, Direction=reverse_10)
pcb_guide_onod = Geometry(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)
file_path = FilePath("/Users/cuizhitong/OneDrive - zju.edu.cn/OlfacKit/GhPython/vertical_permutation.py")
panel_17 = Panel(file_path)
panel_18 = Panel("0")  # disabled
unit_z_21 = UnitZ(Factor=panel_18)  # disabled
readfile = ReadFile(Path=file_path)  # -> out, Data
# ---------- readfile: Python ----------
"""Reads the contents of a file.
    How to use:
        This file should be included in a GhPython Component.
    Inputs:
        Path: The absolute path of the file to read
        PerLine: By default True to output the data line by line, or False
        Empty: By default True, or False to remove empty lines
    Output:
        Data: The file content"""

__author__ = "Zhitong Cui"
__version__ = "2022-2-23"

## -----------------------------------------------------------------------------

ghenv.Component.Name = "Read File"
ghenv.Component.NickName = "ReadFile"

import Grasshopper as gh
import os

def read_lines(fpath, empty=True):
    """Reads the contents of a file line by line.

    Args:
      fpath: An absolute path to a file to read
      empty: By default True to remove empty lines

    Raises:
      OSError: '<fpath>' is not a valid file path
      RuntimeError: Unable to read 'fname'

    Returns:
      The individual lines of data in a list.
    """
    lines = []
    if not os.path.exists(fpath) or not os.path.isfile(fpath):
        raise OSError("'{}' is not a valid file path".format(fpath))

    try:
        with open(fpath) as f:
            for line in f:
                if not empty and (line == '\n' or line == '\r\n'):
                    continue
                lines.append(line)
    except:
        basedir, fname = os.path.split(fpath)
        raise RuntimeError("Unable to read '{}'".format(fname))

    return lines

# ----------------------------------------------

if __name__ == "__main__":
    # Manage path input
    if Path is None:
        e = "Input parameter Path failed to collect data"
        ghenv.Component.AddRuntimeMessage(gh.Kernel.GH_RuntimeMessageLevel.Warning, e)

    if PerLine is None:
        Perline = True

    if Empty is None:
        Empty = True

    if Path is not None:
        # Read data from file
        lines = []
        try:
            lines = read_lines(Path, Empty)
        except Exception as e:
            ghenv.Component.AddRuntimeMessage(gh.Kernel.GH_RuntimeMessageLevel.Error, str(e))
        # Output data
        if PerLine:
            Data = lines
        else:
            Data = "".join(lines)
# ---------- end readfile ----------
unit_z_22 = UnitZ(Factor=subtraction_10)  # disabled
unit_z_23 = UnitZ(Factor=subtraction_10)  # disabled
reverse_11 = Reverse(Vector=unit_z_22)  # disabled
reverse_12 = Reverse(Vector=unit_z_23)  # disabled
unit_z_24 = UnitZ(Factor=addition_25)  # disabled
unit_z_25 = UnitZ(Factor=addition_25)  # disabled
extrude_15 = Extrude(Base=project_5.Geometry, Direction=reverse_11)  # disabled
extrude_16 = Extrude(Base=project_6.Geometry, Direction=reverse_12)  # disabled
reverse_13 = Reverse(Vector=unit_z_24)  # disabled
reverse_14 = Reverse(Vector=unit_z_25)  # disabled
extrude_17 = Extrude(Base=project_7.Geometry, Direction=reverse_13)  # disabled
extrude_18 = Extrude(Base=project_8.Geometry, Direction=reverse_14)  # disabled
rotate_3 = Rotate(Geometry=extrude_13, Angle=expr("-0.25*pi", 1.570796327), Plane=PlaneXY(0, 0, 0))  # -> flatten(Geometry), Transform
rotate_4 = Rotate(Geometry=extrude_14, Angle=expr("-0.25*pi", 1.570796327), Plane=PlaneXY(0, 0, 0))  # -> flatten(Geometry), Transform
unit_z_26 = UnitZ(Factor=bottom_thickness)
solid_union_7 = SolidUnion(Breps=flatten([extrude_11, rotate_3.Geometry]))
solid_union_8 = SolidUnion(Breps=flatten([extrude_12, rotate_4.Geometry]))
colour_picker = ColourPicker(PickedColour=RGBA(163, 148, 49, 82))  # disabled
rotate_5 = Rotate(Geometry=extrude_17, Angle=expr("-0.25*pi", 1.570796327), Plane=PlaneXY(0, 0, 0))  # -> flatten(Geometry), Transform; disabled
rotate_6 = Rotate(Geometry=extrude_18, Angle=expr("-0.25*pi", 1.570796327), Plane=PlaneXY(0, 0, 0))  # -> flatten(Geometry), Transform; disabled
solid_union_9 = SolidUnion(Breps=flatten([extrude_15, rotate_5.Geometry]))  # disabled
solid_union_10 = SolidUnion(Breps=flatten([extrude_16, rotate_6.Geometry]))  # disabled
solid_difference_7 = SolidDifference(BrepsA=cap_holes_2, BrepsB=cap_holes)
solid_union_11 = SolidUnion(Breps=[solid_difference_7, solid_union])
volume_6 = Volume(Geometry=solid_union_7)  # -> Volume, Centroid
scale = Scale(Geometry=solid_union_7, Center=volume_6.Centroid, Factor=lock_scale_factor)  # -> Geometry, Transform
volume_7 = Volume(Geometry=solid_union_8)  # -> Volume, Centroid
scale_2 = Scale(Geometry=solid_union_8, Center=volume_7.Centroid, Factor=lock_scale_factor)  # -> Geometry, Transform
unit_z_27 = UnitZ(Factor="0")
# Tube Holder
# Without Hollow
solid_difference_8 = SolidDifference(BrepsA=solid_union_11, BrepsB=flatten([scale.Geometry, scale_2.Geometry]))
deconstruct_brep_5 = DeconstructBrep(Brep=scale.Geometry)  # -> Faces, Edges, Vertices
list_item_25 = ListItem(List=deconstruct_brep_5.Faces, Index="4", Wrap=True)
unit_z_28 = UnitZ(Factor=lock_height)
reverse_15 = Reverse(Vector=unit_z_28)
move_11 = Move(Geometry=list_item_25, Motion=reverse_15)  # -> Geometry, Transform
volume_8 = Volume(Geometry=solid_union_9)  # -> Volume, Centroid; disabled
scale_3 = Scale(Geometry=solid_union_9, Center=volume_8.Centroid, Factor=lock_scale_factor_2)  # -> Geometry, Transform; disabled
volume_9 = Volume(Geometry=solid_union_10)  # -> Volume, Centroid; disabled
scale_4 = Scale(Geometry=solid_union_10, Center=volume_9.Centroid, Factor=lock_scale_factor_2)  # -> Geometry, Transform; disabled
colour_picker_2 = ColourPicker(PickedColour=RGBA(145, 127, 68, 100))
panel_19 = Panel("""2
4""")
deconstruct_brep_6 = DeconstructBrep(Brep=move_11.Geometry)  # -> Faces, Edges, Vertices
list_item_26 = ListItem(List=deconstruct_brep_6.Edges, Index=panel_19, Wrap=True)
deconstruct_brep_7 = DeconstructBrep(Brep=scale_3.Geometry)  # -> Faces, Edges, Vertices; disabled
list_item_27 = ListItem(List=deconstruct_brep_7.Faces, Index=9, Wrap=True)  # disabled
area_3 = Area(Geometry=list_item_27)  # -> Area, Centroid; disabled
deconstruct = Deconstruct(Point=area_3.Centroid)  # -> XComponent, YComponent, ZComponent; disabled
cotton_constraint = Cylinder(Base=PlaneXY(0, 0, 0), Radius=addition_14, Length=deconstruct.ZComponent)  # disabled
cylinder_14 = Cylinder(Base=PlaneXY(0, 0, 0), Radius=addition_9, Length=deconstruct.ZComponent)  # disabled
cap_holes_17 = CapHoles(Brep=cylinder_14)  # disabled
cap_holes_18 = CapHoles(Brep=cotton_constraint)  # disabled
# Cotton Constraint
cotton_constraint_2 = SolidDifference(BrepsA=cap_holes_18, BrepsB=cap_holes_17)  # disabled
solid_union_12 = SolidUnion(Breps=[cotton_constraint_2, solid_difference_6])  # disabled
colour_picker_3 = ColourPicker(PickedColour=RGBA(116, 125, 184, 100))
curve_middle = CurveMiddle(Curve=list_item_26)
fit_line = FitLine(Points=curve_middle)
surface_split = SurfaceSplit(Surface=move_11.Geometry, Curves=fit_line)
panel_20 = Panel("0.2")  # disabled
# Curved Tubes
scent_number_2 = Slider(2, range=1..20)  # disabled
tube_holder_number = Slider(6, range=1..8)  # disabled
customized_tube_length = Slider(120, range=15..300)  # disabled
minimum_radius_of_curvature = Slider(36, range=0..100)  # disabled
radius_of_curvature = Slider(36, range=-100..100)  # disabled
interval_2 = Slider(2, range=0..50)  # disabled
od_pcb_integration_2 = BooleanToggle(False)  # disabled
expression = Expression(OD_PCB_integration=od_pcb_integration_2, Expression="if (OD_PCB_integration=True, 3.5, 1.5)")  # disabled
expression_2 = Expression(
    horizontal_tube_radius=horizontal_tube_radius,
    OD_PCB_integration=od_pcb_integration_2,
    Expression="if (OD_PCB_integration, if (horizontal_tube_radius=2, 0.5, 0.6), 0.9)")  # disabled
bottom_cylinder_2 = Cylinder(Base=PlaneXY(0, 0, 0), Radius=addition_16, Length=expression)  # disabled
cap_holes_19 = CapHoles(Brep=bottom_cylinder_2)  # disabled
# Bottom Part
bottom_part = SolidUnion(Breps=cap_holes_19)  # disabled
addition_27 = Addition(A=expression, B=addition_17)  # disabled
unit_z_29 = UnitZ(Factor=addition_27)  # disabled
move_12 = Move(Geometry=rotate_3d.Geometry, Motion=unit_z_29)  # -> Geometry, Transform; disabled
deconstruct_brep_8 = DeconstructBrep(Brep=move_12.Geometry)  # -> Faces, Edges, Vertices; disabled
list_item_28 = ListItem(List=deconstruct_brep_8.Faces, Index=1, Wrap=True)  # disabled
cylinder_15 = Cylinder(Base=list_item_28, Radius=addition_18, Length=addition_19)  # disabled
cap_holes_20 = CapHoles(Brep=cylinder_15)  # disabled
solid_difference_9 = SolidDifference(BrepsA=cap_holes_20, BrepsB=move_12.Geometry)  # disabled
deconstruct_brep_9 = DeconstructBrep(Brep=solid_difference_9)  # -> Faces, Edges, Vertices; disabled
unit_x = UnitX(Factor=addition_9)  # disabled
list_item_29 = ListItem(List=deconstruct_brep_9.Edges, Index=0, Wrap=True)  # disabled
# Straight Tubes
move_13 = Move(Geometry=move_12.Geometry, Motion=unit_x)  # -> Geometry, Transform; disabled
deconstruct_brep_10 = DeconstructBrep(Brep=move_13.Geometry)  # -> Faces, Edges, Vertices; disabled
list_item_30 = ListItem(List=deconstruct_brep_10.Faces, Index=0, Wrap=True)  # disabled
deconstruct_arc_3 = DeconstructArc(Arc=list_item_30)  # -> BasePlane, Radius, Angle; disabled
addition_28 = Addition(Radius=deconstruct_arc_3.Radius, Tol=panel_20)  # disabled
area_4 = Area(Geometry=list_item_30)  # -> Area, Centroid; disabled
area_5 = Area(Geometry=list_item_29)  # -> Area, Centroid; disabled
distance = Distance(PointA=area_4.Centroid, PointB=area_5.Centroid)  # disabled
vector_2pt_6 = Vector2Pt(PointA=area_4.Centroid, PointB=area_5.Centroid, Unitize=False)  # -> Vector, Length; disabled
file_path_2 = FilePath("C:\Users\richluo\Desktop\cuizhitong\OneDrive - zju.edu.cn\OlfacKit\GhPython\horizontal_permutation.py")  # disabled
tube_pattern_type = ValueList({"Straight Tubes", "Curved Tubes"}, selected="Straight Tubes")  # disabled
file_path_3 = FilePath("C:\Users\richluo\Desktop\cuizhitong\OneDrive - zju.edu.cn\OlfacKit\GhPython\horizontal_multi_scent_display.py")  # disabled
permutation_pattern_2 = ValueList({"Circle Pattern", "Line Pattern"}, selected="Circle Pattern")  # disabled
explode_tree = ExplodeTree(Data=graft(surface_split))  # -> _0000, _0001
area_6 = Area(Geometry=explode_tree._0001)  # -> Area, Centroid
deconstruct_2 = Deconstruct(Point=area_6.Centroid)  # -> XComponent, YComponent, ZComponent
readfile_2 = ReadFile(Path=file_path_2)  # -> out, Data; disabled; same code as readfile
readfile_3 = ReadFile(Path=file_path_3)  # -> out, Data; disabled; same code as readfile
subtraction_11 = Subtraction(A=deconstruct_2.ZComponent, B=peizo_holder_lock_height)
angle_adjustable = BooleanToggle(True)

# ----
# Hook
ball_or_not = BooleanToggle(False)
targetthickness = Slider(6, range=4..30)
hook = Hook(A=targetthickness, ball_or_not=angle_adjustable)
geometry = Geometry(hook)

# ----
# Ring
interval_3 = Slider(8, range=0..50)
ringx = Slider(8, range=5..30)
single_double = BooleanToggle(True)
ringy = Slider(24, range=5..30)
corner = Slider(6, range=0..10)
ring_ear = RingEar(
    x_coordinate=interval_3,
    x_size=ringx,
    y_size=ringy,
    radius_2=corner,
    A=ringx,
    radius=corner,
    value=single_double,
    A_2=ringy)
geometry_2 = Geometry(ring_ear)

# ----
# Cylinder Clip
ball_or_not_2 = BooleanToggle(True)
targetradius = Slider(30, range=24..100)
clip_round = Clip_Round(A=targetradius, ball_or_not=angle_adjustable)
geometry_3 = Geometry(clip_round)

# ----
# Cubic Clip
ball_or_not_3 = BooleanToggle(False)
targetdepth = Slider(30, range=20..100)
targetwidth = Slider(30, range=20..100)
clip_square = Clip_Square(A=targetdepth, y_size=targetwidth, A_2=targetwidth, ball_or_not=angle_adjustable)
geometry_4 = Geometry(clip_square)

# ----
# Elastic
single_double_2 = BooleanToggle(True)
interval_4 = Slider(8, range=0..50)
t_size = Slider(10, range=8..12)
t_t = T_T(x_coordinate=interval_4, x_size=t_size, A_2=t_size, A=t_size, value=single_double_2, y_size=t_size)
geometry_5 = Geometry(t_t)

# ----
# Stand
baseradius = Slider(30, range=0..100)
basethickness = Slider(5, range=5..50)
standradius = Slider(5, range=5..10)
standheight = Slider(100, range=30..200)
stand = Stand(
    radius=baseradius,
    length=basethickness,
    factor=basethickness,
    radius_2=standradius,
    length_2=standheight,
    A=standheight,
    B=basethickness)
geometry_6 = Geometry(stand)

boolean_toggle = BooleanToggle(True)  # disabled

# ----
# Sticker
ball_or_not_4 = BooleanToggle(True)
cluster = Cluster_3(ball_or_not=angle_adjustable)
geometry_7 = Geometry(cluster)

colour_picker_4 = ColourPicker(PickedColour=RGBA(26, 134, 207, 120))  # disabled
colour_picker_5 = ColourPicker(PickedColour=RGBA(26, 136, 201, 120))  # disabled
unit_z_30 = UnitZ(Factor=subtraction_11)
reverse_16 = Reverse(Vector=unit_z_30)
extrude_19 = Extrude(Base=explode_tree._0001, Direction=reverse_16)

# ----
# Magnet
ball_or_not_5 = BooleanToggle(True)
cluster_2 = Cluster_2(ball_or_not=angle_adjustable)
geometry_8 = Geometry(cluster_2)

file_path_4 = FilePath("C:\Users\richluo\Desktop\cuizhitong\OneDrive - zju.edu.cn\OlfacKit\GhPython\adjust_tube_number.py")  # disabled
readfile_4 = ReadFile(Path=file_path_4)  # -> out, Data; disabled; same code as readfile
pcb_attachment_methods = ValueList({"No_Attachment": "no_attachment", "Cylinder Clip": "cylinder_clip", "Cubic Clip": "cubic_clip", "Hair Clip Connector": "hair_clip_connector", "Hook": "hook", "Ring": "ring", "Elastic": "elastic", "Stand": "stand", "Magnet": "magnet", "Sticker": "sticker"}, selected="Hook")
od_attachment_methods = ValueList({"No_Attachment": "no_attachment", "Cylinder Clip": "cylinder_clip", "Cubic Clip": "cubic_clip", "Hair Clip Connector": "hair_clip_connector", "Hook": "hook", "Ring": "ring", "Elastic": "elastic", "Stand": "stand", "Magnet": "magnet", "Sticker": "sticker"}, selected="Cubic Clip")
deconstruct_brep_11 = DeconstructBrep(Brep=extrude_19)  # -> Faces, Edges, Vertices
list_item_31 = ListItem(List=deconstruct_brep_11.Faces, Index="4", Wrap=True)
area_7 = Area(Geometry=list_item_31)  # -> Area, Centroid
deconstruct_3 = Deconstruct(Point=area_7.Centroid)  # -> XComponent, YComponent, ZComponent
vector_xyz = VectorXYZ(XComponent=deconstruct_3.XComponent, YComponent=deconstruct_3.YComponent, ZComponent=0)  # -> Vector, Length
reverse_17 = Reverse(Vector=vector_xyz.Vector)
curve_to_polyline = CurveToPolyline(Curve=list_item_31, ToleranceDistance=0, ToleranceAngle=0)  # -> Polyline, Segments
fillet = Fillet(Curve=curve_to_polyline.Polyline, Radius="3")
boundary_surfaces_7 = BoundarySurfaces(Edges=fillet)
ghpython_script = GhPythonScript(Code=readfile_4.Data, Scent_number=scent_number_2, Tube_holder_number=tube_holder_number)  # -> Out, Tube_holder_number; disabled
polar_array = PolarArray(Geometry=move_12.Geometry, Plane=PlaneXY(0, 0, 0), Count=ghpython_script.Tube_holder_number, Angle=6.283185307)  # -> flatten(Geometry), Transform; disabled
polar_array_2 = PolarArray(Geometry=solid_difference_9, Plane=PlaneXY(0, 0, 0), Count=ghpython_script.Tube_holder_number, Angle=6.283185307)  # -> Geometry, Transform; disabled
hole_polar_array = Move(Geometry=polar_array.Geometry, Motion=unit_z_13)  # -> Geometry, Transform; disabled
# Piezo Holder Cap Part
tube_holder_polar_array = Move(Geometry=polar_array_2.Geometry, Motion=unit_z_14)  # -> Geometry, Transform; disabled
solid_difference_10 = SolidDifference(BrepsA=solid_union_12, BrepsB=flatten(hole_polar_array.Geometry))  # disabled
solid_union_13 = SolidUnion(Breps=flatten([solid_difference_10, bottom_part, tube_holder_polar_array.Geometry]))  # disabled

# ----
# Piezo Holder
# Tube Holder
solid_union_14 = SolidUnion(Breps=flatten([solid_difference_5, solid_union_5]))  # disabled
solid_difference_11 = SolidDifference(BrepsA=solid_union_13, BrepsB=flatten([scale_3.Geometry, scale_4.Geometry]))  # disabled

move_14 = Move(Geometry=solid_union_14, Motion=unit_z_21)  # -> Geometry, Transform; disabled
custom_preview = CustomPreview(Geometry=move_14.Geometry, Material=colour_picker)  # disabled

# ----
# Hair Clip Connector
geometry_9 = Geometry(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)

panel_21 = Panel("3")  # disabled
reverse_18 = Reverse(Vector=expr("x*-0.3", vector_xyz.Vector))
move_15 = Move(Geometry=boundary_surfaces_7, Motion=reverse_18)  # -> Geometry, Transform
panel_22 = Panel("2")  # disabled
panel_23 = Panel("0")  # disabled
unit_z_31 = UnitZ(Factor=expression)  # disabled
unit_x_2 = UnitX(Factor=distance)  # disabled
file_path_5 = FilePath("/Users/cuizhitong/OneDrive - zju.edu.cn/OlfacKit/GhPython/vertical_attachments.py")
deconstruct_brep_12 = DeconstructBrep(Brep=cap_holes_19)  # -> Faces, Edges, Vertices; disabled
hollow_out_number = Slider(4, range=0..10)
extrude_20 = Extrude(Base=move_15.Geometry, Direction=reverse_17)
# use maximum hollow_out_number=4 to avoid easy broke
polar_array_3 = PolarArray(Geometry=extrude_20, Plane=PlaneXY(0, 0, 0), Count=hollow_out_number, Angle=6.283185307)  # -> Geometry, Transform
solid_difference_12 = SolidDifference(BrepsA=solid_difference_8, BrepsB=polar_array_3.Geometry)
# Tube Holder
rotate_7 = Rotate(Geometry=solid_difference_12, Angle=1.570796327, Plane=PlaneXY(0, 0, 0))  # -> Geometry, Transform
ghpython_script_2 = GhPythonScript(
    Code=readfile.Data,
    Piezo_holder=rotate_2.Geometry,
    Tube_holder=rotate_7.Geometry,
    Scent_number=scent_number,
    Permutation_pattern=permutation_pattern,
    Interval=interval,
    Pcb_case=pcb_case,
    Pcb_guide=pcb_guide,
    OD_PCB_integration=od_pcb_integration,
    Pcb_guide_position=pcb_guide_position,
    Add_attachments_toOD=add_attachments_tood,
    Pcb_guide_onOD=pcb_guide_onod)  # -> Out, Permutation_circle, Permutation_piezo_holder, Permutation_tube_holder, Pedestal, Pcb_case_placement, Pcb_bottom_curve, Pedestal_polyline, OD_pcb_guide
geometry_10 = Geometry(ghpython_script_2.Pcb_case_placement)
geometry_11 = Geometry(ghpython_script_2.OD_pcb_guide)
geometry_12 = Geometry(ghpython_script_2.Permutation_circle)
geometry_13 = Geometry(ghpython_script_2.Permutation_piezo_holder)
geometry_14 = Geometry(ghpython_script_2.Permutation_tube_holder)
geometry_15 = Geometry(ghpython_script_2.Pedestal)
extrude_21 = Extrude(Pedestal=geometry_15, Direction=unit_z_26)
panel_24 = Panel(ghpython_script_2.Out)
move_16 = Move(Geometry=geometry_13, Motion=unit_z_27)  # -> Geometry, Transform
custom_preview_2 = CustomPreview(Geometry=move_16.Geometry, Material=colour_picker_2)
custom_preview_3 = CustomPreview(Geometry=geometry_14, Material=colour_picker_3)
list_item_32 = ListItem(List=deconstruct_brep_12.Faces, Index=panel_23, Wrap=True)  # disabled
multiplication = Multiplication(A=addition_17, B=panel_22)  # disabled
multiplication_2 = Multiplication(A=multiplication, B=expression_2)  # disabled
addition_29 = Addition(Horizontal_tube_radius=multiplication_2, Pedestal_height=expression)  # disabled
readfile_5 = ReadFile(Path=file_path_5)  # -> out, Data; same code as readfile
ghpython_script_3 = GhPythonScript(
    Code=readfile_5.Data,
    Scent_number=scent_number,
    OD_PCB_integration=od_pcb_integration,
    Pcb_guide_position=pcb_guide_position,
    Add_attachments_toOD=add_attachments_tood,
    Angle_adjustable=angle_adjustable,
    PCB_attachment_methods=pcb_attachment_methods,
    OD_attachment_methods=od_attachment_methods,
    Cylinder_clip=geometry_3,
    Cubic_clip=geometry_4,
    Hair_clip_connector=geometry_9,
    Hook=geometry,
    Ring=geometry_2,
    Elastic=geometry_5,
    Stand=geometry_6,
    Magnet=geometry_8,
    Sticker=geometry_7)  # -> Out, Pcb_gen_attchment, Od_gen_attchment
panel_25 = Panel(ghpython_script_3.Out)
magnet_radius = Slider(4.9, range=0..10)  # disabled
magnet_height = Slider(2, range=0..100)  # disabled
sphere = Sphere(Base=PlaneXY(0, 0, 0), Radius=addition_29)  # disabled
split_brep = SplitBrep(Brep=sphere, Cutter=list_item_32)  # disabled
explode_tree_2 = ExplodeTree(Data=graft(split_brep))  # -> Branch0, Branch1; disabled
cap_holes_21 = CapHoles(Brep=flatten(explode_tree_2.Branch0))  # disabled
# Straight Pedestal
reverse_19 = Reverse(Vector=unit_x_2)  # disabled
solid_union_15 = SolidUnion()  # disabled
unit_z_32 = UnitZ(Factor=expression)  # disabled
geometry_16 = Geometry(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)  # disabled
# PCB Case with Magnets
point = Point(Point(179.8711048, 0, 27.23564967))  # disabled
magnet_radius_2 = Slider(5, range=0..10)  # disabled
magnet_height_2 = Slider(2, range=0..100)  # disabled
panel_26 = Panel("2")  # disabled
bounding_box = BoundingBox(Content=geometry_16, Plane=PlaneXY(0, 0, 0))  # -> Box, Box_2; disabled
geometry_17 = Geometry(ghpython_script_3.Od_gen_attchment)
geometry_18 = Geometry(ghpython_script_3.Pcb_gen_attchment)
unit_z_33 = UnitZ(Factor=expr("x", expression))  # disabled
panel_27 = Panel("2")  # disabled
colour_picker_6 = ColourPicker(PickedColour=RGBA(36, 171, 155, 83))  # disabled
deconstruct_brep_13 = DeconstructBrep(Brep=bounding_box.Box)  # -> Faces, Edges, Vertices; disabled
geometry_19 = Geometry(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)  # disabled
# Curved Tubes
ghpython_script_4 = GhPythonScript(
    Code=readfile_2.Data,
    Scent_number=scent_number_2,
    Tube_holder_number=tube_holder_number,
    Tube_pattern_type=tube_pattern_type,
    Customized_tube_length=customized_tube_length,
    Minimum_radius_of_curvature=minimum_radius_of_curvature,
    Radius_of_curvature=radius_of_curvature,
    Arc_start_point=area_5.Centroid,
    Arc_direction=vector_2pt_6.Vector,
    Inner_tube_length=distance,
    Tube_holder=solid_difference_11,
    Permutation_pattern=permutation_pattern_2,
    Interval=interval_2,
    Limiter=cap_holes_21,
    Limiter_radius=addition_29,
    Pedestal_height=expression,
    OD_PCB_integration=od_pcb_integration_2,
    Magnet_radius=magnet_radius,
    Pcb_case_without_magnets=geometry_19)  # -> Out, Base_circle, Pivot_center, Line_pattern_vec_list, Straight_tube_length, Curved_tube_length, Required_tube_length, Arc_end_point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; disabled
addition_30 = Addition(Inner_tube_length=distance, Customized_tube_length=ghpython_script_4.Straight_tube_length)  # disabled
cylinder_16 = Cylinder(Base=list_item_30, Radius=addition_28, Length=addition_30)  # disabled
arc_sed = ArcSED(Start=area_5.Centroid, End=ghpython_script_4.Arc_end_point, Direction=vector_2pt_6.Vector)  # -> Arc, Plane, Radius; disabled
length = Length(Curve=arc_sed.Arc)  # disabled
panel_28 = Panel(length)  # disabled
cap_holes_22 = CapHoles(Brep=cylinder_16)  # disabled
pipe = Pipe(Curve=arc_sed.Arc, Radius=addition_28, Caps=boolean_toggle)  # disabled
polar_array_4 = PolarArray(Geometry=cap_holes_22, Plane=PlaneXY(0, 0, 0), Count=ghpython_script.Tube_holder_number, Angle=6.283185307)  # -> Geometry, Transform; disabled
polar_array_5 = PolarArray(Geometry=pipe, Plane=PlaneXY(0, 0, 0), Count=ghpython_script.Tube_holder_number, Angle=6.283185307)  # -> Geometry, Transform; disabled
custom_preview_4 = CustomPreview(Geometry=polar_array_4.Geometry, Material=colour_picker_4)  # disabled
# Straight Tubes
custom_preview_5 = CustomPreview(Geometry=polar_array_5.Geometry, Material=colour_picker_5)  # disabled
extrude_22 = Extrude(Base=ghpython_script_4.Pedestal_srf_curved_tube, Direction=unit_z_31)  # disabled
deconstruct_brep_14 = DeconstructBrep(Brep=extrude_22)  # -> Faces, Edges, Vertices; disabled
list_item_33 = ListItem(List=deconstruct_brep_14.Faces, Index=panel_21, Wrap=True)  # disabled
# Generated Limiters
panel_29 = Panel(ghpython_script_4.Out)  # disabled
extrude_23 = Extrude(Base=list_item_33, Direction=reverse_19)  # disabled
solid_union_16 = SolidUnion(Breps=flatten([extrude_22, extrude_23]))  # disabled
polar_array_6 = PolarArray(Geometry=solid_union_16, Plane=PlaneXY(0, 0, 0), Count=ghpython_script.Tube_holder_number, Angle=6.283185307)  # -> Geometry, Transform; disabled
surface = Surface(ghpython_script_4.Pedestal_srf_straight_tube)  # disabled
extrude_24 = Extrude(Base=surface, Direction=unit_z_32)  # disabled
polar_array_7 = PolarArray(Geometry=extrude_24, Plane=PlaneXY(0, 0, 0), Count=ghpython_script.Tube_holder_number, Angle=6.283185307)  # -> Geometry, Transform; disabled
polar_array_8 = PolarArray(
    Geometry=ghpython_script_4.Gen_limiters,
    Plane=PlaneXY(0, 0, 0),
    Count=ghpython_script.Tube_holder_number,
    Angle=6.283185307)  # -> Geometry, Transform; disabled
move_17 = Move(Geometry=polar_array_8.Geometry, Motion=unit_z_33)  # -> Geometry, Transform; disabled
custom_preview_6 = CustomPreview(Geometry=flatten(polar_array_7.Geometry), Material=colour_picker_6)  # disabled
# Curved Pedestal
geometry_20 = Geometry(ghpython_script_4.Inner_pedestal)  # disabled
panel_30 = Panel("5")  # disabled
ghpython_script_5 = GhPythonScript(
    limiters=move_17.Geometry,
    permutation_pattern=permutation_pattern_2,
    tube_pattern_type=tube_pattern_type,
    straight_tubes=polar_array_4.Geometry,
    curved_tubes=polar_array_5.Geometry)  # -> out, flatten(final_limiters); disabled
# ---------- ghpython_script_5: Python ----------
__author__ = "richluo"
__version__ = "2022.03.06"

import rhinoscriptsyntax as rs

if permutation_pattern == "Line Pattern":
    # line pattern can only use straight tubes
    tube_pattern_type = 'Straight Tubes'

if tube_pattern_type == 'Straight Tubes':
    final_limiters = rs.BooleanDifference(limiters, straight_tubes, delete_input=False)
elif tube_pattern_type == 'Curved Tubes':
    final_limiters = rs.BooleanDifference(limiters, curved_tubes, delete_input=False)
# ---------- end ghpython_script_5 ----------
merge = Merge(
    Data1=move_14.Geometry,
    Data2=solid_difference_11,
    Data3=flatten(polar_array_4.Geometry),
    Data4=flatten(polar_array_7.Geometry),
    Data5=ghpython_script_5.final_limiters)  # disabled
merge_2 = Merge(
    Data1=move_14.Geometry,
    Data2=solid_difference_11,
    Data3=flatten(polar_array_5.Geometry),
    Data4=flatten(polar_array_6.Geometry),
    Data5=ghpython_script_5.final_limiters)  # disabled
# Mutiple Scent Display
ghpython_script_6 = GhPythonScript(
    Code=readfile_3.Data,
    Scent_number=scent_number_2,
    Permutation_pattern=permutation_pattern_2,
    Tube_pattern_type=tube_pattern_type,
    Pivot_center=ghpython_script_4.Pivot_center,
    Line_pattern_vec_list=ghpython_script_4.Line_pattern_vec_list,
    Objects_straight=merge,
    Objects_curved=merge_2)  # -> Out, Tube_holder_list, Straight_tube_list, Straight_pedestal_list, Curved_tube_list, Curved_pedestal_list, Limiters_list; disabled
geometry_21 = Geometry(ghpython_script_6.Tube_holder_list)  # disabled
geometry_22 = Geometry(ghpython_script_6.Straight_tube_list)  # disabled
geometry_23 = Geometry(ghpython_script_6.Straight_pedestal_list)  # disabled
geometry_24 = Geometry(ghpython_script_6.Curved_tube_list)  # disabled
geometry_25 = Geometry(ghpython_script_6.Curved_pedestal_list)  # disabled
geometry_26 = Geometry(ghpython_script_6.Limiters_list)  # disabled
geometry_27 = Geometry(ghpython_script_4.Pcb_case_preview)  # disabled
panel_31 = Panel("5")  # disabled
list_item_34 = ListItem(List=deconstruct_brep_13.Faces, Index=panel_31, Wrap=True)  # disabled
solid_union_17 = SolidUnion(Breps=flatten([ghpython_script_5.final_limiters, polar_array_6.Geometry]))  # disabled
unit_x_3 = UnitX(Factor=expr("x*2+4", magnet_radius))  # disabled
unit_x_4 = UnitX(Factor=expr("x*2+4", magnet_radius_2))  # disabled
area_8 = Area(Geometry=list_item_34)  # -> Area, Centroid; disabled
vector_2pt_7 = Vector2Pt(PointA=area_8.Centroid, PointB=point, Unitize=False)  # -> Vector, Length; disabled
move_18 = Move(Geometry=area_8.Centroid, Motion=vector_2pt_7.Vector)  # -> Geometry, Transform; disabled
deconstruct_4 = Deconstruct(Point=move_18.Geometry)  # -> XComponent, YComponent, ZComponent; disabled
subtraction_12 = Subtraction(A=deconstruct_4.XComponent, B=magnet_radius_2)  # disabled
subtraction_13 = Subtraction(A=deconstruct_4.ZComponent, B=magnet_height_2)  # disabled
subtraction_14 = Subtraction(A=subtraction_12, B=panel_27)  # disabled
construct_point = ConstructPoint(XCoordinate=subtraction_14, YCoordinate=deconstruct_4.YComponent, ZCoordinate=subtraction_13)  # disabled
cylinder_17 = Cylinder(Base=construct_point, Radius=magnet_radius_2, Length=magnet_height_2)  # disabled
move_19 = Move(Geometry=geometry_16, Motion=vector_2pt_7.Vector)  # -> Geometry, Transform; disabled
magnet = CapHoles(Brep=cylinder_17)  # disabled
move_20 = Move(Geometry=magnet, Motion=unit_x_4)  # -> Geometry, Transform; disabled
colour_picker_7 = ColourPicker(PickedColour=RGBA(36, 171, 155, 83))  # disabled
# Curved Pedestal & Limiters
custom_preview_7 = CustomPreview(Geometry=flatten(solid_union_17), Material=colour_picker_7)  # disabled
unit_z_34 = UnitZ(Factor=magnet_height)  # disabled
# PCB Case with Magnets
solid_difference_13 = SolidDifference(BrepsA=move_19.Geometry, BrepsB=[magnet, move_20.Geometry])  # disabled
bounding_box_2 = BoundingBox(Content=solid_difference_13, Plane=PlaneXY(0, 0, 0))  # -> Box, Box_2; disabled
deconstruct_brep_15 = DeconstructBrep(Brep=bounding_box_2.Box)  # -> Faces, Edges, Vertices; disabled
# PCB Case without Magnets
list_item_35 = ListItem(List=deconstruct_brep_15.Faces, Index=panel_30, Wrap=True)  # disabled
area_9 = Area(Geometry=list_item_35)  # -> Area, Centroid; disabled
vector_2pt_8 = Vector2Pt(PointA=area_9.Centroid, PointB=ghpython_script_4.Magnets_placement_point, Unitize=False)  # -> Vector, Length; disabled
move_21 = Move(Geometry=area_9.Centroid, Motion=vector_2pt_8.Vector)  # -> Geometry, Transform; disabled
deconstruct_5 = Deconstruct(Point=move_21.Geometry)  # -> XComponent, YComponent, ZComponent; disabled
subtraction_15 = Subtraction(A=deconstruct_5.XComponent, B=magnet_radius)  # disabled
subtraction_16 = Subtraction(A=deconstruct_5.ZComponent, B=magnet_height)  # disabled
subtraction_17 = Subtraction(A=subtraction_15, B=panel_26)  # disabled
construct_point_2 = ConstructPoint(XCoordinate=subtraction_17, YCoordinate=deconstruct_5.YComponent, ZCoordinate=subtraction_16)  # disabled
cylinder_18 = Cylinder(Base=construct_point_2, Radius=magnet_radius, Length=magnet_height)  # disabled
move_22 = Move(Geometry=solid_difference_13, Motion=vector_2pt_8.Vector)  # -> Geometry, Transform; disabled
magnet_2 = CapHoles(Brep=cylinder_18)  # disabled
move_23 = Move(Geometry=magnet_2, Motion=unit_x_3)  # -> Geometry, Transform; disabled
rotate_8 = Rotate(
    Geometry=move_22.Geometry,
    Angle=ghpython_script_4.Magnets_rotation_angle,
    Plane=ghpython_script_4.Magnets_placement_point)  # -> Geometry, Transform; disabled
# Magnets on OD
move_24 = Move(Geometry=[magnet_2, move_23.Geometry], Motion=unit_z_34)  # -> Geometry, Transform; disabled
rotate_9 = Rotate(
    Geometry=move_24.Geometry,
    Angle=ghpython_script_4.Magnets_rotation_angle,
    Plane=ghpython_script_4.Magnets_placement_point)  # -> Geometry, Transform; disabled
# inner pedestal without magnets
solid_difference_14 = SolidDifference(BrepsB=rotate_9.Geometry)  # disabled
# inner pedestal with magnets
geometry_28 = Geometry(solid_difference_14)  # disabled
angle_adjustable_2 = BooleanToggle(True)  # disabled
# PCB Case with Magnets
colour_picker_8 = ColourPicker(PickedColour=RGBA(89, 102, 117, 107))  # disabled
custom_preview_8 = CustomPreview(Geometry=flatten(rotate_8.Geometry), Material=colour_picker_8)  # disabled

# ----
# Hook
ball_or_not_6 = BooleanToggle(False)  # disabled
targetthickness_2 = Slider(6, range=4..30)  # disabled
hook_2 = Hook(A=targetthickness_2, ball_or_not=angle_adjustable_2)  # disabled
geometry_29 = Geometry(hook_2)  # disabled

# ----
# Ring
single_double_3 = BooleanToggle(True)  # disabled
interval_5 = Slider(8, range=0..50)  # disabled
ringx_2 = Slider(8, range=5..30)  # disabled
ringy_2 = Slider(24, range=5..30)  # disabled
corner_2 = Slider(6, range=0..10)  # disabled
ring_ear_2 = RingEar(
    x_coordinate=interval_5,
    x_size=ringx_2,
    y_size=ringy_2,
    radius_2=corner_2,
    A=ringx_2,
    radius=corner_2,
    value=single_double_3,
    A_2=ringy_2)  # disabled
geometry_30 = Geometry(ring_ear_2)  # disabled

# ----
# Cylinder Clip
ball_or_not_7 = BooleanToggle(True)  # disabled
targetradius_2 = Slider(30, range=24..100)  # disabled
clip_round_2 = Clip_Round(A=targetradius_2, ball_or_not=angle_adjustable_2)  # disabled
geometry_31 = Geometry(clip_round_2)  # disabled

# ----
# Cubic Clip
ball_or_not_8 = BooleanToggle(False)  # disabled
targetdepth_2 = Slider(40, range=20..100)  # disabled
targetwidth_2 = Slider(40, range=20..100)  # disabled
clip_square_2 = Clip_Square(A=targetdepth_2, y_size=targetwidth_2, A_2=targetwidth_2, ball_or_not=angle_adjustable_2)  # disabled
geometry_32 = Geometry(clip_square_2)  # disabled

# ----
# Elastic
single_double_4 = BooleanToggle(True)  # disabled
interval_6 = Slider(8, range=0..50)  # disabled
t_size_2 = Slider(10, range=8..12)  # disabled
t_t_2 = T_T(x_coordinate=interval_6, x_size=t_size_2, A_2=t_size_2, A=t_size_2, value=single_double_4, y_size=t_size_2)  # disabled
geometry_33 = Geometry(t_t_2)  # disabled

# ----
# Stand
baseradius_2 = Slider(30, range=0..100)  # disabled
basethickness_2 = Slider(6, range=6..50)  # disabled
standradius_2 = Slider(5, range=5..10)  # disabled
standheight_2 = Slider(100, range=30..200)  # disabled
stand_2 = Stand(
    radius=baseradius_2,
    length=basethickness_2,
    factor=basethickness_2,
    radius_2=standradius_2,
    length_2=standheight_2,
    A=standheight_2,
    B=basethickness_2)  # disabled
geometry_34 = Geometry(stand_2)  # disabled

# ----
# Sticker
ball_or_not_9 = BooleanToggle(True)  # disabled
cluster_3 = Cluster_3(ball_or_not=angle_adjustable_2)  # disabled
geometry_35 = Geometry(cluster_3)  # disabled

# ----
# Magnet
ball_or_not_10 = BooleanToggle(True)  # disabled
cluster_4 = Cluster_2(ball_or_not=angle_adjustable_2)  # disabled
geometry_36 = Geometry(cluster_4)  # disabled

pcb_attachment_methods_2 = ValueList({"No_Attachment": "no_attachment", "Cylinder Clip": "cylinder_clip", "Cubic Clip": "cubic_clip", "Hair Clip Connector": "hair_clip_connector", "Hook": "hook", "Ring": "ring", "Elastic": "elastic", "Stand": "stand", "Magnet": "magnet", "Sticker": "sticker"}, selected="Stand")  # disabled
od_attachment_methods_2 = ValueList({"No_Attachment": "no_attachment", "Cylinder Clip": "cylinder_clip", "Cubic Clip": "cubic_clip", "Hair Clip Connector": "hair_clip_connector", "Hook": "hook", "Ring": "ring", "Elastic": "elastic", "Stand": "stand", "Magnet": "magnet", "Sticker": "sticker"}, selected="Ring")  # disabled

# ----
# Hair Clip Connector
geometry_37 = Geometry(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)  # disabled
file_path_6 = FilePath("C:\Users\richluo\Desktop\cuizhitong\OneDrive - zju.edu.cn\OlfacKit\GhPython\horizontal_attachments.py")  # disabled
readfile_6 = ReadFile(Path=file_path_6)  # -> out, Data; disabled; same code as readfile
ghpython_script_7 = GhPythonScript(
    Code=readfile_6.Data,
    OD_PCB_integration=od_pcb_integration_2,
    Angle_adjustable=angle_adjustable_2,
    PCB_attachment_methods=pcb_attachment_methods_2,
    OD_attachment_methods=od_attachment_methods_2,
    Cylinder_clip=geometry_31,
    Cubic_clip=geometry_32,
    Hair_clip_connector=geometry_37,
    Hook=geometry_29,
    Ring=geometry_30,
    Elastic=geometry_33,
    Stand=geometry_34,
    Magnet=geometry_36,
    Sticker=geometry_35)  # -> Out, Pcb_gen_attchment, Od_gen_attchment; disabled
panel_32 = Panel(ghpython_script_7.Out)  # disabled
geometry_38 = Geometry(ghpython_script_7.Pcb_gen_attchment)  # disabled
geometry_39 = Geometry(ghpython_script_7.Od_gen_attchment)  # disabled

# ==== cluster Clip_Round
cliphight = Slider(18, range=18..100)
clipwide = Slider(4, range=4..10)

# ----
# Guide_T(標準件)
# GuideA
# GuideB
cluster = Cluster(factor="18", A="18")  # -> result, extrusion
geometry = Geometry(cluster.result)
geometry_2 = Geometry(cluster.extrusion)

# ----
# Clip_round
panel = Panel("1")

# ----
# square
rectangle = Rectangle(Plane=PlaneXY(0, 0, 0), XSize="14", YSize="18", Radius=0)  # -> Rectangle, Length
unit_z = UnitZ(Factor="5")
division = Division(A="14", B="2")
division_2 = Division(A="18", B="2")
extrude = Extrude(Base=rectangle.Rectangle, Direction=unit_z)
negative = Negative(Value=division)
negative_2 = Negative(Value=division_2)
cap_holes = CapHoles(Brep=extrude)
construct_point = ConstructPoint(XCoordinate=negative, YCoordinate=negative_2, ZCoordinate=0)
move = Move(Geometry=cap_holes, Motion=construct_point)  # -> Geometry, Transform

division_3 = Division(A="18", B="2")
A = ClusterInput()
cushion = Panel("1")
addition = Addition(A=A, B=cushion)
negative_3 = Negative(Value=division_3)
openangle = Slider(120, range=0..180)
addition_2 = Addition(A=addition, B=clipwide)
addition_3 = Addition(A=addition_2, B=panel)
construct_point_2 = ConstructPoint(XCoordinate=addition_3, YCoordinate=0, ZCoordinate=0)
point = Point(Point(0, 0, 0))
radians = Radians(Degrees=openangle)

# ----
# Universal ball
ball_radius = Slider(6, range=5..7)
extended_length_ratio = Slider(1.5, range=0..10)
universal_ball = Universal_ball(ball_radius=ball_radius, extended_length_ratio=extended_length_ratio, ratio_of_ball_holder=Slider(1, range=0.9..1.1))  # -> ball_2, substracted_ball_3, cubic
ghpython_script = GhPythonScript(x=universal_ball.ball_2, y=universal_ball.substracted_ball_3)  # -> out, a
# ---------- ghpython_script: Python ----------
__author__ = "richluo"
__version__ = "2021.09.26"

import rhinoscriptsyntax as rs

objects = []
objects.append(x)
objects.append(y)

# print objects
center = rs.CreatePoint(0,0,0)
vector = rs.CreateVector(1,0,0)
a = rs.RotateObjects(objects, center, 180.0, vector, None)
# ---------- end ghpython_script ----------
geometry_3 = Geometry(ghpython_script.a)
geometry_4 = Geometry(universal_ball.ball_2)
geometry_5 = Geometry(universal_ball.cubic)
explode_tree = ExplodeTree(Data=graft(geometry_3))  # -> Branch0, Branch1
geometry_6 = Geometry(universal_ball.substracted_ball_3)
geometry_7 = Geometry(explode_tree.Branch0)
geometry_8 = Geometry(explode_tree.Branch1)
unit_z_2 = UnitZ(Factor=Slider(20, range=0..100))
move_2 = Move(Geometry=geometry_8, Motion=unit_z_2)  # -> Geometry, Transform
unit_z_3 = UnitZ(Factor=Slider(0, range=0..100))
move_3 = Move(Geometry=geometry_7, Motion=unit_z_3)  # -> Geometry, Transform
solid_difference = SolidDifference(BrepsA=geometry_5, BrepsB=move_2.Geometry)

# ----
# Universal ball holder_round
panel_2 = Panel("3.2")
multiplication = Multiplication(A=ball_radius, B=panel_2)
multiplication_2 = Multiplication(A=ball_radius, B="1.8")
rectangle_2 = Rectangle(Plane=PlaneXY(0, 0, 0), XSize=cliphight, YSize=multiplication, Radius="2")  # -> Rectangle, Length
unit_z_4 = UnitZ(Factor=multiplication_2)
division_4 = Division(A=cliphight, B="2")
division_5 = Division(A=multiplication, B="2")
extrude_2 = Extrude(Base=rectangle_2.Rectangle, Direction=unit_z_4)
negative_4 = Negative(Value=division_4)
negative_5 = Negative(Value=division_5)
cap_holes_2 = CapHoles(Brep=extrude_2)
construct_point_3 = ConstructPoint(XCoordinate=negative_4, YCoordinate=negative_5, ZCoordinate=0)
move_4 = Move(Geometry=cap_holes_2, Motion=construct_point_3)  # -> Geometry, Transform
xy_plane = XYPlane(Origin=Point(0, 0, 0))
radians_2 = Radians(Degrees=Slider(90, range=0..180))
rotate = Rotate(Geometry=geometry_6, Angle=radians_2, Plane=xy_plane)  # -> Geometry, Transform
solid_difference_2 = SolidDifference(BrepsA=move_4.Geometry, BrepsB=rotate.Geometry)

cylinder = Cylinder(Base=PlaneXY(0, 0, 0), Radius=addition, Length=cliphight)
line = Line(StartPoint=point, EndPoint=construct_point_2)
yz_plane = YZPlane(Origin=Point(0, 0, 0))
addition_4 = Addition(A=cliphight, B="1")
radians_3 = Radians(Degrees=Slider(270, range=0..360))
rotate_2 = Rotate(Geometry=geometry_2, Angle=radians_3, Plane=yz_plane)  # -> Geometry, Transform
construct_point_4 = ConstructPoint(XCoordinate="-7", YCoordinate=negative_3, ZCoordinate=0)
cylinder_2 = Cylinder(Base=PlaneXY(0, 0, 0), Radius=addition_2, Length=cliphight)
rotate_3 = Rotate(Geometry=line, Angle=radians, Plane=PlaneXY(0, 0, 0))  # -> Geometry, Transform
unit_z_5 = UnitZ(Factor=addition_4)
cap_holes_3 = CapHoles(Brep=cylinder)
move_5 = Move(Geometry=rotate_2.Geometry, Motion=construct_point_4)  # -> Geometry, Transform
cap_holes_4 = CapHoles(Brep=cylinder_2)
division_6 = Division(A=cliphight, B="2")
radians_4 = Radians(Degrees=Slider(90, range=0..100))
rotate_4 = Rotate(Geometry=move_5.Geometry, Angle=radians_4, Plane=PlaneXY(0, 0, 0))  # -> Geometry, Transform
division_7 = Division(A=openangle, B="2")
extrude_3 = Extrude(Base=[rotate_3.Geometry, line], Direction=unit_z_5)
solid_difference_3 = SolidDifference(BrepsA=cap_holes_4, BrepsB=cap_holes_3)
radians_5 = Radians(Degrees=Slider(90, range=0..100))
rotate_5 = Rotate(Geometry=move.Geometry, Angle=radians_5, Plane=PlaneXY(0, 0, 0))  # -> Geometry, Transform
yz_plane_2 = YZPlane(Origin=Point(0, 0, 0))
xz_plane = XZPlane(Origin=Point(0, 0, 0))
brep_join = BrepJoin(Breps=flatten(extrude_3))  # -> Breps, Closed
radians_6 = Radians(Degrees=Slider(180, range=0..360))
rotate_6 = Rotate(Geometry=rotate_4.Geometry, Angle=radians_6, Plane=yz_plane_2)  # -> Geometry, Transform
radians_7 = Radians(Degrees=division_7)
yz_plane_3 = YZPlane(Origin=Point(0, 0, 0))
split_brep = SplitBrep(Brep=solid_difference_3, Cutter=brep_join.Breps)
explode_tree_2 = ExplodeTree(Data=graft(split_brep))  # -> Branch0, Branch1
unit_z_6 = UnitZ(Factor="-5")
panel_3 = Panel(split_brep)
move_6 = Move(Geometry=rotate_6.Geometry, Motion=unit_z_6)  # -> Geometry, Transform
solid_union = SolidUnion(Breps=[move_6.Geometry, rotate_5.Geometry])
vector_xyz = VectorXYZ(XComponent=division_6, YComponent=0, ZComponent=addition_2)  # -> Vector, Length
cap_holes_5 = CapHoles(Brep=explode_tree_2.Branch0)
cap_holes_6 = CapHoles(Brep=explode_tree_2.Branch1)
rotate_7 = Rotate(Geometry=cap_holes_6, Angle=1.570796327, Plane=xz_plane)  # -> Geometry, Transform
rotate_8 = Rotate(Geometry=rotate_7.Geometry, Angle=radians_7, Plane=yz_plane_3)  # -> Geometry, Transform
multiplication_3 = Multiplication(A=ball_radius, B="1.42")
unit_z_7 = UnitZ(Factor=multiplication_3)
move_7 = Move(Geometry=rotate_8.Geometry, Motion=vector_xyz.Vector)  # -> Geometry, Transform
unit_z_8 = UnitZ(Factor="8")
move_8 = Move(Geometry=solid_union, Motion=unit_z_8)  # -> Geometry, Transform
geometry_9 = Geometry(move_8.Geometry)
move_9 = Move(Geometry=move_7.Geometry, Motion=unit_z_7)  # -> Geometry, Transform
solid_union_2 = SolidUnion(Breps=flatten([move_9.Geometry, geometry_9]))
solid_union_3 = SolidUnion(Breps=flatten([solid_difference_2, move_9.Geometry]))
geometry_10 = Geometry(solid_union_2)
geometry_11 = Geometry(solid_union_3)
ball_or_not = ClusterInput()
unit_z_9 = UnitZ(Factor="20")
move_10 = Move(Geometry=geometry_11, Motion=unit_z_9)  # -> Geometry, Transform

# ----
# G+B_標準件_6ball
geometry_12 = Geometry(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)

ghpython_script_2 = GhPythonScript(ball_or_not=ball_or_not, guide_with_ball_holder=[geometry_12, move_10.Geometry], guide=geometry_10)  # -> out, geometry
# ---------- ghpython_script_2: Python ----------
__author__ = "corey chen"
__version__ = "2022.03.23"

import rhinoscriptsyntax as rs

if ball_or_not==True:
    geometry = guide_with_ball_holder
else:
    geometry = guide
# ---------- end ghpython_script_2 ----------
geometry_13 = ClusterOutput(ghpython_script_2.geometry)

# ==== cluster Clip_Square

# ----
# Universal ball
ball_radius = Slider(6, range=5..7)
extended_length_ratio = Slider(1.5, range=0..10)
universal_ball = Universal_ball(ball_radius=ball_radius, extended_length_ratio=extended_length_ratio, ratio_of_ball_holder=Slider(1, range=0.9..1.1))  # -> ball_2, substracted_ball_3, cubic
ghpython_script = GhPythonScript(x=universal_ball.ball_2, y=universal_ball.substracted_ball_3)  # -> out, a; same code as ghpython_script
geometry = Geometry(ghpython_script.a)
geometry_2 = Geometry(universal_ball.ball_2)
geometry_3 = Geometry(universal_ball.cubic)
explode_tree = ExplodeTree(Data=graft(geometry))  # -> Branch0, Branch1
geometry_4 = Geometry(universal_ball.substracted_ball_3)
geometry_5 = Geometry(explode_tree.Branch0)
geometry_6 = Geometry(explode_tree.Branch1)
unit_z = UnitZ(Factor=Slider(20, range=0..100))
move = Move(Geometry=geometry_6, Motion=unit_z)  # -> Geometry, Transform
unit_z_2 = UnitZ(Factor=Slider(0, range=0..100))
move_2 = Move(Geometry=geometry_5, Motion=unit_z_2)  # -> Geometry, Transform
solid_difference = SolidDifference(BrepsA=geometry_3, BrepsB=move.Geometry)

A = ClusterInput()
A_2 = ClusterInput()
y_size = ClusterInput()

# ----
# square_with_GuideB
geometry_7 = Geometry(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)

ball_or_not = ClusterInput()

# ----
# G+B_標準件_6ball
geometry_8 = Geometry(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)

unit_z_3 = UnitZ(Factor="20")

# ----
# Universal ball holder_square
panel = Panel("3.2")
multiplication = Multiplication(A=ball_radius, B=panel)
multiplication_2 = Multiplication(A=ball_radius, B="1.8")
unit_z_4 = UnitZ(Factor=multiplication_2)
division = Division(A=multiplication, B="2")
negative = Negative(Value=division)
xy_plane = XYPlane(Origin=Point(0, 0, 0))
radians = Radians(Degrees=Slider(90, range=0..180))
rotate = Rotate(Geometry=geometry_4, Angle=radians, Plane=xy_plane)  # -> Geometry, Transform

# ----
# Clip_square
cliphight = Slider(18, range=18..100)
clipwide = Slider(4, range=4..8)
addition = Addition(A=A, B=clipwide)
multiplication_3 = Multiplication(A=clipwide, B="2")
division_2 = Division(A=clipwide, B="2")
addition_2 = Addition(A=addition, B=clipwide)
addition_3 = Addition(A=A_2, B=multiplication_3)
division_3 = Division(A=addition_3, B="2")
cylinder = Cylinder(Base=PlaneXY(0, 0, 0), Radius=clipwide, Length=cliphight)
division_4 = Division(A=cliphight, B="2")
division_5 = Division(A=addition_3, B="2")
unit_y = UnitY(Factor=clipwide)
rectangle = Rectangle(Plane=PlaneXY(0, 0, 0), XSize=addition, YSize=y_size, Radius=0)  # -> Rectangle, Length
rectangle_2 = Rectangle(Plane=PlaneXY(0, 0, 0), XSize=addition_2, YSize=addition_3, Radius=0)  # -> Rectangle, Length
unit_y_2 = UnitY(Factor=division_3)
cap_holes = CapHoles(Brep=cylinder)
negative_2 = Negative(Value=division_4)
unit_y_3 = UnitY(Factor=division_2)
negative_3 = Negative(Value=division_5)
boundary_surfaces = BoundarySurfaces(Edges=rectangle_2.Rectangle)
unit_z_5 = UnitZ(Factor=cliphight)
boundary_surfaces_2 = BoundarySurfaces(Edges=rectangle.Rectangle)
move_3 = Move(Geometry=boundary_surfaces_2, Motion=unit_y)  # -> Geometry, Transform
move_4 = Move(Geometry=cap_holes, Motion=unit_y_3)  # -> Geometry, Transform
xz_plane = XZPlane(Origin=unit_y_2)
solid_difference_2 = SolidDifference(BrepsA=boundary_surfaces, BrepsB=move_3.Geometry)
mirror = Mirror(Geometry=move_4.Geometry, Plane=xz_plane)  # -> Geometry, Transform
extrude = Extrude(Base=solid_difference_2, Direction=unit_z_5)
multiplication_4 = Multiplication(A=ball_radius, B="1.42")
solid_union = SolidUnion(Breps=[mirror.Geometry, move_4.Geometry, extrude])
addition_4 = Addition(A=addition_2, B=multiplication_4)
negative_4 = Negative(Value=Slider(90, range=0..180))
radians_2 = Radians(Degrees=negative_4)
xz_plane_2 = XZPlane(Origin=Point(0, 0, 0))
construct_point = ConstructPoint(XCoordinate=negative_2, YCoordinate=negative_3, ZCoordinate=addition_4)
rotate_2 = Rotate(Geometry=solid_union, Angle=radians_2, Plane=xz_plane_2)  # -> Geometry, Transform
move_5 = Move(Geometry=rotate_2.Geometry, Motion=construct_point)  # -> Geometry, Transform

rectangle_3 = Rectangle(Plane=PlaneXY(0, 0, 0), XSize=cliphight, YSize=multiplication, Radius="2")  # -> Rectangle, Length
division_6 = Division(A=cliphight, B="2")
extrude_2 = Extrude(Base=rectangle_3.Rectangle, Direction=unit_z_4)
negative_5 = Negative(Value=division_6)
cap_holes_2 = CapHoles(Brep=extrude_2)
construct_point_2 = ConstructPoint(XCoordinate=negative_5, YCoordinate=negative, ZCoordinate=0)
move_6 = Move(Geometry=cap_holes_2, Motion=construct_point_2)  # -> Geometry, Transform
solid_difference_3 = SolidDifference(BrepsA=move_6.Geometry, BrepsB=rotate.Geometry)

solid_union_2 = SolidUnion(Breps=[move_5.Geometry, geometry_7])

solid_union_3 = SolidUnion(Breps=[move_5.Geometry, solid_difference_3])

geometry_9 = Geometry(solid_union_2)
geometry_10 = Geometry(solid_union_3)
move_7 = Move(Geometry=geometry_10, Motion=unit_z_3)  # -> Geometry, Transform
ghpython_script_2 = GhPythonScript(ball_or_not=ball_or_not, guide_with_ball_holder=[geometry_8, move_7.Geometry], guide=geometry_9)  # -> out, geometry; same code as ghpython_script_2
geometry_11 = ClusterOutput(ghpython_script_2.geometry)

# ==== cluster Hook

# ----
# Universal ball
ball_radius = Slider(6, range=5..7)
extended_length_ratio = Slider(1.5, range=0..10)
universal_ball = Universal_ball(ball_radius=ball_radius, extended_length_ratio=extended_length_ratio, ratio_of_ball_holder=Slider(1, range=0.9..1.1))  # -> ball_2, substracted_ball_3, cubic
ghpython_script = GhPythonScript(x=universal_ball.ball_2, y=universal_ball.substracted_ball_3)  # -> out, a; same code as ghpython_script
geometry = Geometry(ghpython_script.a)
geometry_2 = Geometry(universal_ball.ball_2)
geometry_3 = Geometry(universal_ball.cubic)
explode_tree = ExplodeTree(Data=graft(geometry))  # -> Branch0, Branch1
geometry_4 = Geometry(universal_ball.substracted_ball_3)
geometry_5 = Geometry(explode_tree.Branch0)
geometry_6 = Geometry(explode_tree.Branch1)
unit_z = UnitZ(Factor=Slider(20, range=0..100))
move = Move(Geometry=geometry_6, Motion=unit_z)  # -> Geometry, Transform
unit_z_2 = UnitZ(Factor=Slider(0, range=0..100))
move_2 = Move(Geometry=geometry_5, Motion=unit_z_2)  # -> Geometry, Transform
solid_difference = SolidDifference(BrepsA=geometry_3, BrepsB=move.Geometry)

A = ClusterInput()

# ----
# Guide_T(標準件)
cluster = Cluster(factor="18", A="18")  # -> result, extrusion
geometry_7 = Geometry(cluster.result)
geometry_8 = Geometry(cluster.extrusion)

# ----
# square
rectangle = Rectangle(Plane=PlaneXY(0, 0, 0), XSize="24", YSize="18", Radius=0)  # -> Rectangle, Length
unit_z_3 = UnitZ(Factor="5")
division = Division(A="24", B="2")
division_2 = Division(A="18", B="2")
extrude = Extrude(Base=rectangle.Rectangle, Direction=unit_z_3)
negative = Negative(Value=division)
negative_2 = Negative(Value=division_2)
cap_holes = CapHoles(Brep=extrude)
construct_point = ConstructPoint(XCoordinate=negative, YCoordinate=negative_2, ZCoordinate=0)
move_3 = Move(Geometry=cap_holes, Motion=construct_point)  # -> Geometry, Transform

division_3 = Division(A="18", B="2")
negative_3 = Negative(Value=division_3)
yz_plane = YZPlane(Origin=Point(0, 0, 0))
radians = Radians(Degrees=Slider(270, range=0..360))
rotate = Rotate(Geometry=geometry_8, Angle=radians, Plane=yz_plane)  # -> Geometry, Transform
construct_point_2 = ConstructPoint(XCoordinate="-7", YCoordinate=negative_3, ZCoordinate=0)
move_4 = Move(Geometry=rotate.Geometry, Motion=construct_point_2)  # -> Geometry, Transform
radians_2 = Radians(Degrees=Slider(90, range=0..100))
rotate_2 = Rotate(Geometry=move_4.Geometry, Angle=radians_2, Plane=PlaneXY(0, 0, 0))  # -> Geometry, Transform
radians_3 = Radians(Degrees=Slider(90, range=0..100))
rotate_3 = Rotate(Geometry=move_3.Geometry, Angle=radians_3, Plane=PlaneXY(0, 0, 0))  # -> Geometry, Transform
yz_plane_2 = YZPlane(Origin=Point(0, 0, 0))
radians_4 = Radians(Degrees=Slider(180, range=0..360))
rotate_4 = Rotate(Geometry=rotate_2.Geometry, Angle=radians_4, Plane=yz_plane_2)  # -> Geometry, Transform
unit_z_4 = UnitZ(Factor="-5")
move_5 = Move(Geometry=rotate_4.Geometry, Motion=unit_z_4)  # -> Geometry, Transform
solid_union = SolidUnion(Breps=[move_5.Geometry, rotate_3.Geometry])
unit_z_5 = UnitZ(Factor="8")
move_6 = Move(Geometry=solid_union, Motion=unit_z_5)  # -> Geometry, Transform
geometry_9 = Geometry(move_6.Geometry)

# ----
# G+B_標準件_6ball
geometry_10 = Geometry(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)

ball_or_not = ClusterInput()
unit_z_6 = UnitZ(Factor="20")

# ----
# Hook
hookhight = Slider(18, range=18..100)
hookwide = Slider(4, range=4..8)
division_4 = Division(A=A, B="2")
subtraction = Subtraction(A=division_4, B="2")
division_5 = Division(A=hookhight, B="2")
negative_4 = Negative(Value=division_5)
addition = Addition(A=Slider(5, range=0..30), B=subtraction)
addition_2 = Addition(A=Slider(10, range=0..20), B=subtraction)
addition_3 = Addition(A=Slider(2, range=0..20), B=subtraction)
addition_4 = Addition(A=Slider(5, range=0..20), B=subtraction)
addition_5 = Addition(A=Slider(2, range=0..10), B=subtraction)
construct_point_3 = ConstructPoint(XCoordinate=0, YCoordinate=addition, ZCoordinate=Slider(64, range=0..70))
construct_point_4 = ConstructPoint(XCoordinate=0, YCoordinate=addition_2, ZCoordinate=Slider(14, range=5..20))
construct_point_5 = ConstructPoint(XCoordinate=negative_4, YCoordinate=0, ZCoordinate="10")
construct_point_6 = ConstructPoint(XCoordinate=0, YCoordinate=addition_4, ZCoordinate=Slider(25, range=0..30))
construct_point_7 = ConstructPoint(XCoordinate=0, YCoordinate=addition_3, ZCoordinate=Slider(36, range=0..40))
construct_point_8 = ConstructPoint(XCoordinate=0, YCoordinate=Slider(4, range=0..5), ZCoordinate=Slider(0, range=0..10))
construct_point_9 = ConstructPoint(XCoordinate=0, YCoordinate=addition_5, ZCoordinate=Slider(50, range=0..50))
construct_point_10 = ConstructPoint(XCoordinate=0, YCoordinate=Slider(7, range=0..20), ZCoordinate=Slider(2, range=0..15))
move_7 = Move(Geometry=construct_point_5, Motion=construct_point_4)  # -> Geometry, Transform
move_8 = Move(Geometry=construct_point_5, Motion=construct_point_8)  # -> Geometry, Transform
move_9 = Move(Geometry=construct_point_5, Motion=construct_point_6)  # -> Geometry, Transform
move_10 = Move(Geometry=construct_point_5, Motion=construct_point_3)  # -> Geometry, Transform
move_11 = Move(Geometry=construct_point_5, Motion=construct_point_7)  # -> Geometry, Transform
move_12 = Move(Geometry=construct_point_5, Motion=construct_point_10)  # -> Geometry, Transform
move_13 = Move(Geometry=construct_point_5, Motion=construct_point_9)  # -> Geometry, Transform
interpolate = Interpolate(
    Vertices=[move_8.Geometry, move_12.Geometry, move_7.Geometry, move_9.Geometry, move_11.Geometry, move_13.Geometry, move_10.Geometry],
    Degree=3,
    Periodic=False,
    KnotStyle=1)  # -> Curve, Length, Domain
unit_x = UnitX(Factor=hookhight)
extrude_2 = Extrude(Base=interpolate.Curve, Direction=unit_x)
unit_y = UnitY(Factor=hookwide)
xz_plane = XZPlane(Origin=Point(0, 0, 0))
extrude_3 = Extrude(Base=extrude_2, Direction=unit_y)
mirror = Mirror(Geometry=extrude_3, Plane=xz_plane)  # -> Geometry, Transform
solid_union_2 = SolidUnion(Breps=[extrude_3, mirror.Geometry])
panel = Panel(solid_union_2)

# ----
# Universal ball holder_hook
panel_2 = Panel("3.2")
multiplication = Multiplication(A=ball_radius, B=panel_2)
multiplication_2 = Multiplication(A=ball_radius, B="1.8")
unit_z_7 = UnitZ(Factor=multiplication_2)
rectangle_2 = Rectangle(Plane=PlaneXY(0, 0, 0), XSize=hookhight, YSize=multiplication, Radius="0.5")  # -> Rectangle, Length
division_6 = Division(A=hookhight, B="2")
division_7 = Division(A=multiplication, B="2")
extrude_4 = Extrude(Base=rectangle_2.Rectangle, Direction=unit_z_7)
negative_5 = Negative(Value=division_6)
negative_6 = Negative(Value=division_7)
cap_holes_2 = CapHoles(Brep=extrude_4)
xy_plane = XYPlane(Origin=Point(0, 0, 0))
construct_point_11 = ConstructPoint(XCoordinate=negative_5, YCoordinate=negative_6, ZCoordinate=0)
move_14 = Move(Geometry=cap_holes_2, Motion=construct_point_11)  # -> Geometry, Transform
radians_5 = Radians(Degrees=Slider(90, range=0..180))
rotate_5 = Rotate(Geometry=geometry_4, Angle=radians_5, Plane=xy_plane)  # -> Geometry, Transform
solid_difference_2 = SolidDifference(BrepsA=move_14.Geometry, BrepsB=rotate_5.Geometry)

solid_union_3 = SolidUnion(Breps=[solid_difference_2, solid_union_2])

solid_union_4 = SolidUnion(Breps=[solid_union_2, geometry_9])
geometry_11 = Geometry(solid_union_4)
geometry_12 = Geometry(solid_union_3)
move_15 = Move(Geometry=geometry_12, Motion=Vector(0, 0, 10))  # -> Geometry, Transform
ghpython_script_2 = GhPythonScript(ball_or_not=ball_or_not, guide_with_ball_holder=[geometry_10, move_15.Geometry], guide=geometry_11)  # -> out, geometry; same code as ghpython_script_2
geometry_13 = ClusterOutput(ghpython_script_2.geometry)

# ==== cluster RingEar
ringwide = Slider(2, range=0..10)
ringthick = Slider(5, range=0..5)
multiplication = Multiplication(A=ringwide, B="2")
A = ClusterInput()
A_2 = ClusterInput()
x_coordinate = ClusterInput()
subtraction = Subtraction(A=A, B=multiplication)
subtraction_2 = Subtraction(A=A_2, B=multiplication)
construct_point = ConstructPoint(XCoordinate=x_coordinate, YCoordinate=Slider(0, range=0..10), ZCoordinate=Slider(0, range=0..10))
construct_point_2 = ConstructPoint(XCoordinate=ringwide, YCoordinate=ringwide, ZCoordinate=0)
radius = ClusterInput()
x_size = ClusterInput()
y_size = ClusterInput()
radius_2 = ClusterInput()
rectangle = Rectangle(Plane=construct_point, XSize=subtraction, YSize=subtraction_2, Radius=radius)  # -> Rectangle, Length
rectangle_2 = Rectangle(Plane=construct_point, XSize=x_size, YSize=y_size, Radius=radius_2)  # -> Rectangle, Length
# Ring/ear
boundary_surfaces = BoundarySurfaces(Edges=rectangle_2.Rectangle)
boundary_surfaces_2 = BoundarySurfaces(Edges=rectangle.Rectangle)
unit_z = UnitZ(Factor=ringthick)
move = Move(Geometry=boundary_surfaces_2, Motion=construct_point_2)  # -> Geometry, Transform
solid_difference = SolidDifference(BrepsA=boundary_surfaces, BrepsB=move.Geometry)
extrude = Extrude(Base=solid_difference, Direction=unit_z)
radians = Radians(Degrees=Slider(0, range=0..180))
yz_plane = YZPlane(Origin=Point(0, 0, 0))
value = ClusterInput()
rotate = Rotate(Geometry=extrude, Angle=radians, Plane=yz_plane)  # -> Geometry, Transform
mirror = Mirror(Geometry=rotate.Geometry, Plane=PlaneYZ(0, 0, 0))  # -> Geometry, Transform
ghpython_script = GhPythonScript(x=mirror.Geometry, value=value)  # -> out, a
# ---------- ghpython_script: Python ----------
__author__ = "corey chen"
__version__ = "2022.03.13"

import rhinoscriptsyntax as rs

if value:
    a = x
else:
    pass
# ---------- end ghpython_script ----------
# Ring/ear
geometry = Geometry(ghpython_script.a)
solid_union = SolidUnion(Breps=[rotate.Geometry, geometry])
result = ClusterOutput(solid_union)

# ==== cluster T_T
A = ClusterInput()
subtraction = Subtraction(A=A, B="6")
x_coordinate = ClusterInput()
t_thick = Slider(3, range=2..4)
construct_point = ConstructPoint(XCoordinate=x_coordinate, YCoordinate=Slider(0, range=0..10), ZCoordinate=Slider(0, range=0..10))
x_size = ClusterInput()
y_size = ClusterInput()
A_2 = ClusterInput()
rectangle = Rectangle(Plane=construct_point, XSize=x_size, YSize=subtraction, Radius="0.5")  # -> Rectangle, Length
rectangle_2 = Rectangle(Plane=construct_point, XSize=subtraction, YSize=y_size, Radius="0.5")  # -> Rectangle, Length
subtraction_2 = Subtraction(A=A_2, B=subtraction)
division = Division(A=subtraction_2, B="2")
negative = Negative(Value=division)
construct_point_2 = ConstructPoint(XCoordinate=subtraction_2, YCoordinate=negative, ZCoordinate=0)
boundary_surfaces = BoundarySurfaces(Edges=rectangle_2.Rectangle)
# T_T
boundary_surfaces_2 = BoundarySurfaces(Edges=rectangle.Rectangle)
unit_z = UnitZ(Factor=t_thick)
move = Move(Geometry=boundary_surfaces, Motion=construct_point_2)  # -> Geometry, Transform
solid_union = SolidUnion(Breps=[boundary_surfaces_2, move.Geometry])
extrude = Extrude(Base=solid_union, Direction=unit_z)
mirror = Mirror(Geometry=extrude, Plane=PlaneYZ(0, 0, 0))  # -> Geometry, Transform
value = ClusterInput()
ghpython_script = GhPythonScript(x=mirror.Geometry, value=value)  # -> out, a; same code as ghpython_script
geometry = Geometry(ghpython_script.a)
solid_union_2 = SolidUnion(Breps=[extrude, geometry])
result = ClusterOutput(solid_union_2)

# ==== cluster Stand

# ----
# Universal ball
ball_radius = Slider(6, range=5..7)
extended_length_ratio = Slider(1.5, range=0..10)
universal_ball = Universal_ball(ball_radius=ball_radius, extended_length_ratio=extended_length_ratio, ratio_of_ball_holder=Slider(1, range=0.9..1.1))  # -> ball_2, substracted_ball_3, cubic
ghpython_script = GhPythonScript(x=universal_ball.ball_2, y=universal_ball.substracted_ball_3)  # -> out, a; same code as ghpython_script
geometry = Geometry(ghpython_script.a)
geometry_2 = Geometry(universal_ball.ball_2)
geometry_3 = Geometry(universal_ball.cubic)
explode_tree = ExplodeTree(Data=graft(geometry))  # -> Branch0, Branch1
geometry_4 = Geometry(universal_ball.substracted_ball_3)
geometry_5 = Geometry(explode_tree.Branch0)
geometry_6 = Geometry(explode_tree.Branch1)
unit_z = UnitZ(Factor=Slider(20, range=0..100))
move = Move(Geometry=geometry_6, Motion=unit_z)  # -> Geometry, Transform
unit_z_2 = UnitZ(Factor=Slider(0, range=0..100))
move_2 = Move(Geometry=geometry_5, Motion=unit_z_2)  # -> Geometry, Transform
solid_difference = SolidDifference(BrepsA=geometry_3, BrepsB=move.Geometry)

# ----
# Guide_T(標準件)
# GuideA
# GuideB
guideheight = Slider(4, range=4..10)
guideholderx = Slider(14, range=10..100)
# 標準件統一參數:35.2
guideholderthick = Slider(35.2, range=0..100)
startz = Slider(0, range=0..100)
starty = Slider(0, range=0..100)
startx = Slider(0, range=0..100)
subtraction = Subtraction(A=guideholderx, B="8")
subtraction_2 = Subtraction(A=guideholderx, B="4")
construct_point = ConstructPoint(XCoordinate=startx, YCoordinate=starty, ZCoordinate=startz)
addition = Addition(A=guideheight, B="2")
subtraction_3 = Subtraction(A=guideheight, B="2")
rectangle = Rectangle(Plane=construct_point, XSize=guideholderx, YSize=addition, Radius=0)  # -> Rectangle, Length
rectangle_2 = Rectangle(Plane=PlaneXY(0, 0, 0), XSize=subtraction_2, YSize="2", Radius=0)  # -> Rectangle, Length
subtraction_4 = Subtraction(A=guideholderx, B=subtraction)
unit_y = UnitY(Factor=subtraction_3)
division = Division(A=subtraction_4, B="2")
division_2 = Division(A="4", B="2")
boundary_surfaces = BoundarySurfaces(Edges=rectangle.Rectangle)
unit_x = UnitX(Factor=division)
rectangle_3 = Rectangle(Plane=PlaneXY(0, 0, 0), XSize=subtraction, YSize=guideheight, Radius=0)  # -> Rectangle, Length
move_3 = Move(Geometry=rectangle_2.Rectangle, Motion=unit_y)  # -> Geometry, Transform
unit_x_2 = UnitX(Factor=division_2)
unit_z_3 = UnitZ(Factor="-2")
unit_z_4 = UnitZ(Factor=guideholderthick)
move_4 = Move(Geometry=rectangle_3.Rectangle, Motion=unit_x)  # -> Geometry, Transform
move_5 = Move(Geometry=move_3.Geometry, Motion=unit_x_2)  # -> Geometry, Transform
extrude = Extrude(Base=boundary_surfaces, Direction=unit_z_3)
division_3 = Division(A=guideholderthick, B="2")
division_4 = Division(A="0.5", B="2")
boundary_surfaces_2 = BoundarySurfaces(Edges=move_4.Geometry)
boundary_surfaces_3 = BoundarySurfaces(Edges=move_5.Geometry)
addition_2 = Addition(A=division, B=division_4)
subtraction_5 = Subtraction(A=subtraction, B="0.5")
subtraction_6 = Subtraction(A=guideheight, B=division_4)
subtraction_7 = Subtraction(A=subtraction_2, B="0.5")
subtraction_8 = Subtraction(A="2", B="0.5")
area = Area(Geometry=boundary_surfaces_3)  # -> Area, Centroid
solid_union = SolidUnion(Breps=[boundary_surfaces_2, boundary_surfaces_3])
rectangle_4 = Rectangle(Plane=PlaneXY(0, 0, 0), XSize=subtraction_5, YSize=subtraction_6, Radius=0)  # -> Rectangle, Length
rectangle_5 = Rectangle(Plane=PlaneXY(0, 0, 0), XSize=subtraction_7, YSize=subtraction_8, Radius=0)  # -> Rectangle, Length
subtraction_9 = Subtraction(A="0", B=division_3)
unit_x_3 = UnitX(Factor=addition_2)
division_5 = Division(A=guideholderx, B="2")
negative = Negative(Value=division_5)
solid_difference_2 = SolidDifference(BrepsA=boundary_surfaces, BrepsB=solid_union)
area_2 = Area(Geometry=rectangle_5.Rectangle)  # -> Area, Centroid
move_6 = Move(Geometry=rectangle_4.Rectangle, Motion=unit_x_3)  # -> Geometry, Transform
construct_point_2 = ConstructPoint(XCoordinate=negative, YCoordinate=subtraction_9, ZCoordinate="5")
xz_plane = XZPlane(Origin=Point(0, 0, 0))
vector_2pt = Vector2Pt(PointA=area_2.Centroid, PointB=area.Centroid, Unitize=False)  # -> Vector, Length
boundary_surfaces_4 = BoundarySurfaces(Edges=move_6.Geometry)
move_7 = Move(Geometry=rectangle_5.Rectangle, Motion=vector_2pt.Vector)  # -> Geometry, Transform
boundary_surfaces_5 = BoundarySurfaces(Edges=move_7.Geometry)
extrude_2 = Extrude(Base=solid_difference_2, Direction=unit_z_4)
orient = Orient(Geometry=extrude_2, Source=xz_plane, Target=PlaneXY(0, 0, 0))  # -> Geometry, Transform
move_8 = Move(Geometry=orient.Geometry, Motion=construct_point_2)  # -> Geometry, Transform
solid_union_2 = SolidUnion(Breps=[boundary_surfaces_4, boundary_surfaces_5])
extrude_3 = Extrude(Base=solid_union_2, Direction=unit_z_4)
solid_union_3 = SolidUnion(Breps=[extrude_3, extrude])

geometry_7 = Geometry(move_8.Geometry)

# ----
# Universal ball holder_stand
# StandB
panel = Panel(guideholderx)
multiplication = Multiplication(A=panel, B="1.4")
multiplication_2 = Multiplication(A=ball_radius, B="1.8")
unit_z_5 = UnitZ(Factor=multiplication_2)
rectangle_6 = Rectangle(Plane=PlaneXY(0, 0, 0), XSize="24", YSize=multiplication, Radius="0")  # -> Rectangle, Length
division_6 = Division(A=multiplication, B="2")
division_7 = Division(A="24", B="2")
extrude_4 = Extrude(Base=rectangle_6.Rectangle, Direction=unit_z_5)
negative_2 = Negative(Value=division_7)
negative_3 = Negative(Value=division_6)
cap_holes = CapHoles(Brep=extrude_4)
radians = Radians(Degrees=Slider(90, range=0..100))
construct_point_3 = ConstructPoint(XCoordinate=negative_2, YCoordinate=negative_3, ZCoordinate=0)
xy_plane = XYPlane(Origin=Point(0, 0, 0))
move_9 = Move(Geometry=cap_holes, Motion=construct_point_3)  # -> Geometry, Transform
xy_plane_2 = XYPlane(Origin=Point(0, 0, 0))
rotate = Rotate(Geometry=geometry_7, Angle=radians, Plane=xy_plane)  # -> Geometry, Transform
unit_z_6 = UnitZ(Factor=unit_z_5)
radians_2 = Radians(Degrees=Slider(0, range=0..180))
rotate_2 = Rotate(Geometry=geometry_4, Angle=radians_2, Plane=xy_plane_2)  # -> Geometry, Transform
division_8 = Division(A="24", B=guideholderthick)
move_10 = Move(Geometry=rotate.Geometry, Motion=unit_z_6)  # -> Geometry, Transform
solid_difference_3 = SolidDifference(BrepsA=move_9.Geometry, BrepsB=rotate_2.Geometry)
scale_nu = ScaleNU(Geometry=move_10.Geometry, Plane=PlaneXY(0, 0, 0), ScaleX=division_8, ScaleY=1, ScaleZ=1)  # -> Geometry, Transform
solid_union_4 = SolidUnion(Breps=[solid_difference_3, scale_nu.Geometry])

factor = ClusterInput()
radius = ClusterInput()
length = ClusterInput()
radius_2 = ClusterInput()
length_2 = ClusterInput()
A = ClusterInput()
B = ClusterInput()

# ----
# Stand
# StandA
unit_z_7 = UnitZ(Factor=factor)
cylinder = Cylinder(Base=PlaneXY(0, 0, 0), Radius=radius, Length=length)
addition_3 = Addition(A=A, B=B)
cylinder_2 = Cylinder(Base=unit_z_7, Radius=radius_2, Length=length_2)
unit_z_8 = UnitZ(Factor=addition_3)
cap_holes_2 = CapHoles(Brep=cylinder_2)
cap_holes_3 = CapHoles(Brep=cylinder)
geometry_8 = Geometry(geometry_2)
move_11 = Move(Geometry=geometry_8, Motion=unit_z_8)  # -> Geometry, Transform
solid_union_5 = SolidUnion(Breps=[cap_holes_3, cap_holes_2, move_11.Geometry])

unit_x_4 = UnitX(Factor="30")
move_12 = Move(Geometry=solid_union_4, Motion=unit_x_4)  # -> Geometry, Transform
unit_z_9 = UnitZ(Factor="20")
move_13 = Move(Geometry=move_12.Geometry, Motion=unit_z_9)  # -> Geometry, Transform
result = ClusterOutput([solid_union_5, move_13.Geometry])

# ==== cluster Cluster_2

# ----
# Universal ball
ball_radius = Slider(6, range=5..7)
extended_length_ratio = Slider(1.5, range=0..10)
universal_ball = Universal_ball(ball_radius=ball_radius, extended_length_ratio=extended_length_ratio, ratio_of_ball_holder=Slider(1, range=0.9..1.1))  # -> ball_2, substracted_ball_3, cubic
ghpython_script = GhPythonScript(x=universal_ball.ball_2, y=universal_ball.substracted_ball_3)  # -> out, a; same code as ghpython_script
geometry = Geometry(ghpython_script.a)
geometry_2 = Geometry(universal_ball.ball_2)
geometry_3 = Geometry(universal_ball.cubic)
explode_tree = ExplodeTree(Data=graft(geometry))  # -> Branch0, Branch1
geometry_4 = Geometry(universal_ball.substracted_ball_3)
geometry_5 = Geometry(explode_tree.Branch0)
geometry_6 = Geometry(explode_tree.Branch1)
unit_z = UnitZ(Factor=Slider(20, range=0..100))
move = Move(Geometry=geometry_6, Motion=unit_z)  # -> Geometry, Transform
unit_z_2 = UnitZ(Factor=Slider(0, range=0..100))
move_2 = Move(Geometry=geometry_5, Motion=unit_z_2)  # -> Geometry, Transform
solid_difference = SolidDifference(BrepsA=geometry_3, BrepsB=move.Geometry)

division = Division(A="32", B="2")

# ----
# Guide_T(標準件)
# GuideA
# GuideB
cluster = Cluster(factor="32", A="32")  # -> result, extrusion
geometry_7 = Geometry(cluster.result)
geometry_8 = Geometry(cluster.extrusion)

negative = Negative(Value=division)
yz_plane = YZPlane(Origin=Point(0, 0, 0))
radians = Radians(Degrees=Slider(270, range=0..360))
rotate = Rotate(Geometry=geometry_8, Angle=radians, Plane=yz_plane)  # -> Geometry, Transform
point = Point(Point(1, 0, 0))
geometry_9 = Geometry([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])
ball_or_not = ClusterInput()

# ----
# G+B_標準件_6ball
geometry_10 = Geometry(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)

unit_z_3 = UnitZ(Factor="30")
move_3 = Move(Geometry=geometry_10, Motion=unit_z_3)  # -> Geometry, Transform
point_2 = Point(Point(0, 0, 0))
magnet_radius = Slider(4.9, range=0..10)
magnet_height = Slider(2, range=0..100)
cylinder = Cylinder(Base=point_2, Radius=magnet_radius, Length=magnet_height)
unit_x = UnitX(Factor=expr("x*2+6", magnet_radius))
magnet = CapHoles(Brep=cylinder)
move_4 = Move(Geometry=magnet, Motion=unit_x)  # -> Geometry, Transform
point_3 = Point(Point(0, 0, 0))
addition = Addition(A=magnet_radius, B="3")
unit_y = UnitY(Factor=expr("x*2+6", magnet_radius))
move_5 = Move(Geometry=magnet, Motion=unit_y)  # -> Geometry, Transform
move_6 = Move(Geometry=move_5.Geometry, Motion=unit_x)  # -> Geometry, Transform
geometry_11 = Geometry([magnet, move_4.Geometry, move_5.Geometry, move_6.Geometry])
construct_point = ConstructPoint(XCoordinate=addition, YCoordinate=addition, ZCoordinate=0)
vector_2pt = Vector2Pt(PointA=construct_point, PointB=point_3, Unitize=False)  # -> Vector, Length
move_7 = Move(Geometry=geometry_11, Motion=vector_2pt.Vector)  # -> Geometry, Transform

# ----
# Universal ball holder_round
panel = Panel("1.8")
multiplication = Multiplication(A=ball_radius, B=panel)
rectangle = Rectangle(Plane=PlaneXY(0, 0, 0), XSize="32", YSize="32", Radius=0)  # -> Rectangle, Length
unit_z_4 = UnitZ(Factor=multiplication)
division_2 = Division(A="32", B="2")
division_3 = Division(A="32", B="2")
extrude = Extrude(Base=rectangle.Rectangle, Direction=unit_z_4)
negative_2 = Negative(Value=division_2)
negative_3 = Negative(Value=division_3)
cap_holes = CapHoles(Brep=extrude)
construct_point_2 = ConstructPoint(XCoordinate=negative_2, YCoordinate=negative_3, ZCoordinate=0)
move_8 = Move(Geometry=cap_holes, Motion=construct_point_2)  # -> Geometry, Transform
xy_plane = XYPlane(Origin=Point(0, 0, 0))
radians_2 = Radians(Degrees=Slider(90, range=0..180))
rotate_2 = Rotate(Geometry=geometry_4, Angle=radians_2, Plane=xy_plane)  # -> Geometry, Transform

addition_2 = Addition(A=multiplication, B="4")
construct_point_3 = ConstructPoint(XCoordinate="-7", YCoordinate=negative, ZCoordinate=addition_2)
volume = Volume(Geometry=move_8.Geometry)  # -> Volume, Centroid
rotate_3d = Rotate3D(Geometry=rotate_2.Geometry, Angle=3.141592654, Center=volume.Centroid, Axis=point)  # -> Geometry, Transform
move_9 = Move(Geometry=rotate.Geometry, Motion=construct_point_3)  # -> Geometry, Transform
solid_difference_2 = SolidDifference(BrepsA=move_8.Geometry, BrepsB=geometry_9)
solid_union = SolidUnion(Breps=[move_9.Geometry, solid_difference_2])

solid_difference_3 = SolidDifference(BrepsA=solid_difference_2, BrepsB=rotate_3d.Geometry)

geometry_12 = Geometry(solid_union)
geometry_13 = Geometry(solid_difference_3)
ghpython_script_2 = GhPythonScript(ball_or_not=ball_or_not, guide_with_ball_holder=[geometry_13, move_3.Geometry], guide=geometry_12)  # -> out, geometry; same code as ghpython_script_2
geometry_14 = ClusterOutput(ghpython_script_2.geometry)

# ==== cluster Cluster_3

# ----
# Universal ball
ball_radius = Slider(6, range=5..7)
extended_length_ratio = Slider(1.5, range=0..10)
universal_ball = Universal_ball(ball_radius=ball_radius, extended_length_ratio=extended_length_ratio, ratio_of_ball_holder=Slider(1, range=0.9..1.1))  # -> ball_2, substracted_ball_3, cubic
ghpython_script = GhPythonScript(x=universal_ball.ball_2, y=universal_ball.substracted_ball_3)  # -> out, a; same code as ghpython_script
geometry = Geometry(ghpython_script.a)
geometry_2 = Geometry(universal_ball.ball_2)
geometry_3 = Geometry(universal_ball.cubic)
explode_tree = ExplodeTree(Data=graft(geometry))  # -> Branch0, Branch1
geometry_4 = Geometry(universal_ball.substracted_ball_3)
geometry_5 = Geometry(explode_tree.Branch0)
geometry_6 = Geometry(explode_tree.Branch1)
unit_z = UnitZ(Factor=Slider(20, range=0..100))
move = Move(Geometry=geometry_6, Motion=unit_z)  # -> Geometry, Transform
unit_z_2 = UnitZ(Factor=Slider(0, range=0..100))
move_2 = Move(Geometry=geometry_5, Motion=unit_z_2)  # -> Geometry, Transform
solid_difference = SolidDifference(BrepsA=geometry_3, BrepsB=move.Geometry)

# ----
# Universal ball holder_round
panel = Panel("1.8")
multiplication = Multiplication(A=ball_radius, B=panel)
rectangle = Rectangle(Plane=PlaneXY(0, 0, 0), XSize="32", YSize="32", Radius=0)  # -> Rectangle, Length
unit_z_3 = UnitZ(Factor=multiplication)
division = Division(A="32", B="2")
division_2 = Division(A="32", B="2")
extrude = Extrude(Base=rectangle.Rectangle, Direction=unit_z_3)
negative = Negative(Value=division)
negative_2 = Negative(Value=division_2)
cap_holes = CapHoles(Brep=extrude)
construct_point = ConstructPoint(XCoordinate=negative, YCoordinate=negative_2, ZCoordinate=0)
move_3 = Move(Geometry=cap_holes, Motion=construct_point)  # -> Geometry, Transform
xy_plane = XYPlane(Origin=Point(0, 0, 0))
radians = Radians(Degrees=Slider(90, range=0..180))
rotate = Rotate(Geometry=geometry_4, Angle=radians, Plane=xy_plane)  # -> Geometry, Transform
solid_difference_2 = SolidDifference(BrepsA=move_3.Geometry, BrepsB=rotate.Geometry)

division_3 = Division(A="32", B="2")
addition = Addition(A=multiplication, B="4")

# ----
# Guide_T(標準件)
# GuideA
# GuideB
cluster = Cluster(factor="32", A="32")  # -> result, extrusion
geometry_7 = Geometry(cluster.result)
geometry_8 = Geometry(cluster.extrusion)

negative_3 = Negative(Value=division_3)
yz_plane = YZPlane(Origin=Point(0, 0, 0))
radians_2 = Radians(Degrees=Slider(270, range=0..360))
rotate_2 = Rotate(Geometry=geometry_8, Angle=radians_2, Plane=yz_plane)  # -> Geometry, Transform
construct_point_2 = ConstructPoint(XCoordinate="-7", YCoordinate=negative_3, ZCoordinate=addition)
move_4 = Move(Geometry=rotate_2.Geometry, Motion=construct_point_2)  # -> Geometry, Transform
solid_union = SolidUnion(Breps=[move_3.Geometry, move_4.Geometry])
ball_or_not = ClusterInput()
geometry_9 = Geometry(solid_difference_2)
geometry_10 = Geometry(solid_union)

# ----
# G+B_標準件_6ball
geometry_11 = Geometry(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)

unit_z_4 = UnitZ(Factor="30")
move_5 = Move(Geometry=geometry_11, Motion=unit_z_4)  # -> Geometry, Transform
ghpython_script_2 = GhPythonScript(ball_or_not=ball_or_not, guide_with_ball_holder=[geometry_9, move_5.Geometry], guide=geometry_10)  # -> out, geometry; same code as ghpython_script_2
geometry_12 = ClusterOutput(ghpython_script_2.geometry)

# ==== cluster Universal_ball
ball_radius = ClusterInput()
ratio_of_ball_holder = ClusterInput()
extended_length_ratio = ClusterInput()
box = Box({Plane=PlaneXY(-10, -10, 0), X=Domain(0, 20), Y=Domain(0, 20), Z=Domain(0, 20)})
cubic = ClusterOutput(box)
division = Division(A=ball_radius, B="6")
scale = Scale(Geometry=box, Center=Point(0, 0, 0), Factor=division)  # -> Geometry, Transform
multiplication = Multiplication(A=ball_radius, B=extended_length_ratio)
deconstruct_brep = DeconstructBrep(Brep=scale.Geometry)  # -> Faces, Edges, Vertices
division_2 = Division(A=ball_radius, B=Slider(1.5, range=0..10))
unit_z = UnitZ(Factor=multiplication)
top_face = Slider(5, range=0..10)
factor_1 = Slider(0.4, range=0..1)
unit_z_2 = UnitZ(Factor=ball_radius)  # -> expr("-x", UnitVector)
box_faces = ListItem(List=deconstruct_brep.Faces, Index=top_face, Wrap=True)
area = Area(Geometry=box_faces)  # -> Area, Centroid
basic_ball = Sphere(Base=area.Centroid, Radius=ball_radius)
multiplication_2 = Multiplication(A=unit_z_2, B=factor_1)

# ---- group: Side balls
unit_x = UnitX(Factor=ball_radius)
scale_0_5x = Scale(Geometry=basic_ball, Center=area.Centroid, Factor=Slider(0.5, range=0..1))  # -> Geometry, Transform
move = Move(Geometry=scale_0_5x.Geometry, Motion=expr("-x", unit_x))  # -> Geometry, Transform
move_2 = Move(Geometry=scale_0_5x.Geometry, Motion=unit_x)  # -> Geometry, Transform

# ----
move_3 = Move(Geometry=basic_ball, Motion=multiplication_2)  # -> Geometry, Transform
area_2 = Area(Geometry=move_3.Geometry)  # -> Area, Centroid
cylinder = Cylinder(Base=area_2.Centroid, Radius=division_2, Length=unit_z)

list_item = ListItem(Index=Slider(2, range=0..10), Wrap=True)
number_slider = Slider(1.5, range=0..10)
need_to_be_para = Slider(1.5, range=0..10)
offset_curve = OffsetCurve(Curve=list_item, Distance=expr("-x", need_to_be_para), Plane=PlaneXY(0, 0, 0), Corners=1)
unit_z_3 = UnitZ(Factor=number_slider)
move_4 = Move(Geometry=offset_curve, Motion=unit_z_3)  # -> flatten(Geometry), Transform
point_on_curve = PointOnCurve(list_item, parameter=0.5)
line_sdl = LineSDL(Start=point_on_curve, Direction=unit_z_3, Length=number_slider)
point_on_curve_2 = PointOnCurve(line_sdl, parameter=1)
point_on_curve_3 = PointOnCurve(move_4.Geometry, parameter=0.5)
polyline = PolyLine(Vertices=flatten([point_on_curve_3, point_on_curve_2, point_on_curve]), Closed=False)
fillet = Fillet(Curve=flatten(polyline), Radius="1")
sweep2 = Sweep2(Rail1=list_item, Rail2=move_4.Geometry, Sections=fillet, SameHeight=False)
cap_holes = CapHoles(Brep=sweep2)

deconstruct_brep_2 = DeconstructBrep(Brep=cylinder)  # -> Faces, Edges, Vertices
list_item_2 = ListItem(List=deconstruct_brep_2.Edges, Index=Slider(0, range=0..10), Wrap=True)
boundary_surfaces = BoundarySurfaces(Edges=list_item_2)
extrude = Extrude(Base=boundary_surfaces, Direction=unit_z)

deconstruct_brep_3 = DeconstructBrep(Brep=extrude)  # -> Faces, Edges, Vertices
list_item_3 = ListItem(List=deconstruct_brep_3.Faces, Index=Slider(5, range=0..10), Wrap=True)
area_3 = Area(Geometry=list_item_3)  # -> Area, Centroid

merge = Merge(Data1=flatten(move_2.Geometry), Data2=flatten(move.Geometry), Data3=flatten(move_3.Geometry))  # -> flatten(Result)
up = SolidDifference(BrepsA=scale.Geometry, BrepsB=[move_3.Geometry, move_2.Geometry, move.Geometry])  # -> flatten(UPPart)
solid_union = SolidUnion(Breps=merge)

solid_union_2 = SolidUnion(Breps=flatten([extrude, move_3.Geometry]))

unit_y = UnitY(Factor=1)
pi = Pi(Factor=Slider(1, range=0..1))
rotate_3d = Rotate3D(Geometry=[solid_union_2, solid_union, up], Angle=pi, Center=area_3.Centroid, Axis=unit_y)  # -> DOWNPart, Transform

point = Point(Point(0, 0, 0))
move_to_point = MoveToPoint(Geometry=rotate_3d.DOWNPart, PointA=area_3.Centroid, PointB=point)  # -> simplify(graft(Moved)), Vector, Transform
explode_tree = ExplodeTree(Data=move_to_point.Moved)  # -> simplify(Branch0), simplify(Branch1), simplify(Branch2)
ball = Geometry(flatten(explode_tree.Branch0))
ball_2 = ClusterOutput(ball)
substracted_ball = Geometry(flatten(explode_tree.Branch1))
cubic_2 = Geometry(explode_tree.Branch2)
deconstruct_brep_4 = DeconstructBrep(Brep=cubic_2)  # -> Faces, Edges, Vertices
list_item_4 = ListItem(List=deconstruct_brep_4.Vertices, Index=Slider(4, range=0..6), Wrap=True)
deconstruct = Deconstruct(Point=list_item_4)  # -> XComponent, YComponent, ZComponent
unit_z_4 = UnitZ(Factor=deconstruct.ZComponent)
reverse = Reverse(Vector=unit_z_4)
move_5 = Move(Geometry=substracted_ball, Motion=reverse)  # -> Geometry, Transform
panel = Panel(ball)
substracted_ball_2 = Geometry(flatten(move_5.Geometry))
scale_2 = Scale(Geometry=substracted_ball_2, Center=Point(0, 0, 0), Factor=ratio_of_ball_holder)  # -> Geometry, Transform
substracted_ball_3 = ClusterOutput(scale_2.Geometry)
panel_2 = Panel(scale_2.Geometry)

# ==== cluster Cluster
guideheight = Slider(4, range=4..10)
guideholderx = Slider(14, range=10..100)
startz = Slider(0, range=0..100)
starty = Slider(0, range=0..100)
startx = Slider(0, range=0..100)
subtraction = Subtraction(A=guideholderx, B="8")
subtraction_2 = Subtraction(A=guideholderx, B="4")
construct_point = ConstructPoint(XCoordinate=startx, YCoordinate=starty, ZCoordinate=startz)
addition = Addition(A=guideheight, B="2")
subtraction_3 = Subtraction(A=guideheight, B="2")
rectangle = Rectangle(Plane=construct_point, XSize=guideholderx, YSize=addition, Radius=0)  # -> Rectangle, Length
rectangle_2 = Rectangle(Plane=PlaneXY(0, 0, 0), XSize=subtraction_2, YSize="2", Radius=0)  # -> Rectangle, Length
subtraction_4 = Subtraction(A=guideholderx, B=subtraction)
unit_y = UnitY(Factor=subtraction_3)
division = Division(A=subtraction_4, B="2")
division_2 = Division(A="4", B="2")
factor = ClusterInput()
boundary_surfaces = BoundarySurfaces(Edges=rectangle.Rectangle)
unit_x = UnitX(Factor=division)
rectangle_3 = Rectangle(Plane=PlaneXY(0, 0, 0), XSize=subtraction, YSize=guideheight, Radius=0)  # -> Rectangle, Length
move = Move(Geometry=rectangle_2.Rectangle, Motion=unit_y)  # -> Geometry, Transform
unit_x_2 = UnitX(Factor=division_2)
unit_z = UnitZ(Factor="-2")
unit_z_2 = UnitZ(Factor=factor)
move_2 = Move(Geometry=rectangle_3.Rectangle, Motion=unit_x)  # -> Geometry, Transform
move_3 = Move(Geometry=move.Geometry, Motion=unit_x_2)  # -> Geometry, Transform
A = ClusterInput()
extrude = Extrude(Base=boundary_surfaces, Direction=unit_z)
division_3 = Division(A=A, B="2")
division_4 = Division(A="0.5", B="2")
boundary_surfaces_2 = BoundarySurfaces(Edges=move_2.Geometry)
boundary_surfaces_3 = BoundarySurfaces(Edges=move_3.Geometry)
addition_2 = Addition(A=division, B=division_4)
subtraction_5 = Subtraction(A=subtraction, B="0.5")
subtraction_6 = Subtraction(A=guideheight, B=division_4)
subtraction_7 = Subtraction(A=subtraction_2, B="0.5")
subtraction_8 = Subtraction(A="2", B="0.5")
area = Area(Geometry=boundary_surfaces_3)  # -> Area, Centroid
solid_union = SolidUnion(Breps=[boundary_surfaces_2, boundary_surfaces_3])
rectangle_4 = Rectangle(Plane=PlaneXY(0, 0, 0), XSize=subtraction_5, YSize=subtraction_6, Radius=0)  # -> Rectangle, Length
rectangle_5 = Rectangle(Plane=PlaneXY(0, 0, 0), XSize=subtraction_7, YSize=subtraction_8, Radius=0)  # -> Rectangle, Length
subtraction_9 = Subtraction(A="0", B=division_3)
unit_x_3 = UnitX(Factor=addition_2)
division_5 = Division(A=guideholderx, B="2")
negative = Negative(Value=division_5)
area_2 = Area(Geometry=rectangle_5.Rectangle)  # -> Area, Centroid
solid_difference = SolidDifference(BrepsA=boundary_surfaces, BrepsB=solid_union)
move_4 = Move(Geometry=rectangle_4.Rectangle, Motion=unit_x_3)  # -> Geometry, Transform
construct_point_2 = ConstructPoint(XCoordinate=negative, YCoordinate=subtraction_9, ZCoordinate="5")
xz_plane = XZPlane(Origin=Point(0, 0, 0))
vector_2pt = Vector2Pt(PointA=area_2.Centroid, PointB=area.Centroid, Unitize=False)  # -> Vector, Length
boundary_surfaces_4 = BoundarySurfaces(Edges=move_4.Geometry)
move_5 = Move(Geometry=rectangle_5.Rectangle, Motion=vector_2pt.Vector)  # -> Geometry, Transform
boundary_surfaces_5 = BoundarySurfaces(Edges=move_5.Geometry)
extrude_2 = Extrude(Base=solid_difference, Direction=unit_z_2)
orient = Orient(Geometry=extrude_2, Source=xz_plane, Target=PlaneXY(0, 0, 0))  # -> Geometry, Transform
move_6 = Move(Geometry=orient.Geometry, Motion=construct_point_2)  # -> Geometry, Transform
solid_union_2 = SolidUnion(Breps=[boundary_surfaces_4, boundary_surfaces_5])
extrude_3 = Extrude(Base=solid_union_2, Direction=unit_z_2)
# GuideA
solid_union_3 = SolidUnion(Breps=[extrude_3, extrude])
extrusion = ClusterOutput(extrude_2)
result = ClusterOutput(solid_union_3)
