# Grasshopper definition userinterface.gh (Grasshopper 1.0.7)
# plug-ins: Human UI

vertical_permutation_pattern = Panel("""Line Pattern
Rectangle Pattern
Circle Pattern
Centralized Pattern""")
horizontal_permutation_pattern = Panel("""Line Pattern
Circle Pattern""")
panel = Panel("""1
2
3
4
5
6
7
8""")
# Vertical: Piezo 10/16mm
tube_radius = Slider(4, range=0..10)
tube_inner_tolerance = Slider(0.2, range=0..1)
piezo_holder_cap_height = Slider(6, range=0..10)
silicone_ring_thickness = Slider(0.8, range=0..10)
tube_holder_tolerance = Slider(0.2, range=0..1)
panel_2 = Panel("peizo_height(2mm)+minimum(1.5mm*2)")
piezo_height = Slider(2.5, range=0..10)
peizo_holder_lock_height = Slider(8, range=0..10)
piezo_holder_thickness = Slider(2, range=0..10)
lock_thickness = Slider(2, range=0..10)
lock_height = Slider(3, range=0..10)
lock_scale_factor = Slider(1.05, range=0..10)
constraint_fix_tolerance = Slider(0.5, range=-1..1)
constraint_wall_thickness = Slider(1.5, range=0..2)
panel_3 = Panel("required tube_length = tube_holder_height-2")
create_radio_button = CreateRadioButton(RadioButtonName="16mm", RadioButtonGroup="Size of Piezo", InitiallySelected=False)
create_radio_button_2 = CreateRadioButton(RadioButtonName="10mm", RadioButtonGroup="Size of Piezo", InitiallySelected=Toggle(True))
create_radio_button_3 = CreateRadioButton(RadioButtonName="Horizontal Container", RadioButtonGroup="Type of container", InitiallySelected=False)
create_radio_button_4 = CreateRadioButton(RadioButtonName="Vetical Container", RadioButtonGroup="Type of container", InitiallySelected=Toggle(True))
length_mm = Slider(60, range=15..200)
number_of_piezo = Slider(3, range=0..12)
# Part 1: Scent Container Design
panel_4 = Panel("1. Select the size of piezo")
# Step1
create_label = CreateLabel(LabelText=panel_4, LabelSize="15", Justification=0)
create_wrappanel = CreateWrapPanel(UIElements=[create_radio_button_2, create_radio_button], Horizontal=True)
value_listener = ValueListener(Elements=create_wrappanel, SomeProperty=True)  # -> flatten(Values), Indices
# Step2
create_label_2 = CreateLabel(LabelText="2. Select the number of scent", LabelSize="15", Justification=0)
create_text_box = CreateTextBox(DefaultText=number_of_piezo, UpdateButton=True, showLabel=True)
value_listener_2 = ValueListener(Elements=create_text_box, SomeProperty=True)  # -> Scent_number, Indices
# Step3
create_label_3 = CreateLabel(LabelText="3. Select the type of container", LabelSize="15", Justification=0)
create_wrappanel_2 = CreateWrapPanel(UIElements=[create_radio_button_4, create_radio_button_3], Horizontal=True)
value_listener_3 = ValueListener(Elements=create_wrappanel_2, SomeProperty=True)  # -> flatten(Values), Indices
# Step4
create_label_4 = CreateLabel(LabelText="4. Adjust the length of tube", LabelSize="15", Justification=0)
create_slider = CreateSlider(Slider=length_mm, ShowBounds=False, ShowTicks=False, ShowTooltip=False, ShowValLabel=True, showLabel=True)
unit_z = UnitZ(Factor=peizo_holder_lock_height)
reverse = Reverse(Vector=unit_z)
value_listener_4 = ValueListener(Elements=create_slider, SomeProperty=True)  # -> Values, Indices
addition = Addition(Length=value_listener_4.Values, B="2")
addition_2 = Addition(Tube_holder_height=addition, Silicone_ring_thickness=silicone_ring_thickness)
list_item = ListItem(List=value_listener.Values, Index=0, Wrap=True)
expression = Expression(piezo_size=list_item, Expression="if(piezo_size=True, 4, 6)")
# 10mm piezo, radius=5mm, 0.2mm tolerance
expression_2 = Expression(tube_radius=expression, Expression="if(tube_radius=4, 5.2, 8.2)")
addition_3 = Addition(Tube_radius=expression, Tube_radius_tolerance=tube_inner_tolerance)
addition_4 = Addition(Tube_radius=addition_3, Piezo_holder_thickness=piezo_holder_thickness)
addition_5 = Addition(A=addition_4, Tolerance=tube_holder_tolerance)
addition_6 = Addition(A=addition_4, Lock_thickness=lock_thickness)
addition_7 = Addition(Tube_radius=expression, Constraint_fix_tolerance=constraint_fix_tolerance)
addition_8 = Addition(A=addition_7, Constraint_wall_thickness=constraint_wall_thickness)
v_true__h_false = ListItem(List=value_listener_3.Values, Index=0, Wrap=True)
ghpython_script = GhPythonScript(
    scent_number=value_listener_2.Scent_number,
    v_or_h=v_true__h_false,
    channel_number_list=panel,
    curved_tubes="Curved Tubes",
    straight_tubes="Straight Tubes")  # -> out, channel, curved_tubes, straight_tubes; inputs channel_number_list: list
# ---------- ghpython_script: Python ----------
__author__ = "richluo"
__version__ = "2022.03.28"

import rhinoscriptsyntax as rs

scent_number = int(scent_number)
if scent_number == 1 and v_or_h == False:
    channel = channel_number_list
else:
    channel = None

if v_or_h == False:
    curved_tubes = curved_tubes
    straight_tubes = straight_tubes
else:
    curved_tubes = None
    straight_tubes = None
# ---------- end ghpython_script ----------
ghpython_script_2 = GhPythonScript(
    scent_number=value_listener_2.Scent_number,
    v_or_h=v_true__h_false,
    vertical_permutation_pattern=vertical_permutation_pattern,
    horizontal_permutation_pattern=horizontal_permutation_pattern)  # -> out, pattern; inputs vertical_permutation_pattern: list, horizontal_permutation_pattern: list
# ---------- ghpython_script_2: Python ----------
__author__ = "richluo"
__version__ = "2022.03.28"

import rhinoscriptsyntax as rs

print(scent_number) # default is a list type
if int(scent_number) == 1:
    pattern = None
else:
    if v_or_h:
        pattern = vertical_permutation_pattern
    else:
        pattern = horizontal_permutation_pattern
# ---------- end ghpython_script_2 ----------
create_radio_button_5 = CreateRadioButton(RadioButtonName=ghpython_script.curved_tubes, RadioButtonGroup="Type of tube", InitiallySelected=Toggle(True))
create_radio_button_6 = CreateRadioButton(RadioButtonName=ghpython_script.straight_tubes, RadioButtonGroup="Type of tube", InitiallySelected=False)
create_pulldown_menu = CreatePulldownMenu(Label="Pattern of Multi-Scent", ListItems=ghpython_script_2.pattern, SelectedIndex="1", showLabel=True)
value_listener_5 = ValueListener(Elements=create_pulldown_menu, SomeProperty=True)  # -> Permutation_pattern, Indices
create_pulldown_menu_2 = CreatePulldownMenu(Label="Number of Tube Channel", ListItems=ghpython_script.channel, SelectedIndex="5", showLabel=True)
create_wrappanel_3 = CreateWrapPanel(UIElements=[create_radio_button_5, create_radio_button_6], Horizontal=True)
value_listener_6 = ValueListener(Elements=create_wrappanel_3, SomeProperty=True)  # -> flatten(Curved_tube_pattern), Indices
panel_5 = Panel(value_listener_5.Permutation_pattern)
value_listener_7 = ValueListener(Elements=create_pulldown_menu_2, SomeProperty=True)  # -> Tube_holder_number, Indices
panel_6 = Panel(value_listener_2.Scent_number)
create_wrappanel_4 = CreateWrapPanel(UIElements=[create_pulldown_menu_2, create_wrappanel_3], Horizontal=True)
v_true__h_false_2 = ListItem(List=value_listener_6.Curved_tube_pattern, Index=0, Wrap=True)
bottom_thickness = Panel("1.5")
panel_7 = Panel(list_item)
panel_8 = Panel(v_true__h_false)
divide_count = Slider(8, range=0..10)
panel_9 = Panel(value_listener_4.Values)
panel_10 = Panel(v_true__h_false_2)
panel_11 = Panel(value_listener_7.Tube_holder_number)
adjust_element_positioning = AdjustElementPositioning(
    ElementsToAdjust=[create_wrappanel, create_text_box, create_wrappanel_2, create_wrappanel_3],
    Margin="6",
    AbsolutePositioning=False)
cylinder = Cylinder(Base=PlaneXY(0, 0, 0), Radius=addition_3, Length=piezo_holder_cap_height)
cylinder_2 = Cylinder(Base=PlaneXY(0, 0, 0), Radius=addition_6, Length=piezo_holder_cap_height)
cylinder_3 = Cylinder(Base=PlaneXY(0, 0, 0), Radius=addition_5, Length=addition)
cylinder_4 = Cylinder(Base=PlaneXY(0, 0, 0), Radius=addition_6, Length=addition)
bottom_cylinder = Cylinder(Base=PlaneXY(0, 0, 0), Radius=addition_6, Length=bottom_thickness)
cylinder_5 = Cylinder(Base=PlaneXY(0, 0, 0), Radius=addition_7, Length=peizo_holder_lock_height)
cylinder_6 = Cylinder(Base=PlaneXY(0, 0, 0), Radius=addition_5, Length=peizo_holder_lock_height)
merge = Merge(Data1=create_label_4, Data2=create_wrappanel_4, Data3=create_slider)  # -> flatten(Result)
merge_2 = Merge(
    Data1=flatten([create_label, create_wrappanel]),
    Data2=flatten([create_label_2, create_text_box]),
    Data3=flatten([create_label_3, create_wrappanel_2, create_pulldown_menu]),
    Data4=flatten(merge))
unit_z_2 = UnitZ(Factor=addition_2)
move = Move(Geometry=cylinder, Motion=unit_z_2)  # -> Geometry, Transform
unit_z_3 = UnitZ(Factor=addition_2)
move_2 = Move(Geometry=cylinder_2, Motion=unit_z_3)  # -> Geometry, Transform
cap_holes = CapHoles(Brep=cylinder_3)
cap_holes_2 = CapHoles(Brep=cylinder_4)
cap_holes_3 = CapHoles(Brep=bottom_cylinder)
cap_holes_4 = CapHoles(Brep=cylinder_5)
cap_holes_5 = CapHoles(Brep=cylinder_6)
panel_12 = Panel("""no_attachment
cylinder_clip
cubic_clip
hair_clip_connector
hook
ring
elastic
stand
magnet
sticker""")
panel_13 = Panel("""back
side
no_guide""")
unit_z_4 = UnitZ(Factor=peizo_holder_lock_height)
reverse_2 = Reverse(Vector=unit_z_4)
unit_z_5 = UnitZ(Factor=peizo_holder_lock_height)
reverse_3 = Reverse(Vector=unit_z_5)
pcb_attachment_methods = ValueList({"No_Attachment": "no_attachment", "Cylinder Clip": "cylinder_clip", "Cubic Clip": "cubic_clip", "Hair Clip Connector": "hair_clip_connector", "Hook": "hook", "Ring": "ring", "Elastic": "elastic", "Stand": "stand", "Magnet": "magnet", "Sticker": "sticker"}, selected="No_Attachment")
od_attachment_methods = ValueList({"No_Attachment": "no_attachment", "Cylinder Clip": "cylinder_clip", "Cubic Clip": "cubic_clip", "Hair Clip Connector": "hair_clip_connector", "Hook": "hook", "Ring": "ring", "Elastic": "elastic", "Stand": "stand", "Magnet": "magnet", "Sticker": "sticker"}, selected="No_Attachment")
cap_holes_6 = CapHoles(Brep=move.Geometry)
deconstruct_brep = DeconstructBrep(Brep=cap_holes_6)  # -> Faces, Edges, Vertices
list_item_2 = ListItem(List=deconstruct_brep.Faces, Index=0, Wrap=True)
deconstruct_arc = DeconstructArc(Arc=list_item_2)  # -> BasePlane, Tube_radius, Angle
addition_9 = Addition(Tube_radius=deconstruct_arc.Tube_radius, Peizo_holder_thickness=piezo_holder_thickness)
addition_10 = Addition(A=addition_9, Lock_thickness=lock_thickness)
circle = Circle(Plane=list_item_2, Radius=addition_9)
move_3 = Move(Geometry=circle, Motion=reverse)  # -> Geometry, Transform
circle_2 = Circle(Plane=move_3.Geometry, Radius=addition_10)
divide_curve = DivideCurve(Curve=move_3.Geometry, Count=divide_count, Kinks=False)  # -> Points, Tangents, Parameters
divide_curve_2 = DivideCurve(Curve=circle_2, Count=divide_count, Kinks=False)  # -> Points, Tangents, Parameters
list_item_3 = ListItem(List=divide_curve.Parameters, Index="0", Wrap=True)
list_item_4 = ListItem(List=divide_curve.Parameters, Index="1", Wrap=True)
list_item_5 = ListItem(List=divide_curve_2.Parameters, Index="0", Wrap=True)
list_item_6 = ListItem(List=divide_curve_2.Parameters, Index="1", Wrap=True)
list_item_7 = ListItem(List=divide_curve.Parameters, Index="4", Wrap=True)
list_item_8 = ListItem(List=divide_curve.Parameters, Index="5", Wrap=True)
list_item_9 = ListItem(List=divide_curve_2.Parameters, Index="4", Wrap=True)
list_item_10 = ListItem(List=divide_curve_2.Parameters, Index="5", Wrap=True)
construct_domain = ConstructDomain(DomainStart=list_item_3, DomainEnd=list_item_4)
sub_curve = SubCurve(BaseCurve=move_3.Geometry, Domain=construct_domain)
construct_domain_2 = ConstructDomain(DomainStart=list_item_5, DomainEnd=list_item_6)
sub_curve_2 = SubCurve(BaseCurve=circle_2, Domain=construct_domain_2)
construct_domain_3 = ConstructDomain(DomainStart=list_item_7, DomainEnd=list_item_8)
sub_curve_3 = SubCurve(BaseCurve=move_3.Geometry, Domain=construct_domain_3)
construct_domain_4 = ConstructDomain(DomainStart=list_item_9, DomainEnd=list_item_10)
sub_curve_4 = SubCurve(BaseCurve=circle_2, Domain=construct_domain_4)
extrude = Extrude(Base=list_item_2, Direction=reverse_2)
boundary_surfaces = BoundarySurfaces(Edges=circle)
extrude_2 = Extrude(Base=boundary_surfaces, Direction=reverse_3)
volume = Volume(Geometry=cap_holes_6)  # -> Volume, Centroid
cap_holes_7 = CapHoles(Brep=move_2.Geometry)
solid_difference = SolidDifference(BrepsA=cap_holes_5, BrepsB=cap_holes_4)
panel_14 = Panel("Use a spherical joint to make the scent container angle adjustable")
pcb_guide_position = ValueList({"Back": "back", "Side": "side", "No_Guide": "no_guide"}, selected="Back")
angle_adjustable = BooleanToggle(True)
# Part 2: Attachment Design
panel_15 = Panel("1. Arrangement of Scent Container and PCB")
# Part 3: Generate Fabrication-Ready Objects
panel_16 = Panel("Generate the Final Design!")
solid_difference_2 = SolidDifference(BrepsA=extrude_2, BrepsB=extrude)
point_on_curve = PointOnCurve(sub_curve, parameter=0)
point_on_curve_2 = PointOnCurve(sub_curve, parameter=1)
point_on_curve_3 = PointOnCurve(sub_curve_2, parameter=0)
point_on_curve_4 = PointOnCurve(sub_curve_2, parameter=1)
point_on_curve_5 = PointOnCurve(sub_curve_3, parameter=0)
point_on_curve_6 = PointOnCurve(sub_curve_3, parameter=1)
point_on_curve_7 = PointOnCurve(sub_curve_4, parameter=0)
point_on_curve_8 = PointOnCurve(sub_curve_4, parameter=1)
piezo_holder_cap = SolidDifference(BrepsA=cap_holes_7, BrepsB=cap_holes_6)
cylinder_7 = Cylinder(Base=volume.Centroid, Piezo_radius=expression_2, Piezo_height=piezo_height)
cap_holes_8 = CapHoles(Brep=cylinder_7)
deconstruct_brep_2 = DeconstructBrep(Brep=cap_holes_8)  # -> Faces, Edges, Vertices
list_item_11 = ListItem(List=deconstruct_brep_2.Edges, Index=0, Wrap=True)
divide_curve_3 = DivideCurve(Curve=list_item_11, Count=expr("x*2", divide_count), Kinks=False)  # -> Points, Tangents, Parameters
# Bottom Part
solid_union = SolidUnion(Breps=[solid_difference, cap_holes_3])
create_radio_button_7 = CreateRadioButton(RadioButtonName="One Whole Part", RadioButtonGroup="OD_PCB_integration", InitiallySelected=Toggle(True))
create_radio_button_8 = CreateRadioButton(RadioButtonName="Two Separated Parts", RadioButtonGroup="OD_PCB_integration", InitiallySelected=False)
panel_17 = Panel("1")
create_label_5 = CreateLabel(LabelText=panel_15, LabelSize="15", Justification=0)
create_label_6 = CreateLabel(LabelText="2. Select an Attachment and its Position", LabelSize="15", Justification=0)
create_pulldown_menu_3 = CreatePulldownMenu(Label="Attachment on the PCB Case", ListItems=panel_12, showLabel=True)
create_checkbox = CreateCheckbox(Label=panel_14, StartingValue=angle_adjustable)
adjust_element_positioning_2 = AdjustElementPositioning(ElementsToAdjust=create_checkbox, Margin="10", AbsolutePositioning=False)
create_true_only_button = CreateTrueOnlyButton(ButtonName=panel_16, ButtonStyle=0)
value_listener_8 = ValueListener(Elements=create_true_only_button, SomeProperty=True)  # -> Values, Indices
panel_18 = Panel(value_listener_8.Values)
line = Line(StartPoint=point_on_curve, EndPoint=point_on_curve_3)
line_2 = Line(StartPoint=point_on_curve_4, EndPoint=point_on_curve_2)
line_3 = Line(StartPoint=point_on_curve_5, EndPoint=point_on_curve_7)
line_4 = Line(StartPoint=point_on_curve_8, EndPoint=point_on_curve_6)
list_item_12 = ListItem(List=deconstruct_brep_2.Faces, Index=0, Wrap=True)
area = Area(Geometry=list_item_12)  # -> Area, Centroid
create_wrappanel_5 = CreateWrapPanel(UIElements=[create_radio_button_7, create_radio_button_8], Horizontal=True)
value_listener_9 = ValueListener(Elements=create_wrappanel_5, SomeProperty=True)  # -> flatten(OD_PCB_integration), Indices
list_item_13 = ListItem(List=divide_curve_3.Points, Index="1", Wrap=True)
value_listener_10 = ValueListener(Elements=create_checkbox, SomeProperty=True)  # -> Angle_adjustable, Indices
panel_19 = Panel(value_listener_10.Angle_adjustable)
value_listener_11 = ValueListener(Elements=create_pulldown_menu_3, SomeProperty=True)  # -> PCB_attachment_methods, Indices
ghpython_script_3 = GhPythonScript(PCB_attachment_methods=value_listener_11.PCB_attachment_methods)  # -> out, attachment_parameters, default_text
# ---------- ghpython_script_3: Python ----------
__author__ = "richluo"
__version__ = "2022.04.07"

import rhinoscriptsyntax as rs

attachment_parameters = []
default_text = []
if PCB_attachment_methods == 'cylinder_clip':
    attachment_parameters.append("TargetObjectRadius (mm)")
    default_text.append("25")

elif PCB_attachment_methods == 'cubic_clip':
    attachment_parameters.append("TargetObjectWidth (mm)")
    attachment_parameters.append("TargetObjectLength (mm)")
    default_text.append("35")
    default_text.append("30")
    
elif PCB_attachment_methods == 'hook':
    attachment_parameters.append("TargetWidth (mm)")
    default_text.append("6")

elif PCB_attachment_methods == 'ring':
    attachment_parameters.append("Interval (mm)")
    attachment_parameters.append("Width (mm)")
    attachment_parameters.append("Length (mm)")
    attachment_parameters.append("Rounded (mm)")
    attachment_parameters.append("Single or Double")
    default_text.append("10")
    default_text.append("10")
    default_text.append("30")
    default_text.append("4")
    default_text.append("Double")

elif PCB_attachment_methods == 'stand':
    attachment_parameters.append("BaseRadius (mm)")
    attachment_parameters.append("BaseThickness (mm)")
    attachment_parameters.append("StandHeight (mm)")
    default_text.append("30")
    default_text.append("5")
    default_text.append("80")
    
elif PCB_attachment_methods == 'magnet':
    attachment_parameters.append("Length (mm)")
    default_text.append("30")
    
elif PCB_attachment_methods == 'sticker':
    attachment_parameters.append("Length (mm)")
    default_text.append("30")
# ---------- end ghpython_script_3 ----------
create_text_box_2 = CreateTextBox(
    Label=ghpython_script_3.attachment_parameters,
    DefaultText=ghpython_script_3.default_text,
    UpdateButton=True,
    showLabel=True)
value_listener_12 = ValueListener(Elements=create_text_box_2, SomeProperty=True)  # -> Values, Indices
panel_20 = Panel(ghpython_script_3.attachment_parameters)
panel_21 = Panel(value_listener_11.PCB_attachment_methods)
adjust_element_appearance = AdjustElementAppearance(ElementsToAdjust=create_true_only_button, FontSize="14")
adjust_element_positioning_3 = AdjustElementPositioning(ElementsToAdjust=create_true_only_button, AbsolutePositioning=False, Width="550")
join_curves = JoinCurves(Curves=[sub_curve, line, sub_curve_2, line_2], Preserve=False)
boundary_surfaces_2 = BoundarySurfaces(Edges=join_curves)
unit_z_6 = UnitZ(Factor=lock_height)
# Lock Right
extrude_3 = Extrude(Base=boundary_surfaces_2, Direction=unit_z_6)
join_curves_2 = JoinCurves(Curves=[sub_curve_3, line_3, sub_curve_4, line_4], Preserve=False)
boundary_surfaces_3 = BoundarySurfaces(Edges=join_curves_2)
unit_z_7 = UnitZ(Factor=lock_height)
# Lock Left
extrude_4 = Extrude(Base=boundary_surfaces_3, Direction=unit_z_7)
volume_2 = Volume(Geometry=cap_holes_8)  # -> Volume, Centroid
vector_2pt = Vector2Pt(PointA=area.Centroid, PointB=list_item_13, Unitize=False)  # -> Vector, Length
plane_normal = PlaneNormal(Origin=area.Centroid, ZAxis=vector_2pt.Vector)
brep_plane = BrepPlane(Brep=cap_holes_8, Plane=plane_normal)  # -> Curves, Points
amplitude = Amplitude(Vector=vector_2pt.Vector, Amplitude=addition_6)
list_item_14 = ListItem(List=value_listener_9.OD_PCB_integration, Index=0, Wrap=True)
ghpython_script_4 = GhPythonScript(v_or_h=v_true__h_false, OD_PCB_integration=list_item_14, pcb_guide_position=panel_13, OD_attachment_methods=panel_12)  # -> out, list1, list2; inputs pcb_guide_position: list, OD_attachment_methods: list
# ---------- ghpython_script_4: Python ----------
__author__ = "richluo"
__version__ = "2022.03.28"

import rhinoscriptsyntax as rs

if v_or_h: # vertical scent container
    if OD_PCB_integration:
        list1 = pcb_guide_position
        list2 = None
    else:
        list1 = None
        list2 = OD_attachment_methods
else: # horizontal scent container
    if OD_PCB_integration:
        list1 = pcb_guide_position
        list2 = None
    else:
        list1 = None
        list2 = OD_attachment_methods
# ---------- end ghpython_script_4 ----------
create_pulldown_menu_4 = CreatePulldownMenu(Label="Position of the Attachment on PCB", ListItems=ghpython_script_4.list1, showLabel=True)
create_pulldown_menu_5 = CreatePulldownMenu(Label="Attachment on the Scent Container", ListItems=ghpython_script_4.list2, showLabel=True)
value_listener_13 = ValueListener(Elements=create_pulldown_menu_4, SomeProperty=True)  # -> Pcb_guide_position, Indices
value_listener_14 = ValueListener(Elements=create_pulldown_menu_5, SomeProperty=True)  # -> OD_attachment_methods, Indices
panel_22 = Panel(value_listener_13.Pcb_guide_position)
panel_23 = Panel(value_listener_14.OD_attachment_methods)
# Piezo Holder Lock Part
solid_union_2 = SolidUnion(Breps=flatten([solid_difference_2, extrude_3, extrude_4]))
panel_24 = Panel(list_item_14)
vector_2pt_2 = Vector2Pt(PointA=volume_2.Centroid, PointB=area.Centroid, Unitize=False)  # -> Vector, Length
extrude_5 = Extrude(Base=brep_plane.Curves, Direction=amplitude)
cap_holes_9 = CapHoles(Brep=extrude_5)
solid_union_3 = SolidUnion(Breps=flatten([cap_holes_9, cap_holes_8]))
move_4 = Move(Geometry=solid_union_3, Motion=vector_2pt_2.Vector)  # -> Geometry, Transform
adjust_element_positioning_4 = AdjustElementPositioning(ElementsToAdjust=[create_wrappanel_5, create_checkbox], Margin="6", AbsolutePositioning=False)
subtraction = Subtraction(A=peizo_holder_lock_height, B=silicone_ring_thickness)
subtraction_2 = Subtraction(Peizo_holder_height=subtraction, Lock_height=lock_height)
subtraction_3 = Subtraction(A=subtraction_2, Tube_holder_tolerance=tube_holder_tolerance)
subtraction_4 = Subtraction(Tube_holder_height=addition, B=subtraction_3)
addition_11 = Addition(Lock_height=lock_height, Tube_holder_tolerance=tube_holder_tolerance)
subtraction_5 = Subtraction(Piezo_holder_height=peizo_holder_lock_height, Silicone_ring_thickness=silicone_ring_thickness)
# Piezo Holder Cap
solid_difference_3 = SolidDifference(BrepsA=piezo_holder_cap, BrepsB=move_4.Geometry)
plane_offset = PlaneOffset(BasePlane=PlaneXY(0, 0, 0), Tube_holder_height=addition)
plane_offset_2 = PlaneOffset(BasePlane=PlaneXY(0, 0, 0), Tube_holder_height=addition)
project = Project(Geometry=boundary_surfaces_2, Plane=plane_offset)  # -> Geometry, Transform
project_2 = Project(Geometry=boundary_surfaces_3, Plane=plane_offset_2)  # -> Geometry, Transform
plane_offset_3 = PlaneOffset(BasePlane=PlaneXY(0, 0, 0), Offset=subtraction_4)
project_3 = Project(Geometry=boundary_surfaces_2, Plane=plane_offset_3)  # -> Geometry, Transform
plane_offset_4 = PlaneOffset(BasePlane=PlaneXY(0, 0, 0), Offset=subtraction_4)
project_4 = Project(Geometry=boundary_surfaces_3, Plane=plane_offset_4)  # -> Geometry, Transform
unit_z_8 = UnitZ(Factor=subtraction_5)
reverse_4 = Reverse(Vector=unit_z_8)
extrude_6 = Extrude(Base=project.Geometry, Direction=reverse_4)
unit_z_9 = UnitZ(Factor=subtraction_5)
reverse_5 = Reverse(Vector=unit_z_9)
extrude_7 = Extrude(Base=project_2.Geometry, Direction=reverse_5)
unit_z_10 = UnitZ(Factor=addition_11)
reverse_6 = Reverse(Vector=unit_z_10)
extrude_8 = Extrude(Base=project_3.Geometry, Direction=reverse_6)
unit_z_11 = UnitZ(Factor=addition_11)
reverse_7 = Reverse(Vector=unit_z_11)
extrude_9 = Extrude(Base=project_4.Geometry, Direction=reverse_7)
rotate = Rotate(Geometry=extrude_8, Angle=expr("-0.25*pi", 1.570796327), Plane=PlaneXY(0, 0, 0))  # -> flatten(Geometry), Transform
rotate_2 = Rotate(Geometry=extrude_9, Angle=expr("-0.25*pi", 1.570796327), Plane=PlaneXY(0, 0, 0))  # -> flatten(Geometry), Transform
solid_union_4 = SolidUnion(Breps=flatten([extrude_6, rotate.Geometry]))
solid_union_5 = SolidUnion(Breps=flatten([extrude_7, rotate_2.Geometry]))
pi = Pi(Factor="2")
scent_number = Slider(3, range=1..20)
interval = Slider(2, range=0..150)
ghpython_script_5 = GhPythonScript(pcb_guide_position=value_listener_13.Pcb_guide_position, OD_attachment_methods=value_listener_14.OD_attachment_methods)  # -> out, add_attachments_toOD
# ---------- ghpython_script_5: Python ----------
__author__ = "richluo"
__version__ = "2022.03.29"

import rhinoscriptsyntax as rs

if pcb_guide_position == "no_guide" or OD_attachment_methods == "no_attachment" or OD_attachment_methods == "ring" or OD_attachment_methods == "elastic":
    add_attachments_toOD = False
else:
    add_attachments_toOD = True
# ---------- end ghpython_script_5 ----------
od_pcb_integration = BooleanToggle(True)
pcb_guide_position_2 = ValueList({"Back": "back", "Side": "side", "No_Guide": "no_guide"}, selected="No_Guide")
permutation_pattern = ValueList({"Line Pattern", "Rectangle Pattern", "Circle Pattern", "Centralized Pattern"}, selected="Rectangle Pattern")
division = Division(A=pi, B=divide_count)
add_attachments_tood = BooleanToggle(True)
solid_difference_4 = SolidDifference(BrepsA=cap_holes_2, BrepsB=cap_holes)
solid_union_6 = SolidUnion(Breps=[solid_difference_4, solid_union])
volume_3 = Volume(Geometry=solid_union_4)  # -> Volume, Centroid
scale = Scale(Geometry=solid_union_4, Center=volume_3.Centroid, Factor=lock_scale_factor)  # -> Geometry, Transform
volume_4 = Volume(Geometry=solid_union_5)  # -> Volume, Centroid
scale_2 = Scale(Geometry=solid_union_5, Center=volume_4.Centroid, Factor=lock_scale_factor)  # -> Geometry, Transform
# Piezo Holder
solid_union_7 = SolidUnion(Breps=flatten([solid_difference_3, solid_union_2]))
rotate_3 = Rotate(Geometry=solid_union_7, Angle=expr("0.5*pi - x", division), Plane=PlaneXY(0, 0, 0))  # -> Geometry, Transform
pcb_guide = Geometry(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)
pcb_case = Geometry(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)
pcb_guide_onod = Geometry(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)
file_path = FilePath("C:\Users\richluo\Desktop\cuizhitong\OneDrive - zju.edu.cn\OlfacKit\GhPython\vertical_permutation.py")
# Tube Holder
# Without Hollow
solid_difference_5 = SolidDifference(BrepsA=solid_union_6, BrepsB=flatten([scale.Geometry, scale_2.Geometry]))
readfile = ReadFile(Path=file_path)  # -> out, Data
# ---------- readfile: Python ----------
"""Reads the contents of a file.
    How to use:
        This file should be included in a GhPython Component.
    Inputs:
        Path: The absolute path of the file to read
        PerLine: By default True to output the data line by line, or False
        Empty: By default True, or False to remove empty lines
    Output:
        Data: The file content"""

__author__ = "Zhitong Cui"
__version__ = "2022-2-23"

## -----------------------------------------------------------------------------

ghenv.Component.Name = "Read File"
ghenv.Component.NickName = "ReadFile"

import Grasshopper as gh
import os

def read_lines(fpath, empty=True):
    """Reads the contents of a file line by line.

    Args:
      fpath: An absolute path to a file to read
      empty: By default True to remove empty lines

    Raises:
      OSError: '<fpath>' is not a valid file path
      RuntimeError: Unable to read 'fname'

    Returns:
      The individual lines of data in a list.
    """
    lines = []
    if not os.path.exists(fpath) or not os.path.isfile(fpath):
        raise OSError("'{}' is not a valid file path".format(fpath))

    try:
        with open(fpath) as f:
            for line in f:
                if not empty and (line == '\n' or line == '\r\n'):
                    continue
                lines.append(line)
    except:
        basedir, fname = os.path.split(fpath)
        raise RuntimeError("Unable to read '{}'".format(fname))

    return lines

# ----------------------------------------------

if __name__ == "__main__":
    # Manage path input
    if Path is None:
        e = "Input parameter Path failed to collect data"
        ghenv.Component.AddRuntimeMessage(gh.Kernel.GH_RuntimeMessageLevel.Warning, e)

    if PerLine is None:
        Perline = True

    if Empty is None:
        Empty = True

    if Path is not None:
        # Read data from file
        lines = []
        try:
            lines = read_lines(Path, Empty)
        except Exception as e:
            ghenv.Component.AddRuntimeMessage(gh.Kernel.GH_RuntimeMessageLevel.Error, str(e))
        # Output data
        if PerLine:
            Data = lines
        else:
            Data = "".join(lines)
# ---------- end readfile ----------
deconstruct_brep_3 = DeconstructBrep(Brep=scale.Geometry)  # -> Faces, Edges, Vertices
list_item_15 = ListItem(List=deconstruct_brep_3.Faces, Index="4", Wrap=True)
unit_z_12 = UnitZ(Factor=lock_height)
reverse_8 = Reverse(Vector=unit_z_12)
move_5 = Move(Geometry=list_item_15, Motion=reverse_8)  # -> Geometry, Transform
unit_z_13 = UnitZ(Factor=bottom_thickness)
panel_25 = Panel("""2
4""")
deconstruct_brep_4 = DeconstructBrep(Brep=move_5.Geometry)  # -> Faces, Edges, Vertices
list_item_16 = ListItem(List=deconstruct_brep_4.Edges, Index=panel_25, Wrap=True)
curve_middle = CurveMiddle(Curve=list_item_16)
fit_line = FitLine(Points=curve_middle)
surface_split = SurfaceSplit(Surface=move_5.Geometry, Curves=fit_line)
unit_z_14 = UnitZ(Factor="0")
explode_tree = ExplodeTree(Data=graft(surface_split))  # -> _0000, _0001
area_2 = Area(Geometry=explode_tree._0001)  # -> Area, Centroid
deconstruct = Deconstruct(Point=area_2.Centroid)  # -> XComponent, YComponent, ZComponent
subtraction_6 = Subtraction(A=deconstruct.ZComponent, B=peizo_holder_lock_height)
colour_picker = ColourPicker(PickedColour=RGBA(163, 163, 158, 120))
unit_z_15 = UnitZ(Factor=subtraction_6)
reverse_9 = Reverse(Vector=unit_z_15)
extrude_10 = Extrude(Base=explode_tree._0001, Direction=reverse_9)
deconstruct_brep_5 = DeconstructBrep(Brep=extrude_10)  # -> Faces, Edges, Vertices
list_item_17 = ListItem(List=deconstruct_brep_5.Faces, Index="4", Wrap=True)
area_3 = Area(Geometry=list_item_17)  # -> Area, Centroid
deconstruct_2 = Deconstruct(Point=area_3.Centroid)  # -> XComponent, YComponent, ZComponent
vector_xyz = VectorXYZ(XComponent=deconstruct_2.XComponent, YComponent=deconstruct_2.YComponent, ZComponent=0)  # -> Vector, Length
reverse_10 = Reverse(Vector=vector_xyz.Vector)
curve_to_polyline = CurveToPolyline(Curve=list_item_17, ToleranceDistance=0, ToleranceAngle=0)  # -> Polyline, Segments
fillet = Fillet(Curve=curve_to_polyline.Polyline, Radius="3")
boundary_surfaces_4 = BoundarySurfaces(Edges=fillet)
geometry = Geometry(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)
colour_picker_2 = ColourPicker(PickedColour=RGBA(124, 132, 191, 83))

# ----
# Hook
targetthickness = Slider(6, range=4..30)
ball_or_not = BooleanToggle(False)
hook = Hook(A=targetthickness, ball_or_not=value_listener_10.Angle_adjustable)
geometry_2 = Geometry(hook)

# ----
# Ring
interval_2 = Slider(8, range=0..50)
ringx = Slider(8, range=5..30)
ringy = Slider(30, range=5..40)
single_double = BooleanToggle(True)
corner = Slider(4, range=0..10)
ring_ear = RingEar(
    x_coordinate=interval_2,
    x_size=ringx,
    y_size=ringy,
    radius_2=corner,
    A=ringx,
    radius=corner,
    value=single_double,
    A_2=ringy)
geometry_3 = Geometry(ring_ear)

# ----
# Cubic Clip
ball_or_not_2 = BooleanToggle(False)
targetdepth = Slider(30, range=20..100)
targetwidth = Slider(35, range=20..100)
clip_square = Clip_Square(A=targetdepth, y_size=targetwidth, A_2=targetwidth, ball_or_not=value_listener_10.Angle_adjustable)
geometry_4 = Geometry(clip_square)

# ----
# Cylinder Clip
ball_or_not_3 = BooleanToggle(True)
targetradius = Slider(25, range=24..100)
clip_round = Clip_Round(A=targetradius, ball_or_not=value_listener_10.Angle_adjustable)
geometry_5 = Geometry(clip_round)

# ----
# Elastic
interval_3 = Slider(32, range=0..50)
single_double_2 = BooleanToggle(True)
t_size = Slider(10, range=8..12)
t_t = T_T(x_coordinate=interval_3, x_size=t_size, A_2=t_size, A=t_size, value=single_double_2, y_size=t_size)
geometry_6 = Geometry(t_t)

# ----
# Stand
baseradius = Slider(30, range=0..100)
basethickness = Slider(5, range=4..50)
standheight = Slider(80, range=10..200)
standradius = Panel("5")
stand = Stand(
    radius=baseradius,
    length=basethickness,
    factor=basethickness,
    radius_2=standradius,
    length_2=standheight,
    A=standheight,
    B=basethickness)
geometry_7 = Geometry(stand)

reverse_11 = Reverse(Vector=expr("x*-0.3", vector_xyz.Vector))
move_6 = Move(Geometry=boundary_surfaces_4, Motion=reverse_11)  # -> Geometry, Transform

# ----
# Magnet
ball_or_not_4 = BooleanToggle(True)
cluster = Cluster_2(ball_or_not=value_listener_10.Angle_adjustable)
geometry_8 = Geometry(cluster)

# ----
# Sticker
ball_or_not_5 = BooleanToggle(True)
cluster_2 = Cluster_3(ball_or_not=value_listener_10.Angle_adjustable)
geometry_9 = Geometry(cluster_2)

angle_adjustable_2 = BooleanToggle(True)
pcb_attachment_methods_2 = ValueList({"No_Attachment": "no_attachment", "Cylinder Clip": "cylinder_clip", "Cubic Clip": "cubic_clip", "Hair Clip Connector": "hair_clip_connector", "Hook": "hook", "Ring": "ring", "Elastic": "elastic", "Stand": "stand", "Magnet": "magnet", "Sticker": "sticker"}, selected="Sticker")
od_attachment_methods_2 = ValueList({"No_Attachment": "no_attachment", "Cylinder Clip": "cylinder_clip", "Cubic Clip": "cubic_clip", "Hair Clip Connector": "hair_clip_connector", "Hook": "hook", "Ring": "ring", "Elastic": "elastic", "Stand": "stand", "Magnet": "magnet", "Sticker": "sticker"}, selected="Stand")
extrude_11 = Extrude(Base=move_6.Geometry, Direction=reverse_10)
hollow_out_number = Slider(4, range=0..10)
# use maximum hollow_out_number=4 to avoid easy broke
polar_array = PolarArray(Geometry=extrude_11, Plane=PlaneXY(0, 0, 0), Count=hollow_out_number, Angle=6.283185307)  # -> Geometry, Transform
solid_difference_6 = SolidDifference(BrepsA=solid_difference_5, BrepsB=polar_array.Geometry)
# Tube Holder
rotate_4 = Rotate(Geometry=solid_difference_6, Angle=1.570796327, Plane=PlaneXY(0, 0, 0))  # -> Geometry, Transform
ghpython_script_6 = GhPythonScript(
    Code=readfile.Data,
    Piezo_holder=rotate_3.Geometry,
    Tube_holder=rotate_4.Geometry,
    Scent_number=value_listener_2.Scent_number,
    Permutation_pattern=value_listener_5.Permutation_pattern,
    Interval=interval,
    Pcb_case=pcb_case,
    Pcb_guide=pcb_guide,
    OD_PCB_integration=list_item_14,
    Pcb_guide_position=value_listener_13.Pcb_guide_position,
    Add_attachments_toOD=ghpython_script_5.add_attachments_toOD,
    Pcb_guide_onOD=pcb_guide_onod)  # -> Out, Permutation_circle, Permutation_piezo_holder, Permutation_tube_holder, Pedestal, Pcb_case_placement, Pcb_bottom_curve, Pedestal_polyline, OD_pcb_guide
geometry_10 = Geometry(ghpython_script_6.Pcb_case_placement)
geometry_11 = Geometry(ghpython_script_6.OD_pcb_guide)
geometry_12 = Geometry(ghpython_script_6.Permutation_piezo_holder)
geometry_13 = Geometry(ghpython_script_6.Permutation_circle)
geometry_14 = Geometry(ghpython_script_6.Permutation_tube_holder)
geometry_15 = Geometry(ghpython_script_6.Pedestal)
extrude_12 = Extrude(Pedestal=geometry_15, Direction=unit_z_13)
# Pedestal_and_PCB_Case
solid_union_8 = SolidUnion(Breps=flatten([extrude_12, geometry_10, geometry_11]))
panel_26 = Panel(ghpython_script_6.Out)
move_7 = Move(Geometry=geometry_12, Motion=unit_z_14)  # -> Geometry, Transform

# ----
# Hair Clip Connector
geometry_16 = Geometry(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)

file_path_2 = FilePath("C:\Users\richluo\Desktop\cuizhitong\OneDrive - zju.edu.cn\OlfacKit\GhPython\vertical_attachments.py")
readfile_2 = ReadFile(Path=file_path_2)  # -> out, Data; same code as readfile
ghpython_script_7 = GhPythonScript(
    Code=readfile_2.Data,
    OD_PCB_integration=list_item_14,
    Pcb_guide_position=value_listener_13.Pcb_guide_position,
    Add_attachments_toOD=ghpython_script_5.add_attachments_toOD,
    Angle_adjustable=value_listener_10.Angle_adjustable,
    PCB_attachment_methods=value_listener_11.PCB_attachment_methods,
    OD_attachment_methods=value_listener_14.OD_attachment_methods,
    Cylinder_clip=geometry_5,
    Cubic_clip=geometry_4,
    Hair_clip_connector=geometry_16,
    Hook=geometry_2,
    Ring=geometry_3,
    Elastic=geometry_6,
    Stand=geometry_7,
    Magnet=geometry_8,
    Sticker=geometry_9)  # -> Out, Pcb_gen_attchment, Od_gen_attchment
panel_27 = Panel(ghpython_script_7.Out)
geometry_17 = Geometry(ghpython_script_7.Pcb_gen_attchment)
geometry_18 = Geometry(ghpython_script_7.Od_gen_attchment)
expression_3 = Expression(OD_PCB_integration=list_item_14, Expression="if (OD_PCB_integration=True, 3.5, 1.5)")
# Horizontal: Piezo 10/16mm
expression_4 = Expression(piezo_size=list_item, Expression="if(piezo_size=True, 4, 6)")
expression_5 = Expression(
    tube_radius=expression_4,
    OD_PCB_integration=list_item_14,
    Expression="if (tube_radius=4, if (OD_PCB_integration,17,15), if (OD_PCB_integration,19,17))")
expression_6 = Expression(tube_radius=expression_4, Expression="if(tube_radius=4, 2, 3)")
# 10mm piezo, radius=5mm, 0.2mm tolerance
expression_7 = Expression(tube_radius=expression_4, Expression="if(tube_radius=4, 5.2, 8.2)")
expression_8 = Expression(
    horizontal_tube_radius=expression_6,
    OD_PCB_integration=list_item_14,
    Expression="if (OD_PCB_integration, if (horizontal_tube_radius=2, 0.5, 0.6), 0.9)")
piezo_holder_cap_height_2 = Slider(6, range=0..100)
tube_holder_tolerance_2 = Slider(0.2, range=0..1)
peizo_holder_lock_height_2 = Slider(8, range=0..10)
piezo_holder_thickness_2 = Slider(2, range=0..10)
lock_thickness_2 = Slider(2, range=0..10)
lock_height_2 = Slider(3, range=0..10)
lock_scale_factor_2 = Slider(1.05, range=0..10)
extended_tube_holder_length = Slider(10, range=0..100)
tube_inner_tolerance_2 = Slider(0.2, range=0..1)
silicone_ring_thickness_2 = Slider(0.8, range=0..10)
piezo_height_2 = Slider(2.5, range=0..10)
additonal_seal_thickness = Slider(1.5, range=0..10)
panel_28 = Panel("3mm lock_height + 4mm")
tube_fix_tolerance = Slider(0.1, range=-1..1)
addition_12 = Addition(Horizontal_tube_radius=expression_6, Tube_fix_tolerance=tube_fix_tolerance)
addition_13 = Addition(Radius_inner_clylinder=addition_12, Additonal_seal_thickness=additonal_seal_thickness)
addition_14 = Addition(Extended_tube_holder_length=extended_tube_holder_length, Additonal_seal_thickness=additonal_seal_thickness)
addition_15 = Addition(Tube_radius=expression_4, Tube_radius_tolerance=tube_inner_tolerance_2)
addition_16 = Addition(Tube_holder_height=expression_5, Silicone_ring_thickness=silicone_ring_thickness_2)
addition_17 = Addition(Tube_radius=addition_15, Piezo_holder_thickness=piezo_holder_thickness_2)
addition_18 = Addition(A=addition_17, Lock_thickness=lock_thickness_2)
addition_19 = Addition(A=addition_18, Additonal_seal_thickness=additonal_seal_thickness)
addition_20 = Addition(Extended_tube_holder_length=extended_tube_holder_length, B=addition_19)
addition_21 = Addition(A=addition_17, Tolerance=tube_holder_tolerance_2)
addition_22 = Addition(A=addition_17, Lock_thickness=lock_thickness_2)
addition_23 = Addition(A=addition_22, Additonal_seal_thickness=additonal_seal_thickness)
cylinder_8 = Cylinder(Base=PlaneXY(0, 0, 0), Radius=addition_15, Length=piezo_holder_cap_height_2)
cylinder_9 = Cylinder(Base=PlaneXY(0, 0, 0), Radius=addition_22, Length=piezo_holder_cap_height_2)
cylinder_10 = Cylinder(Base=PlaneXY(0, 0, 0), Radius=addition_21, Length=expression_5)
cylinder_11 = Cylinder(Base=PlaneXY(0, 0, 0), Radius=addition_23, Length=expression_5)
bottom_cylinder_2 = Cylinder(Base=PlaneXY(0, 0, 0), Radius=addition_23, Length=expression_3)
cylinder_12 = Cylinder(Base=PlaneXY(0, 0, 0), Radius=addition_12, Length=addition_20)
unit_z_16 = UnitZ(Factor=peizo_holder_lock_height_2)
reverse_12 = Reverse(Vector=unit_z_16)
divide_count_2 = Slider(8, range=0..10)
unit_z_17 = UnitZ(Factor=addition_16)
move_8 = Move(Geometry=cylinder_8, Motion=unit_z_17)  # -> Geometry, Transform
unit_z_18 = UnitZ(Factor=addition_16)
move_9 = Move(Geometry=cylinder_9, Motion=unit_z_18)  # -> Geometry, Transform
cap_holes_10 = CapHoles(Brep=cylinder_10)
cap_holes_11 = CapHoles(Brep=cylinder_11)
cap_holes_12 = CapHoles(Brep=bottom_cylinder_2)
cap_holes_13 = CapHoles(Brep=cylinder_12)
unit_z_19 = UnitZ(Factor=peizo_holder_lock_height_2)
reverse_13 = Reverse(Vector=unit_z_19)
unit_z_20 = UnitZ(Factor=peizo_holder_lock_height_2)
reverse_14 = Reverse(Vector=unit_z_20)
cap_holes_14 = CapHoles(Brep=move_8.Geometry)
deconstruct_brep_6 = DeconstructBrep(Brep=cap_holes_14)  # -> Faces, Edges, Vertices
list_item_18 = ListItem(List=deconstruct_brep_6.Faces, Index=0, Wrap=True)
deconstruct_arc_2 = DeconstructArc(Arc=list_item_18)  # -> BasePlane, Tube_radius, Angle
addition_24 = Addition(Tube_radius=deconstruct_arc_2.Tube_radius, Peizo_holder_thickness=piezo_holder_thickness_2)
addition_25 = Addition(A=addition_24, Lock_thickness=lock_thickness_2)
circle_3 = Circle(Plane=list_item_18, Radius=addition_24)
move_10 = Move(Geometry=circle_3, Motion=reverse_12)  # -> Geometry, Transform
circle_4 = Circle(Plane=move_10.Geometry, Radius=addition_25)
divide_curve_4 = DivideCurve(Curve=move_10.Geometry, Count=divide_count_2, Kinks=False)  # -> Points, Tangents, Parameters
divide_curve_5 = DivideCurve(Curve=circle_4, Count=divide_count_2, Kinks=False)  # -> Points, Tangents, Parameters
extrude_13 = Extrude(Base=list_item_18, Direction=reverse_13)
boundary_surfaces_5 = BoundarySurfaces(Edges=circle_3)
extrude_14 = Extrude(Base=boundary_surfaces_5, Direction=reverse_14)
volume_5 = Volume(Geometry=cap_holes_14)  # -> Volume, Centroid
cap_holes_15 = CapHoles(Brep=move_9.Geometry)
# Bottom Part
bottom_part = SolidUnion(Breps=cap_holes_12)
list_item_19 = ListItem(List=divide_curve_4.Parameters, Index="0", Wrap=True)
list_item_20 = ListItem(List=divide_curve_4.Parameters, Index="1", Wrap=True)
list_item_21 = ListItem(List=divide_curve_5.Parameters, Index="0", Wrap=True)
list_item_22 = ListItem(List=divide_curve_5.Parameters, Index="1", Wrap=True)
list_item_23 = ListItem(List=divide_curve_4.Parameters, Index="4", Wrap=True)
list_item_24 = ListItem(List=divide_curve_4.Parameters, Index="5", Wrap=True)
list_item_25 = ListItem(List=divide_curve_5.Parameters, Index="4", Wrap=True)
list_item_26 = ListItem(List=divide_curve_5.Parameters, Index="5", Wrap=True)
solid_difference_7 = SolidDifference(BrepsA=extrude_14, BrepsB=extrude_13)
piezo_holder_cap_2 = SolidDifference(BrepsA=cap_holes_15, BrepsB=cap_holes_14)
cylinder_13 = Cylinder(Base=volume_5.Centroid, Piezo_radius=expression_7, Piezo_height=piezo_height_2)
cap_holes_16 = CapHoles(Brep=cylinder_13)
deconstruct_brep_7 = DeconstructBrep(Brep=cap_holes_16)  # -> Faces, Edges, Vertices
list_item_27 = ListItem(List=deconstruct_brep_7.Edges, Index=0, Wrap=True)
divide_curve_6 = DivideCurve(Curve=list_item_27, Count=expr("x*2", divide_count_2), Kinks=False)  # -> Points, Tangents, Parameters
unit_y = UnitY(Factor=1)
rotate_3d = Rotate3D(Geometry=cap_holes_13, Angle=1.570796327, Center=Point(0, 0, 0), Axis=unit_y)  # -> Geometry, Transform
addition_26 = Addition(A=expression_3, B=addition_12)
unit_z_21 = UnitZ(Factor=addition_26)
move_11 = Move(Geometry=rotate_3d.Geometry, Motion=unit_z_21)  # -> Geometry, Transform
construct_domain_5 = ConstructDomain(DomainStart=list_item_19, DomainEnd=list_item_20)
sub_curve_5 = SubCurve(BaseCurve=move_10.Geometry, Domain=construct_domain_5)
construct_domain_6 = ConstructDomain(DomainStart=list_item_21, DomainEnd=list_item_22)
sub_curve_6 = SubCurve(BaseCurve=circle_4, Domain=construct_domain_6)
construct_domain_7 = ConstructDomain(DomainStart=list_item_23, DomainEnd=list_item_24)
sub_curve_7 = SubCurve(BaseCurve=move_10.Geometry, Domain=construct_domain_7)
construct_domain_8 = ConstructDomain(DomainStart=list_item_25, DomainEnd=list_item_26)
sub_curve_8 = SubCurve(BaseCurve=circle_4, Domain=construct_domain_8)
deconstruct_brep_8 = DeconstructBrep(Brep=move_11.Geometry)  # -> Faces, Edges, Vertices
list_item_28 = ListItem(List=deconstruct_brep_8.Faces, Index=1, Wrap=True)
cylinder_14 = Cylinder(Base=list_item_28, Radius=addition_13, Length=addition_14)
cap_holes_17 = CapHoles(Brep=cylinder_14)
list_item_29 = ListItem(List=deconstruct_brep_7.Faces, Index=0, Wrap=True)
area_4 = Area(Geometry=list_item_29)  # -> Area, Centroid
list_item_30 = ListItem(List=divide_curve_6.Points, Index="1", Wrap=True)
point_on_curve_9 = PointOnCurve(sub_curve_5, parameter=0)
point_on_curve_10 = PointOnCurve(sub_curve_5, parameter=1)
point_on_curve_11 = PointOnCurve(sub_curve_6, parameter=0)
point_on_curve_12 = PointOnCurve(sub_curve_6, parameter=1)
point_on_curve_13 = PointOnCurve(sub_curve_7, parameter=0)
point_on_curve_14 = PointOnCurve(sub_curve_7, parameter=1)
point_on_curve_15 = PointOnCurve(sub_curve_8, parameter=0)
point_on_curve_16 = PointOnCurve(sub_curve_8, parameter=1)
solid_difference_8 = SolidDifference(BrepsA=cap_holes_17, BrepsB=move_11.Geometry)
volume_6 = Volume(Geometry=cap_holes_16)  # -> Volume, Centroid
vector_2pt_3 = Vector2Pt(PointA=area_4.Centroid, PointB=list_item_30, Unitize=False)  # -> Vector, Length
plane_normal_2 = PlaneNormal(Origin=area_4.Centroid, ZAxis=vector_2pt_3.Vector)
brep_plane_2 = BrepPlane(Brep=cap_holes_16, Plane=plane_normal_2)  # -> Curves, Points
amplitude_2 = Amplitude(Vector=vector_2pt_3.Vector, Amplitude=addition_22)
line_5 = Line(StartPoint=point_on_curve_9, EndPoint=point_on_curve_11)
line_6 = Line(StartPoint=point_on_curve_12, EndPoint=point_on_curve_10)
line_7 = Line(StartPoint=point_on_curve_13, EndPoint=point_on_curve_15)
line_8 = Line(StartPoint=point_on_curve_16, EndPoint=point_on_curve_14)
lift_tolerance_boolean = Slider(0.01, range=0..0.01)
vector_2pt_4 = Vector2Pt(PointA=volume_6.Centroid, PointB=area_4.Centroid, Unitize=False)  # -> Vector, Length
extrude_15 = Extrude(Base=brep_plane_2.Curves, Direction=amplitude_2)
cap_holes_18 = CapHoles(Brep=extrude_15)
solid_union_9 = SolidUnion(Breps=flatten([cap_holes_18, cap_holes_16]))
move_12 = Move(Geometry=solid_union_9, Motion=vector_2pt_4.Vector)  # -> Geometry, Transform
unit_z_22 = UnitZ(Factor=lift_tolerance_boolean)
unit_z_23 = UnitZ(Factor=lift_tolerance_boolean)
join_curves_3 = JoinCurves(Curves=[sub_curve_5, line_5, sub_curve_6, line_6], Preserve=False)
boundary_surfaces_6 = BoundarySurfaces(Edges=join_curves_3)
unit_z_24 = UnitZ(Factor=lock_height_2)
# Lock Right
extrude_16 = Extrude(Base=boundary_surfaces_6, Direction=unit_z_24)
join_curves_4 = JoinCurves(Curves=[sub_curve_7, line_7, sub_curve_8, line_8], Preserve=False)
boundary_surfaces_7 = BoundarySurfaces(Edges=join_curves_4)
unit_z_25 = UnitZ(Factor=lock_height_2)
# Lock Left
extrude_17 = Extrude(Base=boundary_surfaces_7, Direction=unit_z_25)
# Piezo Holder Lock Part
solid_union_10 = SolidUnion(Breps=flatten([solid_difference_7, extrude_16, extrude_17]))
# Piezo Holder Cap Part
solid_difference_9 = SolidDifference(BrepsA=piezo_holder_cap_2, BrepsB=move_12.Geometry)
subtraction_7 = Subtraction(A=peizo_holder_lock_height_2, B=silicone_ring_thickness_2)
solid_difference_10 = SolidDifference(BrepsA=cap_holes_11, BrepsB=cap_holes_10)
subtraction_8 = Subtraction(Peizo_holder_height=subtraction_7, Lock_height=lock_height_2)
subtraction_9 = Subtraction(A=subtraction_8, Tube_holder_tolerance=tube_holder_tolerance_2)
subtraction_10 = Subtraction(Tube_holder_height=expression_5, B=subtraction_9)
addition_27 = Addition(Lock_height=lock_height_2, Tube_holder_tolerance=tube_holder_tolerance_2)
subtraction_11 = Subtraction(Piezo_holder_height=peizo_holder_lock_height_2, Silicone_ring_thickness=silicone_ring_thickness_2)
plane_offset_5 = PlaneOffset(BasePlane=PlaneXY(0, 0, 0), Tube_holder_height=expression_5)
plane_offset_6 = PlaneOffset(BasePlane=PlaneXY(0, 0, 0), Tube_holder_height=expression_5)
project_5 = Project(Geometry=boundary_surfaces_6, Plane=plane_offset_5)  # -> Geometry, Transform
project_6 = Project(Geometry=boundary_surfaces_7, Plane=plane_offset_6)  # -> Geometry, Transform
plane_offset_7 = PlaneOffset(BasePlane=PlaneXY(0, 0, 0), Offset=subtraction_10)
project_7 = Project(Geometry=boundary_surfaces_6, Plane=plane_offset_7)  # -> Geometry, Transform
plane_offset_8 = PlaneOffset(BasePlane=PlaneXY(0, 0, 0), Offset=subtraction_10)
project_8 = Project(Geometry=boundary_surfaces_7, Plane=plane_offset_8)  # -> Geometry, Transform
unit_z_26 = UnitZ(Factor="0")
unit_z_27 = UnitZ(Factor=subtraction_11)
reverse_15 = Reverse(Vector=unit_z_27)
extrude_18 = Extrude(Base=project_5.Geometry, Direction=reverse_15)
unit_z_28 = UnitZ(Factor=subtraction_11)
reverse_16 = Reverse(Vector=unit_z_28)
extrude_19 = Extrude(Base=project_6.Geometry, Direction=reverse_16)
unit_z_29 = UnitZ(Factor=addition_27)
reverse_17 = Reverse(Vector=unit_z_29)
extrude_20 = Extrude(Base=project_7.Geometry, Direction=reverse_17)
unit_z_30 = UnitZ(Factor=addition_27)
reverse_18 = Reverse(Vector=unit_z_30)
extrude_21 = Extrude(Base=project_8.Geometry, Direction=reverse_18)
colour_picker_3 = ColourPicker(PickedColour=RGBA(163, 148, 49, 82))
rotate_5 = Rotate(Geometry=extrude_20, Angle=expr("-0.25*pi", 1.570796327), Plane=PlaneXY(0, 0, 0))  # -> flatten(Geometry), Transform
rotate_6 = Rotate(Geometry=extrude_21, Angle=expr("-0.25*pi", 1.570796327), Plane=PlaneXY(0, 0, 0))  # -> flatten(Geometry), Transform
solid_union_11 = SolidUnion(Breps=flatten([extrude_18, rotate_5.Geometry]))
solid_union_12 = SolidUnion(Breps=flatten([extrude_19, rotate_6.Geometry]))
volume_7 = Volume(Geometry=solid_union_11)  # -> Volume, Centroid
scale_3 = Scale(Geometry=solid_union_11, Center=volume_7.Centroid, Factor=lock_scale_factor_2)  # -> Geometry, Transform
volume_8 = Volume(Geometry=solid_union_12)  # -> Volume, Centroid
scale_4 = Scale(Geometry=solid_union_12, Center=volume_8.Centroid, Factor=lock_scale_factor_2)  # -> Geometry, Transform
expression_9 = Expression(curved_tube_pattern=v_true__h_false_2, Expression="if (curved_tube_pattern, \"Curved Tubes\", \"Straight Tubes\")")
deconstruct_brep_9 = DeconstructBrep(Brep=scale_3.Geometry)  # -> Faces, Edges, Vertices
list_item_31 = ListItem(List=deconstruct_brep_9.Faces, Index=9, Wrap=True)
area_5 = Area(Geometry=list_item_31)  # -> Area, Centroid
deconstruct_3 = Deconstruct(Point=area_5.Centroid)  # -> XComponent, YComponent, ZComponent
cotton_constraint = Cylinder(Base=PlaneXY(0, 0, 0), Radius=addition_21, Length=deconstruct_3.ZComponent)
cylinder_15 = Cylinder(Base=PlaneXY(0, 0, 0), Radius=addition_15, Length=deconstruct_3.ZComponent)
cap_holes_19 = CapHoles(Brep=cylinder_15)
cap_holes_20 = CapHoles(Brep=cotton_constraint)
# Cotton Constraint
cotton_constraint_2 = SolidDifference(BrepsA=cap_holes_20, BrepsB=cap_holes_19)
solid_union_13 = SolidUnion(Breps=[cotton_constraint_2, solid_difference_10])
unit_x = UnitX(Factor=addition_15)
# Straight Tubes
move_13 = Move(Geometry=move_11.Geometry, Motion=unit_x)  # -> Geometry, Transform
deconstruct_brep_10 = DeconstructBrep(Brep=move_13.Geometry)  # -> Faces, Edges, Vertices
list_item_32 = ListItem(List=deconstruct_brep_10.Faces, Index=0, Wrap=True)
deconstruct_arc_3 = DeconstructArc(Arc=list_item_32)  # -> BasePlane, Radius, Angle
addition_28 = Addition(Radius=deconstruct_arc_3.Radius, Tol="0.2")
# Curved Tubes
area_6 = Area(Geometry=list_item_32)  # -> Area, Centroid
deconstruct_brep_11 = DeconstructBrep(Brep=solid_difference_8)  # -> Faces, Edges, Vertices
list_item_33 = ListItem(List=deconstruct_brep_11.Edges, Index=0, Wrap=True)
area_7 = Area(Geometry=list_item_33)  # -> Area, Centroid
distance = Distance(PointA=area_6.Centroid, PointB=area_7.Centroid)
vector_2pt_5 = Vector2Pt(PointA=area_6.Centroid, PointB=area_7.Centroid, Unitize=False)  # -> Vector, Length
customized_tube_length = Slider(140, range=15..300)
scent_number_2 = Slider(2, range=1..20)
minimum_radius_of_curvature = Slider(36, range=0..100)
radius_of_curvature = Slider(36, range=-100..100)
permutation_pattern_2 = ValueList({"Circle Pattern", "Line Pattern"}, selected="Circle Pattern")
interval_4 = Slider(2, range=0..50)
od_pcb_integration_2 = BooleanToggle(True)
tube_holder_number = Slider(6, range=1..8)
file_path_3 = FilePath("C:\Users\richluo\Desktop\cuizhitong\OneDrive - zju.edu.cn\OlfacKit\GhPython\horizontal_permutation.py")
file_path_4 = FilePath("C:\Users\richluo\Desktop\cuizhitong\OneDrive - zju.edu.cn\OlfacKit\GhPython\horizontal_multi_scent_display.py")
readfile_3 = ReadFile(Path=file_path_3)  # -> out, Data; same code as readfile
readfile_4 = ReadFile(Path=file_path_4)  # -> out, Data; same code as readfile
colour_picker_4 = ColourPicker(PickedColour=RGBA(26, 134, 207, 120))
colour_picker_5 = ColourPicker(PickedColour=RGBA(26, 136, 201, 120))
file_path_5 = FilePath("C:\Users\richluo\Desktop\cuizhitong\OneDrive - zju.edu.cn\OlfacKit\GhPython\adjust_tube_number.py")
readfile_5 = ReadFile(Path=file_path_5)  # -> out, Data; same code as readfile
ghpython_script_8 = GhPythonScript(Code=readfile_5.Data, Scent_number=value_listener_2.Scent_number, Tube_holder_number=value_listener_7.Tube_holder_number)  # -> Out, Tube_holder_number
polar_array_2 = PolarArray(Geometry=move_11.Geometry, Plane=PlaneXY(0, 0, 0), Count=ghpython_script_8.Tube_holder_number, Angle=6.283185307)  # -> flatten(Geometry), Transform
polar_array_3 = PolarArray(Geometry=solid_difference_8, Plane=PlaneXY(0, 0, 0), Count=ghpython_script_8.Tube_holder_number, Angle=6.283185307)  # -> Geometry, Transform
hole_polar_array = Move(Geometry=polar_array_2.Geometry, Motion=unit_z_22)  # -> Geometry, Transform
tube_holder_polar_array = Move(Geometry=polar_array_3.Geometry, Motion=unit_z_23)  # -> Geometry, Transform
solid_difference_11 = SolidDifference(BrepsA=solid_union_13, BrepsB=flatten(hole_polar_array.Geometry))
solid_union_14 = SolidUnion(Breps=flatten([solid_difference_11, bottom_part, tube_holder_polar_array.Geometry]))

# ----
# Piezo Holder
# Tube Holder
solid_union_15 = SolidUnion(Breps=flatten([solid_difference_9, solid_union_10]))
solid_difference_12 = SolidDifference(BrepsA=solid_union_14, BrepsB=flatten([scale_3.Geometry, scale_4.Geometry]))

move_14 = Move(Geometry=solid_union_15, Motion=unit_z_26)  # -> Geometry, Transform
custom_preview = CustomPreview(Geometry=move_14.Geometry, Material=colour_picker_3)
unit_z_31 = UnitZ(Factor=expression_3)
unit_x_2 = UnitX(Factor=distance)
geometry_19 = Geometry(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)
geometry_20 = Geometry(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)
geometry_21 = Geometry(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)
deconstruct_brep_12 = DeconstructBrep(Brep=cap_holes_12)  # -> Faces, Edges, Vertices
list_item_34 = ListItem(List=deconstruct_brep_12.Faces, Index="0", Wrap=True)
multiplication = Multiplication(A=addition_12, B="2")
multiplication_2 = Multiplication(A=multiplication, B=expression_8)
addition_29 = Addition(Horizontal_tube_radius=multiplication_2, Pedestal_height=expression_3)
# PCB Case Guide on Side
# PCB Case Guide on Back
ghpython_script_9 = GhPythonScript(
    pcb_guide_position=value_listener_13.Pcb_guide_position,
    pcb_case_no_guide=geometry_19,
    pcb_case_side_guide=geometry_20,
    pcb_case_back_guide=geometry_21)  # -> out, pcb_case
# ---------- ghpython_script_9: Python ----------
__author__ = "richluo"
__version__ = "2022.03.31"

import rhinoscriptsyntax as rs

if pcb_guide_position == 'back':
    pcb_case = pcb_case_back_guide
elif pcb_guide_position == 'side':
    pcb_case = pcb_case_side_guide
elif pcb_guide_position == 'no_guide':
    pcb_case = pcb_case_no_guide
# ---------- end ghpython_script_9 ----------
magnet_radius = Slider(4.9, range=0..10)
magnet_height = Slider(2, range=0..100)
sphere = Sphere(Base=PlaneXY(0, 0, 0), Radius=addition_29)
split_brep = SplitBrep(Brep=sphere, Cutter=list_item_34)
explode_tree_2 = ExplodeTree(Data=graft(split_brep))  # -> _0000, _0001
cap_holes_21 = CapHoles(Brep=flatten(explode_tree_2._0000))
reverse_19 = Reverse(Vector=unit_x_2)
unit_z_32 = UnitZ(Factor=expression_3)
solid_union_16 = SolidUnion()
magnet_radius_2 = Slider(5, range=0..10)
magnet_height_2 = Slider(2, range=0..100)
# PCB Case No Guide
bounding_box = BoundingBox(Content=ghpython_script_9.pcb_case, Plane=PlaneXY(0, 0, 0))  # -> Box, Box_2
unit_z_33 = UnitZ(Factor=expr("x", expression_3))
point = Point(Point(179.8711048, 0, 27.23564967))
colour_picker_6 = ColourPicker(PickedColour=RGBA(36, 171, 155, 83))
deconstruct_brep_13 = DeconstructBrep(Brep=bounding_box.Box)  # -> Faces, Edges, Vertices
# PCB Case without Magnets
geometry_22 = Geometry(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)
ghpython_script_10 = GhPythonScript(
    Code=readfile_3.Data,
    Scent_number=value_listener_2.Scent_number,
    Tube_holder_number=value_listener_7.Tube_holder_number,
    Tube_pattern_type=expression_9,
    Customized_tube_length=value_listener_4.Values,
    Minimum_radius_of_curvature=minimum_radius_of_curvature,
    Radius_of_curvature=radius_of_curvature,
    Arc_start_point=area_7.Centroid,
    Arc_direction=vector_2pt_5.Vector,
    Inner_tube_length=distance,
    Tube_holder=solid_difference_12,
    Permutation_pattern=value_listener_5.Permutation_pattern,
    Interval=interval_4,
    Limiter=cap_holes_21,
    Limiter_radius=addition_29,
    Pedestal_height=expression_3,
    OD_PCB_integration=list_item_14,
    Magnet_radius=magnet_radius,
    Pcb_case_without_magnets=geometry_22)  # -> Out, Base_circle, Pivot_center, Line_pattern_vec_list, Straight_tube_length, Curved_tube_length, Required_tube_length, Arc_end_point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
addition_30 = Addition(Inner_tube_length=distance, Customized_tube_length=ghpython_script_10.Straight_tube_length)
arc_sed = ArcSED(Start=area_7.Centroid, End=ghpython_script_10.Arc_end_point, Direction=vector_2pt_5.Vector)  # -> Arc, Plane, Radius
length = Length(Curve=arc_sed.Arc)
cylinder_16 = Cylinder(Base=list_item_32, Radius=addition_28, Length=addition_30)
panel_29 = Panel(length)
cap_holes_22 = CapHoles(Brep=cylinder_16)
polar_array_4 = PolarArray(Geometry=cap_holes_22, Plane=PlaneXY(0, 0, 0), Count=ghpython_script_8.Tube_holder_number, Angle=6.283185307)  # -> Geometry, Transform
pipe = Pipe(Curve=arc_sed.Arc, Radius=addition_28, Caps=Toggle(True))
polar_array_5 = PolarArray(Geometry=pipe, Plane=PlaneXY(0, 0, 0), Count=ghpython_script_8.Tube_holder_number, Angle=6.283185307)  # -> Geometry, Transform
# Straight Tubes
custom_preview_2 = CustomPreview(Geometry=polar_array_4.Geometry, Material=colour_picker_4)
# Curved Tubes
custom_preview_3 = CustomPreview(Geometry=polar_array_5.Geometry, Material=colour_picker_5)
extrude_22 = Extrude(Base=ghpython_script_10.Pedestal_srf_curved_tube, Direction=unit_z_31)
deconstruct_brep_14 = DeconstructBrep(Brep=extrude_22)  # -> Faces, Edges, Vertices
list_item_35 = ListItem(List=deconstruct_brep_14.Faces, Index="3", Wrap=True)
geometry_23 = Geometry(ghpython_script_10.Splited_srf_list)
panel_30 = Panel(ghpython_script_10.Out)
extrude_23 = Extrude(Base=list_item_35, Direction=reverse_19)
solid_union_17 = SolidUnion(Breps=flatten([extrude_22, extrude_23]))
# Curved Pedestal
polar_array_6 = PolarArray(Geometry=solid_union_17, Plane=PlaneXY(0, 0, 0), Count=ghpython_script_8.Tube_holder_number, Angle=6.283185307)  # -> Geometry, Transform
surface = Surface(ghpython_script_10.Pedestal_srf_straight_tube)
extrude_24 = Extrude(Base=surface, Direction=unit_z_32)
polar_array_7 = PolarArray(Geometry=extrude_24, Plane=PlaneXY(0, 0, 0), Count=ghpython_script_8.Tube_holder_number, Angle=6.283185307)  # -> Geometry, Transform
# Generated Limiters
polar_array_8 = PolarArray(
    Geometry=ghpython_script_10.Gen_limiters,
    Plane=PlaneXY(0, 0, 0),
    Count=ghpython_script_8.Tube_holder_number,
    Angle=6.283185307)  # -> Geometry, Transform
move_15 = Move(Geometry=polar_array_8.Geometry, Motion=unit_z_33)  # -> Geometry, Transform
# Straight Pedestal
custom_preview_4 = CustomPreview(Geometry=flatten(polar_array_7.Geometry), Material=colour_picker_6)
# inner pedestal without magnets
geometry_24 = Geometry(ghpython_script_10.Inner_pedestal)
ghpython_script_11 = GhPythonScript(
    limiters=move_15.Geometry,
    permutation_pattern=value_listener_5.Permutation_pattern,
    tube_pattern_type=expression_9,
    straight_tubes=polar_array_4.Geometry,
    curved_tubes=polar_array_5.Geometry)  # -> out, flatten(final_limiters)
# ---------- ghpython_script_11: Python ----------
__author__ = "richluo"
__version__ = "2022.03.06"

import rhinoscriptsyntax as rs

if permutation_pattern == "Line Pattern":
    # line pattern can only use straight tubes
    tube_pattern_type = 'Straight Tubes'

if tube_pattern_type == 'Straight Tubes':
    final_limiters = rs.BooleanDifference(limiters, straight_tubes, delete_input=False)
elif tube_pattern_type == 'Curved Tubes':
    final_limiters = rs.BooleanDifference(limiters, curved_tubes, delete_input=False)
# ---------- end ghpython_script_11 ----------
merge_3 = Merge(
    Data1=move_14.Geometry,
    Data2=solid_difference_12,
    Data3=flatten(polar_array_4.Geometry),
    Data4=flatten(polar_array_7.Geometry),
    Data5=ghpython_script_11.final_limiters)
merge_4 = Merge(
    Data1=move_14.Geometry,
    Data2=solid_difference_12,
    Data3=flatten(polar_array_5.Geometry),
    Data4=flatten(polar_array_6.Geometry),
    Data5=ghpython_script_11.final_limiters)
# Mutiple Scent Display
ghpython_script_12 = GhPythonScript(
    Code=readfile_4.Data,
    Scent_number=value_listener_2.Scent_number,
    Tube_holder_number=value_listener_7.Tube_holder_number,
    Permutation_pattern=value_listener_5.Permutation_pattern,
    Tube_pattern_type=expression_9,
    Pivot_center=ghpython_script_10.Pivot_center,
    Line_pattern_vec_list=ghpython_script_10.Line_pattern_vec_list,
    Objects_straight=merge_3,
    Objects_curved=merge_4)  # -> Out, Piezo_holder_list, Tube_holder_list, Tube_list, Pedestal_list, Limiters_list
panel_31 = Panel(ghpython_script_12.Out)
geometry_25 = Geometry(ghpython_script_12.Piezo_holder_list)
geometry_26 = Geometry(ghpython_script_12.Tube_holder_list)
geometry_27 = Geometry(ghpython_script_12.Tube_list)
geometry_28 = Geometry(ghpython_script_12.Pedestal_list)
geometry_29 = Geometry(ghpython_script_12.Limiters_list)
geometry_30 = Geometry(ghpython_script_10.Pcb_case_preview)
list_item_36 = ListItem(List=deconstruct_brep_13.Faces, Index="5", Wrap=True)
solid_union_18 = SolidUnion(Breps=flatten([ghpython_script_11.final_limiters, polar_array_6.Geometry]))
unit_x_3 = UnitX(Factor=expr("x*2+4", magnet_radius))
unit_x_4 = UnitX(Factor=expr("x*2+4", magnet_radius_2))
area_8 = Area(Geometry=list_item_36)  # -> Area, Centroid
vector_2pt_6 = Vector2Pt(PointA=area_8.Centroid, PointB=point, Unitize=False)  # -> Vector, Length
move_16 = Move(Geometry=area_8.Centroid, Motion=vector_2pt_6.Vector)  # -> Geometry, Transform
deconstruct_4 = Deconstruct(Point=move_16.Geometry)  # -> XComponent, YComponent, ZComponent
subtraction_12 = Subtraction(A=deconstruct_4.XComponent, B=magnet_radius_2)
subtraction_13 = Subtraction(A=deconstruct_4.ZComponent, B=magnet_height_2)
subtraction_14 = Subtraction(A=subtraction_12, B="2")
construct_point = ConstructPoint(XCoordinate=subtraction_14, YCoordinate=deconstruct_4.YComponent, ZCoordinate=subtraction_13)
cylinder_17 = Cylinder(Base=construct_point, Radius=magnet_radius_2, Length=magnet_height_2)
move_17 = Move(Geometry=ghpython_script_9.pcb_case, Motion=vector_2pt_6.Vector)  # -> Geometry, Transform
magnet = CapHoles(Brep=cylinder_17)
move_18 = Move(Geometry=magnet, Motion=unit_x_4)  # -> Geometry, Transform
colour_picker_7 = ColourPicker(PickedColour=RGBA(36, 171, 155, 83))
# Curved Pedestal & Limiters
custom_preview_5 = CustomPreview(Geometry=flatten([polar_array_6.Geometry, ghpython_script_11.final_limiters]), Material=colour_picker_7)
unit_z_34 = UnitZ(Factor=magnet_height)
solid_difference_13 = SolidDifference(BrepsA=move_17.Geometry, BrepsB=[magnet, move_18.Geometry])
bounding_box_2 = BoundingBox(Content=solid_difference_13, Plane=PlaneXY(0, 0, 0))  # -> Box, Box_2
deconstruct_brep_15 = DeconstructBrep(Brep=bounding_box_2.Box)  # -> Faces, Edges, Vertices
list_item_37 = ListItem(List=deconstruct_brep_15.Faces, Index="5", Wrap=True)
area_9 = Area(Geometry=list_item_37)  # -> Area, Centroid
vector_2pt_7 = Vector2Pt(PointA=area_9.Centroid, PointB=ghpython_script_10.Magnets_placement_point, Unitize=False)  # -> Vector, Length
move_19 = Move(Geometry=area_9.Centroid, Motion=vector_2pt_7.Vector)  # -> Geometry, Transform
deconstruct_5 = Deconstruct(Point=move_19.Geometry)  # -> XComponent, YComponent, ZComponent
subtraction_15 = Subtraction(A=deconstruct_5.XComponent, B=magnet_radius)
subtraction_16 = Subtraction(A=deconstruct_5.ZComponent, B=magnet_height)
subtraction_17 = Subtraction(A=subtraction_15, B="2")
construct_point_2 = ConstructPoint(XCoordinate=subtraction_17, YCoordinate=deconstruct_5.YComponent, ZCoordinate=subtraction_16)
cylinder_18 = Cylinder(Base=construct_point_2, Radius=magnet_radius, Length=magnet_height)
move_20 = Move(Geometry=solid_difference_13, Motion=vector_2pt_7.Vector)  # -> Geometry, Transform
magnet_2 = CapHoles(Brep=cylinder_18)
move_21 = Move(Geometry=magnet_2, Motion=unit_x_3)  # -> Geometry, Transform
rotate_7 = Rotate(
    Geometry=move_20.Geometry,
    Angle=ghpython_script_10.Magnets_rotation_angle,
    Plane=ghpython_script_10.Magnets_placement_point)  # -> Geometry, Transform
move_22 = Move(Geometry=[magnet_2, move_21.Geometry], Motion=unit_z_34)  # -> Geometry, Transform
# Magnets on OD
rotate_8 = Rotate(
    Geometry=move_22.Geometry,
    Angle=ghpython_script_10.Magnets_rotation_angle,
    Plane=ghpython_script_10.Magnets_placement_point)  # -> Geometry, Transform
solid_difference_14 = SolidDifference(BrepsB=rotate_8.Geometry)
# inner pedestal with magnets
geometry_31 = Geometry(solid_difference_14)
explode_tree_3 = ExplodeTree(Data=graft(value_listener_12.Values))  # -> Branch0, Branch1, Branch2
colour_picker_8 = ColourPicker(PickedColour=RGBA(70, 74, 79, 107))
# PCB Case with Magnets
custom_preview_6 = CustomPreview(Geometry=flatten(rotate_7.Geometry), Material=colour_picker_8)

# ----
# Hook
targetthickness_2 = Slider(6, range=3..30)
ball_or_not_6 = BooleanToggle(False)
hook_2 = Hook(A=targetthickness_2, ball_or_not=value_listener_10.Angle_adjustable)
geometry_32 = Geometry(hook_2)

# ----
# Cylinder Clip
targetradius_2 = Slider(25, range=5..100)
ball_or_not_7 = BooleanToggle(True)
clip_round_2 = Clip_Round(A=targetradius_2, ball_or_not=value_listener_10.Angle_adjustable)
geometry_33 = Geometry(clip_round_2)

# ----
# Ring
interval_5 = Slider(6, range=0..50)
ringy_2 = Slider(26, range=5..30)
single_double_3 = BooleanToggle(True)
ringx_2 = Slider(10, range=5..30)
corner_2 = Slider(6, range=0..20)
ring_ear_2 = RingEar(
    x_coordinate=interval_5,
    x_size=ringx_2,
    y_size=ringy_2,
    radius_2=corner_2,
    A=ringx_2,
    radius=corner_2,
    value=single_double_3,
    A_2=ringy_2)
geometry_34 = Geometry(ring_ear_2)

# ----
# Cubic Clip
ball_or_not_8 = BooleanToggle(False)
targetdepth_2 = Slider(30, range=20..100)
targetwidth_2 = Slider(35, range=20..100)
clip_square_2 = Clip_Square(A=targetdepth_2, y_size=targetwidth_2, A_2=targetwidth_2, ball_or_not=value_listener_10.Angle_adjustable)
geometry_35 = Geometry(clip_square_2)

# ----
# Elastic
single_double_4 = BooleanToggle(True)
interval_6 = Slider(8, range=0..50)
t_size_2 = Slider(10, range=8..12)
t_t_2 = T_T(x_coordinate=interval_6, x_size=t_size_2, A_2=t_size_2, A=t_size_2, value=single_double_4, y_size=t_size_2)
geometry_36 = Geometry(t_t_2)

# ----
# Stand
basethickness_2 = Slider(5, range=5..50)
standheight_2 = Slider(120, range=10..200)
baseradius_2 = Slider(35, range=0..100)
standradius_2 = Panel("5")
stand_2 = Stand(
    radius=explode_tree_3.Branch0,
    length=explode_tree_3.Branch1,
    factor=explode_tree_3.Branch1,
    radius_2=standradius_2,
    length_2=explode_tree_3.Branch2,
    A=explode_tree_3.Branch2,
    B=explode_tree_3.Branch1)
geometry_37 = Geometry(stand_2)

# ----
# Sticker
ball_or_not_9 = BooleanToggle(True)
cluster_3 = Cluster_3(ball_or_not=value_listener_10.Angle_adjustable)
geometry_38 = Geometry(cluster_3)

# ----
# Magnet
ball_or_not_10 = BooleanToggle(True)
cluster_4 = Cluster_2(ball_or_not=value_listener_10.Angle_adjustable)
geometry_39 = Geometry(cluster_4)

angle_adjustable_3 = BooleanToggle(True)
pcb_attachment_methods_3 = ValueList({"No_Attachment": "no_attachment", "Cylinder Clip": "cylinder_clip", "Cubic Clip": "cubic_clip", "Hair Clip Connector": "hair_clip_connector", "Hook": "hook", "Ring": "ring", "Elastic": "elastic", "Stand": "stand", "Magnet": "magnet", "Sticker": "sticker"}, selected="No_Attachment")
od_attachment_methods_3 = ValueList({"No_Attachment": "no_attachment", "Cylinder Clip": "cylinder_clip", "Cubic Clip": "cubic_clip", "Hair Clip Connector": "hair_clip_connector", "Hook": "hook", "Ring": "ring", "Elastic": "elastic", "Stand": "stand", "Magnet": "magnet", "Sticker": "sticker"}, selected="Cubic Clip")

# ----
# Hair Clip Connector
geometry_40 = Geometry(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)

file_path_6 = FilePath("C:\Users\richluo\Desktop\cuizhitong\OneDrive - zju.edu.cn\OlfacKit\GhPython\horizontal_attachments.py")
readfile_6 = ReadFile(Path=file_path_6)  # -> out, Data; same code as readfile
ghpython_script_13 = GhPythonScript(
    Code=readfile_6.Data,
    OD_PCB_integration=list_item_14,
    Angle_adjustable=value_listener_10.Angle_adjustable,
    PCB_attachment_methods=value_listener_11.PCB_attachment_methods,
    OD_attachment_methods=value_listener_14.OD_attachment_methods,
    Cylinder_clip=geometry_33,
    Cubic_clip=geometry_35,
    Hair_clip_connector=geometry_40,
    Hook=geometry_32,
    Ring=geometry_34,
    Elastic=geometry_36,
    Stand=geometry_37,
    Magnet=geometry_39,
    Sticker=geometry_38)  # -> Out, Pcb_gen_attchment, Od_gen_attchment
panel_32 = Panel(ghpython_script_13.Out)
geometry_41 = Geometry(ghpython_script_13.Pcb_gen_attchment)
geometry_42 = Geometry(ghpython_script_13.Od_gen_attchment)

width = Slider(600, range=0..1000)
height = Slider(720, range=0..1500)
# Human UI Interface
boolean_toggle = BooleanToggle(True)
launch_window = LaunchWindow(Show=boolean_toggle, Name="OlfacKit User Interface", Width=width, Height=height, ChildStatus=0, EnableHorizScroll=False)
set_window_properties = SetWindowProperties(Window=launch_window, Theme="1", AccentColor="purple", ShowTitleBar=True, ScaleFactor=Slider(1, range=1..2))
step1_header = Panel("Step 1: Scent Container Design")
create_expander = CreateExpander(UIElements=merge_2, Header=step1_header, Open=True)
step2_header = Panel("Step 2: Attachment Design")
step2_header_2 = Panel("Step 3: Generate Fabrication-Ready Objects")
create_expander_2 = CreateExpander(UIElements=create_true_only_button, Header=step2_header_2, Open=True)

# ----
# Mesh Processing
# 3D Model to Mesh
move_along_z_axis = Slider(0, range=-80..80)
rotate_along_y_axis = Slider(0, range=-45..45)
move_along_x_axis = Slider(0, range=-80..80)
move_along_y_axis = Slider(0, range=-80..80)
rotate_along_x_axis = Slider(0, range=-45..45)
rotate_along_z_axis = Slider(0, range=-45..45)
_1_scale_your_model_to_your_desired_dime = Slider(1, range=0..10)  # "1. Scale Your Model to your Desired Dimension"
position = Panel("""top
bottom
left
right
front
back
top-left-front
top-left-back
top-right-front
top-right-back
bottom-left-front
bottom-left-back
bottom-right-front
bottom-right-back""")
create_label_7 = CreateLabel(LabelText="Integrate the Scent Container to a 3D Model", LabelSize="15", Justification=0)
create_file_picker = CreateFilePicker(ButtonLabelText="IMPORT", DialogType=0, MustExist=Toggle(False), Filter="All Files|*.*")
create_slider_2 = CreateSlider(
    Slider=_1_scale_your_model_to_your_desired_dime,
    SnapValue="0.05",
    ShowBounds=False,
    ShowTicks=False,
    ShowTooltip=False,
    ShowValLabel=True,
    showLabel=True)
create_label_8 = CreateLabel(LabelText=" 2. Select Where to Put the Scent Container", LabelSize="12", Justification=0)
create_list_box = CreateListBox(ListItems=position, SelectedIndex=0, Height="120")
create_label_9 = CreateLabel(LabelText=" 3. Fine-tune the Position of the Scent Container", LabelSize="12", Justification=0)
create_slider_3 = CreateSlider(Slider=move_along_x_axis, ShowBounds=False, ShowTicks=False, ShowTooltip=False, ShowValLabel=True, showLabel=True)
create_slider_4 = CreateSlider(Slider=move_along_y_axis, ShowBounds=False, ShowTicks=False, ShowTooltip=False, ShowValLabel=True, showLabel=True)
create_slider_5 = CreateSlider(Slider=move_along_z_axis, ShowBounds=False, ShowTicks=False, ShowTooltip=False, ShowValLabel=True, showLabel=True)
create_slider_6 = CreateSlider(Slider=rotate_along_x_axis, ShowBounds=False, ShowTicks=False, ShowTooltip=False, ShowValLabel=True, showLabel=True)
create_slider_7 = CreateSlider(Slider=rotate_along_y_axis, ShowBounds=False, ShowTicks=False, ShowTooltip=False, ShowValLabel=True, showLabel=True)
create_slider_8 = CreateSlider(Slider=rotate_along_z_axis, ShowBounds=False, ShowTicks=False, ShowTooltip=False, ShowValLabel=True, showLabel=True)
value_listener_15 = ValueListener(Elements=create_slider_2, SomeProperty=True)  # -> Scale_factor, Indices
value_listener_16 = ValueListener(Elements=create_file_picker, SomeProperty=True)  # -> Values, Indices
import_3dm = Import3DM(File=value_listener_16.Values, Layer="*", Name="*")
value_listener_17 = ValueListener(Elements=create_slider_3, SomeProperty=True)  # -> Values, Indices
value_listener_18 = ValueListener(Elements=create_slider_4, SomeProperty=True)  # -> Values, Indices
value_listener_19 = ValueListener(Elements=create_slider_5, SomeProperty=True)  # -> Values, Indices
value_listener_20 = ValueListener(Elements=create_slider_6, SomeProperty=True)  # -> Values, Indices
value_listener_21 = ValueListener(Elements=create_slider_7, SomeProperty=True)  # -> Values, Indices
value_listener_22 = ValueListener(Elements=create_slider_8, SomeProperty=True)  # -> Values, Indices
value_listener_23 = ValueListener(Elements=create_list_box, SomeProperty=True)  # -> Values, Indices
ghpython_script_14 = GhPythonScript(filepath=value_listener_16.Values)  # -> out, show
# ---------- ghpython_script_14: Python ----------
__author__ = "richluo"
__version__ = "2022.08.20"

import rhinoscriptsyntax as rs


if filepath != '':
    show = True
else:
    show = False
print(show)
# ---------- end ghpython_script_14 ----------
hide_show_element = HideShowElement(
    ElementToHideShow=[create_slider_2, create_label_8, create_list_box, create_label_9, create_slider_3, create_slider_4, create_slider_5, create_slider_6, create_slider_7, create_slider_8],
    Show=ghpython_script_14.show,
    Collapse=True,
    Disable=False)
merge_5 = Merge(
    Data1=create_label_7,
    Data2=create_file_picker,
    Data3=create_slider_2,
    Data4=create_label_8,
    Data5=create_list_box,
    Data6=create_label_9,
    Data7=create_slider_3,
    Data8=create_slider_4,
    Data9=create_slider_5,
    Data10=create_slider_6,
    Data11=create_slider_7,
    Data12=create_slider_8)
mesh = Mesh(import_3dm)
volume_9 = Volume(Geometry=mesh)  # -> Volume, Centroid

merge_6 = Merge(
    Data1=flatten(create_wrappanel_5),
    Data3=flatten(create_pulldown_menu_3),
    Data5=flatten(create_pulldown_menu_4),
    Data6=flatten(create_pulldown_menu_5),
    Data7=flatten(create_text_box_2),
    Data8=flatten(merge_5),
    Data9=flatten(create_checkbox))

create_expander_3 = CreateExpander(UIElements=merge_6, Header=step2_header, Open=True)
merge_7 = Merge(Data1=create_expander, Data2=create_expander_3, Data3=create_expander_2)
add_elements = AddElements(Window=launch_window, Elements=flatten(merge_7), DoVLChecking=True)  # -> AddedElements, ElementNames

file_path_7 = FilePath("C:\Users\richluo\Desktop\cuizhitong\OneDrive - zju.edu.cn\OlfacKit\GhPython\human_ui.py")
readfile_7 = ReadFile(Path=file_path_7)  # -> out, Data; same code as readfile
ghpython_script_15 = GhPythonScript(
    Code=readfile_7.Data,
    Is_vertical_od=flatten(v_true__h_false),
    Scent_number=value_listener_2.Scent_number,
    Vertical_piezo_holder=flatten(move_7.Geometry),
    Vertical_tube_holder=flatten(geometry_14),
    Vertical_pedestal_and_pcb_case=flatten(solid_union_8),
    Vertical_pcb_attchment=flatten(geometry_17),
    Vertical_od_attchment=flatten(geometry_18),
    Hor_piezo_holder_list=flatten(geometry_25),
    Hor_tube_holder_list=flatten(geometry_26),
    Hor_tube_list=flatten(geometry_27),
    Hor_pedestal_list=flatten(geometry_28),
    Hor_limiters_list=flatten(geometry_29),
    Magnets_on_od=flatten(rotate_8.Geometry),
    Pcb_case_with_magnets=flatten(rotate_7.Geometry),
    Pcb_case_without_magnets=flatten(geometry_30),
    Hor_pcb_attchment=flatten(geometry_41),
    Hor_od_attchment=flatten(geometry_42),
    Hor_multiscent_pedestal=geometry_24)  # -> Out, Vertical_piezo_holder, Vertical_tube_holder, Vertical_pedestal_and_pcb_case, Vertical_pcb_attchment, Vertical_od_attchment, Hor_piezo_holder_list, Hor_tube_holder_list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
geometry_43 = Geometry(ghpython_script_15.Magnets_on_od)
colour_picker_9 = ColourPicker(PickedColour=RGBA(163, 163, 158, 120))
colour_picker_10 = ColourPicker(PickedColour=RGBA(163, 163, 158, 120))
colour_picker_11 = ColourPicker(PickedColour=RGBA(222, 202, 75, 138))
colour_picker_12 = ColourPicker(PickedColour=RGBA(202, 73, 82, 147))
unit_z_35 = UnitZ(Factor="-120")
move_23 = Move(Geometry=ghpython_script_15.Hor_pcb_attchment, Motion=unit_z_35)  # -> Geometry, Transform
colour_picker_13 = ColourPicker(PickedColour=RGBA(65, 168, 207, 120))
custom_preview_7 = CustomPreview(Geometry=ghpython_script_15.Hor_tube_list, Material=colour_picker_13)
unit_x_5 = UnitX(Factor="50")
move_24 = Move(Geometry=move_23.Geometry, Motion=unit_x_5)  # -> Geometry, Transform
ghpython_script_16 = GhPythonScript(att=value_listener_11.PCB_attachment_methods, geo1=move_24.Geometry)  # -> out, a
# ---------- ghpython_script_16: Python ----------
__author__ = "richluo"
__version__ = "2022.04.11"

import rhinoscriptsyntax as rs

if att == 'stand':
    a = geo1
# ---------- end ghpython_script_16 ----------
custom_preview_8 = CustomPreview(
    Geometry=[ghpython_script_15.Hor_od_attchment, ghpython_script_15.Vertical_od_attchment, ghpython_script_16.a, ghpython_script_15.Vertical_pcb_attchment],
    Material=colour_picker_12)

explode_tree_4 = ExplodeTree(Data=graft(ghpython_script_15.Vertical_pedestal_and_pcb_case))  # -> _00000, Branch1
merge_8 = Merge(
    Data1=flatten(ghpython_script_15.Vertical_piezo_holder),
    Data2=flatten(ghpython_script_15.Vertical_tube_holder),
    Data3=flatten(explode_tree_4._00000))  # -> flatten(Result)
bounding_box_3 = BoundingBox(Content=merge_8, Plane=PlaneXY(0, 0, 0), UnionBox=True)  # -> Box, Box_2
mesh_2 = Mesh(bounding_box_3.Box)
bounding_box_4 = BoundingBox(Content=flatten(mesh_2), Plane=PlaneXY(0, 0, 0), UnionBox=False)  # -> Box, Box_2
volume_10 = Volume(Geometry=bounding_box_4.Box)  # -> Volume, Centroid
deconstruct_brep_16 = DeconstructBrep(Brep=bounding_box_4.Box)  # -> Faces, Edges, Vertices
vector_2pt_8 = Vector2Pt(PointA=volume_9.Centroid, PointB=volume_10.Centroid, Unitize=False)  # -> Vector, Length
move_25 = Move(Geometry=mesh, Motion=vector_2pt_8.Vector)  # -> Geometry, Transform
volume_11 = Volume(Geometry=move_25.Geometry)  # -> Volume, Centroid
scale_5 = Scale(Geometry=move_25.Geometry, Center=volume_11.Centroid, Scale_factor=value_listener_15.Scale_factor)  # -> Geometry, Transform
list_item_38 = ListItem(List=deconstruct_brep_16.Faces, Index="5", Wrap=True)
ghpython_script_17 = GhPythonScript(
    container=mesh_2,
    holder_top=list_item_38,
    angle=value_listener_23.Values,
    objs=merge_8,
    M_X=value_listener_17.Values,
    M_Y=value_listener_18.Values,
    M_Z=value_listener_19.Values,
    R_X=value_listener_20.Values,
    R_Y=value_listener_21.Values,
    R_Z=value_listener_22.Values,
    model=scale_5.Geometry)  # -> model_to_box, holder_top, final_objs, model_adsorbed; inputs objs: list
# ---------- ghpython_script_17: Python ----------
import rhinoscriptsyntax as rs

print(angle)
#Select the orientation of the holder
if angle  == 'front':
    angle_YZ = 90
    angle_XY = 0
    
elif angle  == 'bottom':
    angle_YZ = 180
    angle_XY = 0
    
elif angle  == 'back':
    angle_YZ = -90
    angle_XY = 0
    
elif angle  == 'right':
    angle_YZ = 90
    angle_XY = 90
    
elif angle  == 'left':
    angle_YZ = 90
    angle_XY = -90
    
elif angle  == 'top-right-front':
    angle_YZ = 45
    angle_XY = 45
    
elif angle  == 'top-right-back':
    angle_YZ = 45
    angle_XY = 135
    
elif angle  == 'top-left-back':
    angle_YZ = 45
    angle_XY = 225
    
elif angle  == 'top-left-front':
    angle_YZ = 45
    angle_XY = 315

elif angle  == 'bottom-right-front':
    angle_YZ = 135
    angle_XY = 45
    
elif angle  == 'bottom-right-back':
    angle_YZ = 135
    angle_XY = 135

elif angle  == 'bottom-left-back':
    angle_YZ = 135
    angle_XY = 225
    
elif angle  == 'bottom-left-front':
    angle_YZ = 135
    angle_XY = 315

elif angle == 'top':
    angle_YZ = 0
    angle_XY = 0

print(container)
print(holder_top)

# rotate the union bounding box
center = rs.MeshVolumeCentroid(container)
model_1 = rs.RotateObject(container, center, angle_YZ, axis=rs.CreateVector(1,0,0), copy=False)
model_2 = rs.RotateObject(model_1, center, angle_XY, axis=rs.CreateVector(0,0,1), copy=False)
output_model = model_2

holder_top_1 = rs.RotateObject(holder_top, center, angle_YZ, axis=rs.CreateVector(1,0,0), copy=False)
holder_top_2 = rs.RotateObject(holder_top_1, center, angle_XY, axis=rs.CreateVector(0,0,1), copy=False)
final_holder_top = holder_top_2

# rotate merged objects
objs_1 = rs.RotateObjects(objs, center, angle_YZ, axis=rs.CreateVector(1,0,0), copy=False)
objs_2 = rs.RotateObjects(objs_1, center, angle_XY, axis=rs.CreateVector(0,0,1), copy=False)
final_objs = objs_2

# fine-tube the position of the scent container
model_adjust = rs.MoveObjects(objs_2, (M_X, M_Y, M_Z))
model_adjust = rs.RotateObjects(model_adjust, center, R_X, axis=rs.CreateVector(1,0,0), copy=False)
model_adjust = rs.RotateObjects(model_adjust, center, R_Y, axis=rs.CreateVector(0,1,0), copy=False)
model_adjust = rs.RotateObjects(model_adjust, center, R_Z, axis=rs.CreateVector(0,0,1), copy=False)
final_objs = model_adjust

holder_top_adjust = rs.MoveObjects(holder_top_2, (M_X, M_Y, M_Z))
holder_top_adjust = rs.RotateObjects(holder_top_adjust, center, R_X, axis=rs.CreateVector(1,0,0), copy=False)
holder_top_adjust = rs.RotateObjects(holder_top_adjust, center, R_Y, axis=rs.CreateVector(0,1,0), copy=False)
holder_top_adjust = rs.RotateObjects(holder_top_adjust, center, R_Z, axis=rs.CreateVector(0,0,1), copy=False)
final_holder_top = holder_top_adjust

# snap the scent container to the imported 3D model
lines = []
print(final_holder_top)

topCenter = rs.SurfaceAreaCentroid(final_holder_top)[0]

PointArray = rs.BoundingBox(model, view_or_plane=None, in_world_coords=True)
model_to_box = rs.AddBox(PointArray)

inside_or_not = rs.IsPointInSurface(model_to_box, topCenter, strictly_in=False, tolerance=None)
print(inside_or_not)
if inside_or_not == 0:
    model_adsorbed = rs.MoveObject(model, (0, 0, 0))
else:
    param = rs.SurfaceClosestPoint(final_holder_top, topCenter)
    vector = rs.SurfaceNormal(final_holder_top, param)
    
    setPoint = rs.CopyObject(topCenter, 1000*vector)
    line = rs.AddLine(rs.CreatePoint(topCenter), rs.CreatePoint(setPoint))

    if rs.CurveMeshIntersection(line, model, return_faces=False):
        
        max_length = 0
        for p in rs.CurveMeshIntersection(line, model, return_faces=False):
            length = rs.VectorLength(rs.VectorCreate(p, topCenter))
            if length > max_length:
                print(length)
                intersection = p
                max_length = length

        
        move_vector = rs.VectorCreate(intersection, topCenter)
        model_adsorbed = rs.MoveObject(model, -move_vector)
        
    else:
        intersection = None
        model_adsorbed = rs.MoveObject(model, (0, 0, 0))
# ---------- end ghpython_script_17 ----------
geometry_44 = Geometry(ghpython_script_17.final_objs)
geometry_45 = Geometry(ghpython_script_17.model_adsorbed)
geometry_46 = Geometry(ghpython_script_17.model_to_box)
geometry_47 = Geometry(ghpython_script_17.holder_top)

custom_preview_9 = CustomPreview(Geometry=geometry_44, Material=colour_picker)
custom_preview_10 = CustomPreview(Geometry=geometry_45, Material=colour_picker_2)
ghpython_script_18 = GhPythonScript(
    imported_mesh=mesh,
    vertical_piezo_holder=ghpython_script_15.Vertical_piezo_holder,
    vertical_tube_holder=ghpython_script_15.Vertical_tube_holder,
    vertical_pedestal_and_pcb_case=ghpython_script_15.Vertical_pedestal_and_pcb_case)  # -> out, vertical_piezo_holder, vertical_tube_holder, pedestal_and_pcb_case; inputs vertical_pedestal_and_pcb_case: list
# ---------- ghpython_script_18: Python ----------
__author__ = "richluo"
__version__ = "2022.09.22"

import rhinoscriptsyntax as rs

if imported_mesh is not None:
    vertical_piezo_holder = None
    vertical_tube_holder = None
    vertical_pedestal_and_pcb_case = None
else:
    vertical_piezo_holder = vertical_piezo_holder
    vertical_tube_holder = vertical_tube_holder
    
    pedestal_and_pcb_case = []
    for item in vertical_pedestal_and_pcb_case:
        pedestal_and_pcb_case.append(item)
# ---------- end ghpython_script_18 ----------

custom_preview_11 = CustomPreview(Geometry=[ghpython_script_15.Hor_piezo_holder_list, ghpython_script_18.vertical_piezo_holder], Material=colour_picker_9)
custom_preview_12 = CustomPreview(Geometry=[ghpython_script_15.Hor_tube_holder_list, ghpython_script_18.vertical_tube_holder], Material=colour_picker_10)
custom_preview_13 = CustomPreview(
    Geometry=flatten([ghpython_script_15.Hor_pedestal_list, ghpython_script_15.Hor_limiters_list, ghpython_script_15.Pcb_case_with_magnets, ghpython_script_15.Hor_multiscent_pedestal, ghpython_script_15.Pcb_case_without_magnets, ghpython_script_18.pedestal_and_pcb_case]),
    Material=colour_picker_11)

# ==== cluster Clip_Round
cliphight = Slider(18, range=18..100)
clipwide = Slider(4, range=4..10)

# ----
# Guide_T(標準件)
# GuideA
# GuideB
cluster = Cluster(factor="18", A="18")  # -> result, extrusion
geometry = Geometry(cluster.result)
geometry_2 = Geometry(cluster.extrusion)

# ----
# square
rectangle = Rectangle(Plane=PlaneXY(0, 0, 0), XSize="14", YSize="18", Radius=0)  # -> Rectangle, Length
unit_z = UnitZ(Factor="5")
division = Division(A="14", B="2")
division_2 = Division(A="18", B="2")
extrude = Extrude(Base=rectangle.Rectangle, Direction=unit_z)
negative = Negative(Value=division)
negative_2 = Negative(Value=division_2)
cap_holes = CapHoles(Brep=extrude)
construct_point = ConstructPoint(XCoordinate=negative, YCoordinate=negative_2, ZCoordinate=0)
move = Move(Geometry=cap_holes, Motion=construct_point)  # -> Geometry, Transform

# ----
# Clip_round
panel = Panel("1")
division_3 = Division(A="18", B="2")
A = ClusterInput()
cushion = Panel("1")
addition = Addition(A=A, B=cushion)
negative_3 = Negative(Value=division_3)
openangle = Slider(120, range=0..180)
addition_2 = Addition(A=addition, B=clipwide)
addition_3 = Addition(A=addition_2, B=panel)
construct_point_2 = ConstructPoint(XCoordinate=addition_3, YCoordinate=0, ZCoordinate=0)
point = Point(Point(0, 0, 0))
radians = Radians(Degrees=openangle)

# ----
# Universal ball
ball_radius = Slider(6, range=5..7)
extended_length_ratio = Slider(1.5, range=0..10)
universal_ball = Universal_ball(ball_radius=ball_radius, extended_length_ratio=extended_length_ratio, ratio_of_ball_holder=Slider(1, range=0.9..1.1))  # -> ball_2, substracted_ball_3, cubic
ghpython_script = GhPythonScript(x=universal_ball.ball_2, y=universal_ball.substracted_ball_3)  # -> out, a
# ---------- ghpython_script: Python ----------
__author__ = "richluo"
__version__ = "2021.09.26"

import rhinoscriptsyntax as rs

objects = []
objects.append(x)
objects.append(y)

# print objects
center = rs.CreatePoint(0,0,0)
vector = rs.CreateVector(1,0,0)
a = rs.RotateObjects(objects, center, 180.0, vector, None)
# ---------- end ghpython_script ----------
geometry_3 = Geometry(ghpython_script.a)
geometry_4 = Geometry(universal_ball.ball_2)
geometry_5 = Geometry(universal_ball.cubic)
explode_tree = ExplodeTree(Data=graft(geometry_3))  # -> Branch0, Branch1
geometry_6 = Geometry(universal_ball.substracted_ball_3)
geometry_7 = Geometry(explode_tree.Branch0)
geometry_8 = Geometry(explode_tree.Branch1)
unit_z_2 = UnitZ(Factor=Slider(20, range=0..100))
move_2 = Move(Geometry=geometry_8, Motion=unit_z_2)  # -> Geometry, Transform
unit_z_3 = UnitZ(Factor=Slider(0, range=0..100))
move_3 = Move(Geometry=geometry_7, Motion=unit_z_3)  # -> Geometry, Transform
solid_difference = SolidDifference(BrepsA=geometry_5, BrepsB=move_2.Geometry)

# ----
# Universal ball holder_round
panel_2 = Panel("3.2")
multiplication = Multiplication(A=ball_radius, B=panel_2)
multiplication_2 = Multiplication(A=ball_radius, B="1.8")
rectangle_2 = Rectangle(Plane=PlaneXY(0, 0, 0), XSize=cliphight, YSize=multiplication, Radius="0")  # -> Rectangle, Length
unit_z_4 = UnitZ(Factor=multiplication_2)
division_4 = Division(A=cliphight, B="2")
division_5 = Division(A=multiplication, B="2")
extrude_2 = Extrude(Base=rectangle_2.Rectangle, Direction=unit_z_4)
negative_4 = Negative(Value=division_4)
negative_5 = Negative(Value=division_5)
cap_holes_2 = CapHoles(Brep=extrude_2)
construct_point_3 = ConstructPoint(XCoordinate=negative_4, YCoordinate=negative_5, ZCoordinate=0)
move_4 = Move(Geometry=cap_holes_2, Motion=construct_point_3)  # -> Geometry, Transform
xy_plane = XYPlane(Origin=Point(0, 0, 0))
radians_2 = Radians(Degrees=Slider(90, range=0..180))
rotate = Rotate(Geometry=geometry_6, Angle=radians_2, Plane=xy_plane)  # -> Geometry, Transform
solid_difference_2 = SolidDifference(BrepsA=move_4.Geometry, BrepsB=rotate.Geometry)

cylinder = Cylinder(Base=PlaneXY(0, 0, 0), Radius=addition, Length=cliphight)
line = Line(StartPoint=point, EndPoint=construct_point_2)
yz_plane = YZPlane(Origin=Point(0, 0, 0))
addition_4 = Addition(A=cliphight, B="1")
radians_3 = Radians(Degrees=Slider(270, range=0..360))
rotate_2 = Rotate(Geometry=geometry_2, Angle=radians_3, Plane=yz_plane)  # -> Geometry, Transform
construct_point_4 = ConstructPoint(XCoordinate="-7", YCoordinate=negative_3, ZCoordinate=0)
cylinder_2 = Cylinder(Base=PlaneXY(0, 0, 0), Radius=addition_2, Length=cliphight)
rotate_3 = Rotate(Geometry=line, Angle=radians, Plane=PlaneXY(0, 0, 0))  # -> Geometry, Transform
unit_z_5 = UnitZ(Factor=addition_4)
cap_holes_3 = CapHoles(Brep=cylinder)
move_5 = Move(Geometry=rotate_2.Geometry, Motion=construct_point_4)  # -> Geometry, Transform
cap_holes_4 = CapHoles(Brep=cylinder_2)
division_6 = Division(A=cliphight, B="2")
radians_4 = Radians(Degrees=Slider(90, range=0..100))
rotate_4 = Rotate(Geometry=move_5.Geometry, Angle=radians_4, Plane=PlaneXY(0, 0, 0))  # -> Geometry, Transform
division_7 = Division(A=openangle, B="2")
extrude_3 = Extrude(Base=[rotate_3.Geometry, line], Direction=unit_z_5)
solid_difference_3 = SolidDifference(BrepsA=cap_holes_4, BrepsB=cap_holes_3)
radians_5 = Radians(Degrees=Slider(90, range=0..100))
rotate_5 = Rotate(Geometry=move.Geometry, Angle=radians_5, Plane=PlaneXY(0, 0, 0))  # -> Geometry, Transform
yz_plane_2 = YZPlane(Origin=Point(0, 0, 0))
xz_plane = XZPlane(Origin=Point(0, 0, 0))
brep_join = BrepJoin(Breps=flatten(extrude_3))  # -> Breps, Closed
radians_6 = Radians(Degrees=Slider(180, range=0..360))
rotate_6 = Rotate(Geometry=rotate_4.Geometry, Angle=radians_6, Plane=yz_plane_2)  # -> Geometry, Transform
radians_7 = Radians(Degrees=division_7)
yz_plane_3 = YZPlane(Origin=Point(0, 0, 0))
split_brep = SplitBrep(Brep=solid_difference_3, Cutter=brep_join.Breps)
explode_tree_2 = ExplodeTree(Data=graft(split_brep))  # -> Branch0, Branch1
unit_z_6 = UnitZ(Factor="-5")
vector_xyz = VectorXYZ(XComponent=division_6, YComponent=0, ZComponent=addition_2)  # -> Vector, Length
move_6 = Move(Geometry=rotate_6.Geometry, Motion=unit_z_6)  # -> Geometry, Transform
solid_union = SolidUnion(Breps=[move_6.Geometry, rotate_5.Geometry])
panel_3 = Panel(split_brep)
cap_holes_5 = CapHoles(Brep=explode_tree_2.Branch0)
cap_holes_6 = CapHoles(Brep=explode_tree_2.Branch1)
rotate_7 = Rotate(Geometry=cap_holes_6, Angle=1.570796327, Plane=xz_plane)  # -> Geometry, Transform
rotate_8 = Rotate(Geometry=rotate_7.Geometry, Angle=radians_7, Plane=yz_plane_3)  # -> Geometry, Transform
multiplication_3 = Multiplication(A=ball_radius, B="1.42")
unit_z_7 = UnitZ(Factor=multiplication_3)
move_7 = Move(Geometry=rotate_8.Geometry, Motion=vector_xyz.Vector)  # -> Geometry, Transform
unit_z_8 = UnitZ(Factor="8")
move_8 = Move(Geometry=solid_union, Motion=unit_z_8)  # -> Geometry, Transform
move_9 = Move(Geometry=move_7.Geometry, Motion=unit_z_7)  # -> Geometry, Transform
geometry_9 = Geometry(move_8.Geometry)
solid_union_2 = SolidUnion(Breps=flatten([move_9.Geometry, geometry_9]))
solid_union_3 = SolidUnion(Breps=flatten([solid_difference_2, move_9.Geometry]))
geometry_10 = Geometry(solid_union_2)
geometry_11 = Geometry(solid_union_3)
ball_or_not = ClusterInput()
unit_z_9 = UnitZ(Factor="20")
move_10 = Move(Geometry=geometry_11, Motion=unit_z_9)  # -> Geometry, Transform

# ----
# G+B_標準件_6ball
geometry_12 = Geometry(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)

ghpython_script_2 = GhPythonScript(ball_or_not=ball_or_not, guide_with_ball_holder=[geometry_12, move_10.Geometry], guide=geometry_10)  # -> out, geometry
# ---------- ghpython_script_2: Python ----------
__author__ = "corey chen"
__version__ = "2022.03.23"

import rhinoscriptsyntax as rs

if ball_or_not==True:
    geometry = guide_with_ball_holder
else:
    geometry = guide
# ---------- end ghpython_script_2 ----------
geometry_13 = ClusterOutput(ghpython_script_2.geometry)

# ==== cluster Clip_Square

# ----
# Universal ball
ball_radius = Slider(6, range=5..7)
extended_length_ratio = Slider(1.5, range=0..10)
universal_ball = Universal_ball(ball_radius=ball_radius, extended_length_ratio=extended_length_ratio, ratio_of_ball_holder=Slider(1, range=0.9..1.1))  # -> ball_2, substracted_ball_3, cubic
ghpython_script = GhPythonScript(x=universal_ball.ball_2, y=universal_ball.substracted_ball_3)  # -> out, a; same code as ghpython_script
geometry = Geometry(ghpython_script.a)
geometry_2 = Geometry(universal_ball.ball_2)
geometry_3 = Geometry(universal_ball.cubic)
explode_tree = ExplodeTree(Data=graft(geometry))  # -> Branch0, Branch1
geometry_4 = Geometry(universal_ball.substracted_ball_3)
geometry_5 = Geometry(explode_tree.Branch0)
geometry_6 = Geometry(explode_tree.Branch1)
unit_z = UnitZ(Factor=Slider(20, range=0..100))
move = Move(Geometry=geometry_6, Motion=unit_z)  # -> Geometry, Transform
unit_z_2 = UnitZ(Factor=Slider(0, range=0..100))
move_2 = Move(Geometry=geometry_5, Motion=unit_z_2)  # -> Geometry, Transform
solid_difference = SolidDifference(BrepsA=geometry_3, BrepsB=move.Geometry)

A = ClusterInput()
A_2 = ClusterInput()
y_size = ClusterInput()

# ----
# square_with_GuideB
geometry_7 = Geometry(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)

ball_or_not = ClusterInput()

# ----
# G+B_標準件_6ball
geometry_8 = Geometry(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)

unit_z_3 = UnitZ(Factor="20")

# ----
# Universal ball holder_square
panel = Panel("3.2")
multiplication = Multiplication(A=ball_radius, B=panel)
multiplication_2 = Multiplication(A=ball_radius, B="1.8")
unit_z_4 = UnitZ(Factor=multiplication_2)
division = Division(A=multiplication, B="2")
negative = Negative(Value=division)
xy_plane = XYPlane(Origin=Point(0, 0, 0))
radians = Radians(Degrees=Slider(90, range=0..180))
rotate = Rotate(Geometry=geometry_4, Angle=radians, Plane=xy_plane)  # -> Geometry, Transform

# ----
# Clip_square
cliphight = Slider(18, range=18..100)
clipwide = Slider(4, range=4..8)
addition = Addition(A=A, B=clipwide)
multiplication_3 = Multiplication(A=clipwide, B="2")
division_2 = Division(A=clipwide, B="2")
addition_2 = Addition(A=addition, B=clipwide)
addition_3 = Addition(A=A_2, B=multiplication_3)
division_3 = Division(A=addition_3, B="2")
cylinder = Cylinder(Base=PlaneXY(0, 0, 0), Radius=clipwide, Length=cliphight)
division_4 = Division(A=cliphight, B="2")
division_5 = Division(A=addition_3, B="2")
unit_y = UnitY(Factor=clipwide)
rectangle = Rectangle(Plane=PlaneXY(0, 0, 0), XSize=addition, YSize=y_size, Radius=0)  # -> Rectangle, Length
rectangle_2 = Rectangle(Plane=PlaneXY(0, 0, 0), XSize=addition_2, YSize=addition_3, Radius=0)  # -> Rectangle, Length
unit_y_2 = UnitY(Factor=division_3)
cap_holes = CapHoles(Brep=cylinder)
negative_2 = Negative(Value=division_4)
unit_y_3 = UnitY(Factor=division_2)
negative_3 = Negative(Value=division_5)
boundary_surfaces = BoundarySurfaces(Edges=rectangle_2.Rectangle)
unit_z_5 = UnitZ(Factor=cliphight)
boundary_surfaces_2 = BoundarySurfaces(Edges=rectangle.Rectangle)
move_3 = Move(Geometry=boundary_surfaces_2, Motion=unit_y)  # -> Geometry, Transform
move_4 = Move(Geometry=cap_holes, Motion=unit_y_3)  # -> Geometry, Transform
xz_plane = XZPlane(Origin=unit_y_2)
solid_difference_2 = SolidDifference(BrepsA=boundary_surfaces, BrepsB=move_3.Geometry)
mirror = Mirror(Geometry=move_4.Geometry, Plane=xz_plane)  # -> Geometry, Transform
extrude = Extrude(Base=solid_difference_2, Direction=unit_z_5)
multiplication_4 = Multiplication(A=ball_radius, B="1.42")
solid_union = SolidUnion(Breps=[mirror.Geometry, move_4.Geometry, extrude])
addition_4 = Addition(A=addition_2, B=multiplication_4)
negative_4 = Negative(Value=Slider(90, range=0..180))
radians_2 = Radians(Degrees=negative_4)
xz_plane_2 = XZPlane(Origin=Point(0, 0, 0))
construct_point = ConstructPoint(XCoordinate=negative_2, YCoordinate=negative_3, ZCoordinate=addition_4)
rotate_2 = Rotate(Geometry=solid_union, Angle=radians_2, Plane=xz_plane_2)  # -> Geometry, Transform
move_5 = Move(Geometry=rotate_2.Geometry, Motion=construct_point)  # -> Geometry, Transform

rectangle_3 = Rectangle(Plane=PlaneXY(0, 0, 0), XSize=cliphight, YSize=multiplication, Radius="0")  # -> Rectangle, Length
division_6 = Division(A=cliphight, B="2")
extrude_2 = Extrude(Base=rectangle_3.Rectangle, Direction=unit_z_4)
negative_5 = Negative(Value=division_6)
cap_holes_2 = CapHoles(Brep=extrude_2)
construct_point_2 = ConstructPoint(XCoordinate=negative_5, YCoordinate=negative, ZCoordinate=0)
move_6 = Move(Geometry=cap_holes_2, Motion=construct_point_2)  # -> Geometry, Transform
solid_difference_3 = SolidDifference(BrepsA=move_6.Geometry, BrepsB=rotate.Geometry)

solid_union_2 = SolidUnion(Breps=[move_5.Geometry, geometry_7])

solid_union_3 = SolidUnion(Breps=[move_5.Geometry, solid_difference_3])

geometry_9 = Geometry(solid_union_2)
geometry_10 = Geometry(solid_union_3)
move_7 = Move(Geometry=geometry_10, Motion=unit_z_3)  # -> Geometry, Transform
ghpython_script_2 = GhPythonScript(ball_or_not=ball_or_not, guide_with_ball_holder=[geometry_8, move_7.Geometry], guide=geometry_9)  # -> out, geometry; same code as ghpython_script_2
geometry_11 = ClusterOutput(ghpython_script_2.geometry)

# ==== cluster Hook

# ----
# Universal ball
ball_radius = Slider(6, range=5..7)
extended_length_ratio = Slider(1.5, range=0..10)
universal_ball = Universal_ball(ball_radius=ball_radius, extended_length_ratio=extended_length_ratio, ratio_of_ball_holder=Slider(1, range=0.9..1.1))  # -> ball_2, substracted_ball_3, cubic
ghpython_script = GhPythonScript(x=universal_ball.ball_2, y=universal_ball.substracted_ball_3)  # -> out, a; same code as ghpython_script
geometry = Geometry(ghpython_script.a)
geometry_2 = Geometry(universal_ball.ball_2)
geometry_3 = Geometry(universal_ball.cubic)
explode_tree = ExplodeTree(Data=graft(geometry))  # -> Branch0, Branch1
geometry_4 = Geometry(universal_ball.substracted_ball_3)
geometry_5 = Geometry(explode_tree.Branch0)
geometry_6 = Geometry(explode_tree.Branch1)
unit_z = UnitZ(Factor=Slider(20, range=0..100))
move = Move(Geometry=geometry_6, Motion=unit_z)  # -> Geometry, Transform
unit_z_2 = UnitZ(Factor=Slider(0, range=0..100))
move_2 = Move(Geometry=geometry_5, Motion=unit_z_2)  # -> Geometry, Transform
solid_difference = SolidDifference(BrepsA=geometry_3, BrepsB=move.Geometry)

A = ClusterInput()

# ----
# Guide_T(標準件)
cluster = Cluster(factor="18", A="18")  # -> result, extrusion
geometry_7 = Geometry(cluster.result)
geometry_8 = Geometry(cluster.extrusion)

# ----
# square
rectangle = Rectangle(Plane=PlaneXY(0, 0, 0), XSize="24", YSize="18", Radius=0)  # -> Rectangle, Length
unit_z_3 = UnitZ(Factor="5")
division = Division(A="24", B="2")
division_2 = Division(A="18", B="2")
extrude = Extrude(Base=rectangle.Rectangle, Direction=unit_z_3)
negative = Negative(Value=division)
negative_2 = Negative(Value=division_2)
cap_holes = CapHoles(Brep=extrude)
construct_point = ConstructPoint(XCoordinate=negative, YCoordinate=negative_2, ZCoordinate=0)
move_3 = Move(Geometry=cap_holes, Motion=construct_point)  # -> Geometry, Transform

division_3 = Division(A="18", B="2")
negative_3 = Negative(Value=division_3)
yz_plane = YZPlane(Origin=Point(0, 0, 0))
radians = Radians(Degrees=Slider(270, range=0..360))
rotate = Rotate(Geometry=geometry_8, Angle=radians, Plane=yz_plane)  # -> Geometry, Transform
construct_point_2 = ConstructPoint(XCoordinate="-7", YCoordinate=negative_3, ZCoordinate=0)
move_4 = Move(Geometry=rotate.Geometry, Motion=construct_point_2)  # -> Geometry, Transform
radians_2 = Radians(Degrees=Slider(90, range=0..100))
rotate_2 = Rotate(Geometry=move_4.Geometry, Angle=radians_2, Plane=PlaneXY(0, 0, 0))  # -> Geometry, Transform
radians_3 = Radians(Degrees=Slider(90, range=0..100))
rotate_3 = Rotate(Geometry=move_3.Geometry, Angle=radians_3, Plane=PlaneXY(0, 0, 0))  # -> Geometry, Transform
yz_plane_2 = YZPlane(Origin=Point(0, 0, 0))
radians_4 = Radians(Degrees=Slider(180, range=0..360))
rotate_4 = Rotate(Geometry=rotate_2.Geometry, Angle=radians_4, Plane=yz_plane_2)  # -> Geometry, Transform
unit_z_4 = UnitZ(Factor="-5")
move_5 = Move(Geometry=rotate_4.Geometry, Motion=unit_z_4)  # -> Geometry, Transform
solid_union = SolidUnion(Breps=[move_5.Geometry, rotate_3.Geometry])
unit_z_5 = UnitZ(Factor="8")
move_6 = Move(Geometry=solid_union, Motion=unit_z_5)  # -> Geometry, Transform
geometry_9 = Geometry(move_6.Geometry)

# ----
# G+B_標準件_6ball
geometry_10 = Geometry(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)

ball_or_not = ClusterInput()
unit_z_6 = UnitZ(Factor="20")

# ----
# Hook
hookhight = Slider(18, range=18..100)
hookwide = Slider(4, range=4..8)
division_4 = Division(A=A, B="2")
subtraction = Subtraction(A=division_4, B="2")
division_5 = Division(A=hookhight, B="2")
negative_4 = Negative(Value=division_5)
addition = Addition(A=Slider(5, range=0..30), B=subtraction)
addition_2 = Addition(A=Slider(10, range=0..20), B=subtraction)
addition_3 = Addition(A=Slider(2, range=0..20), B=subtraction)
addition_4 = Addition(A=Slider(5, range=0..20), B=subtraction)
addition_5 = Addition(A=Slider(2, range=0..10), B=subtraction)
construct_point_3 = ConstructPoint(XCoordinate=0, YCoordinate=addition, ZCoordinate=Slider(64, range=0..70))
construct_point_4 = ConstructPoint(XCoordinate=0, YCoordinate=addition_2, ZCoordinate=Slider(14, range=5..20))
construct_point_5 = ConstructPoint(XCoordinate=negative_4, YCoordinate=0, ZCoordinate="10")
construct_point_6 = ConstructPoint(XCoordinate=0, YCoordinate=addition_4, ZCoordinate=Slider(25, range=0..30))
construct_point_7 = ConstructPoint(XCoordinate=0, YCoordinate=addition_3, ZCoordinate=Slider(36, range=0..40))
construct_point_8 = ConstructPoint(XCoordinate=0, YCoordinate=Slider(4, range=0..5), ZCoordinate=Slider(0, range=0..10))
construct_point_9 = ConstructPoint(XCoordinate=0, YCoordinate=addition_5, ZCoordinate=Slider(50, range=0..50))
construct_point_10 = ConstructPoint(XCoordinate=0, YCoordinate=Slider(7, range=0..20), ZCoordinate=Slider(2, range=0..15))
move_7 = Move(Geometry=construct_point_5, Motion=construct_point_4)  # -> Geometry, Transform
move_8 = Move(Geometry=construct_point_5, Motion=construct_point_8)  # -> Geometry, Transform
move_9 = Move(Geometry=construct_point_5, Motion=construct_point_6)  # -> Geometry, Transform
move_10 = Move(Geometry=construct_point_5, Motion=construct_point_3)  # -> Geometry, Transform
move_11 = Move(Geometry=construct_point_5, Motion=construct_point_7)  # -> Geometry, Transform
move_12 = Move(Geometry=construct_point_5, Motion=construct_point_10)  # -> Geometry, Transform
move_13 = Move(Geometry=construct_point_5, Motion=construct_point_9)  # -> Geometry, Transform
interpolate = Interpolate(
    Vertices=[move_8.Geometry, move_12.Geometry, move_7.Geometry, move_9.Geometry, move_11.Geometry, move_13.Geometry, move_10.Geometry],
    Degree=3,
    Periodic=False,
    KnotStyle=1)  # -> Curve, Length, Domain
unit_x = UnitX(Factor=hookhight)
extrude_2 = Extrude(Base=interpolate.Curve, Direction=unit_x)
unit_y = UnitY(Factor=hookwide)
xz_plane = XZPlane(Origin=Point(0, 0, 0))
extrude_3 = Extrude(Base=extrude_2, Direction=unit_y)
mirror = Mirror(Geometry=extrude_3, Plane=xz_plane)  # -> Geometry, Transform
solid_union_2 = SolidUnion(Breps=[extrude_3, mirror.Geometry])
panel = Panel(solid_union_2)

# ----
# Universal ball holder_hook
panel_2 = Panel("3.2")
multiplication = Multiplication(A=ball_radius, B=panel_2)
multiplication_2 = Multiplication(A=ball_radius, B="1.8")
unit_z_7 = UnitZ(Factor=multiplication_2)
rectangle_2 = Rectangle(Plane=PlaneXY(0, 0, 0), XSize=hookhight, YSize=multiplication, Radius="0")  # -> Rectangle, Length
division_6 = Division(A=hookhight, B="2")
extrude_4 = Extrude(Base=rectangle_2.Rectangle, Direction=unit_z_7)
division_7 = Division(A=multiplication, B="2")
negative_5 = Negative(Value=division_6)
negative_6 = Negative(Value=division_7)
cap_holes_2 = CapHoles(Brep=extrude_4)
xy_plane = XYPlane(Origin=Point(0, 0, 0))
construct_point_11 = ConstructPoint(XCoordinate=negative_5, YCoordinate=negative_6, ZCoordinate=0)
move_14 = Move(Geometry=cap_holes_2, Motion=construct_point_11)  # -> Geometry, Transform
radians_5 = Radians(Degrees=Slider(90, range=0..180))
rotate_5 = Rotate(Geometry=geometry_4, Angle=radians_5, Plane=xy_plane)  # -> Geometry, Transform
solid_difference_2 = SolidDifference(BrepsA=move_14.Geometry, BrepsB=rotate_5.Geometry)

solid_union_3 = SolidUnion(Breps=[solid_difference_2, solid_union_2])

solid_union_4 = SolidUnion(Breps=[solid_union_2, geometry_9])
geometry_11 = Geometry(solid_union_4)
geometry_12 = Geometry(solid_union_3)
move_15 = Move(Geometry=geometry_12, Motion=Vector(0, 0, 10))  # -> Geometry, Transform
ghpython_script_2 = GhPythonScript(ball_or_not=ball_or_not, guide_with_ball_holder=[geometry_10, move_15.Geometry], guide=geometry_11)  # -> out, geometry; same code as ghpython_script_2
geometry_13 = ClusterOutput(ghpython_script_2.geometry)

# ==== cluster RingEar
ringwide = Slider(2, range=0..10)
ringthick = Slider(5, range=0..5)
multiplication = Multiplication(A=ringwide, B="2")
A = ClusterInput()
A_2 = ClusterInput()
x_coordinate = ClusterInput()
subtraction = Subtraction(A=A, B=multiplication)
subtraction_2 = Subtraction(A=A_2, B=multiplication)
construct_point = ConstructPoint(XCoordinate=x_coordinate, YCoordinate=Slider(0, range=0..10), ZCoordinate=Slider(0, range=0..10))
construct_point_2 = ConstructPoint(XCoordinate=ringwide, YCoordinate=ringwide, ZCoordinate=0)
radius = ClusterInput()
x_size = ClusterInput()
y_size = ClusterInput()
radius_2 = ClusterInput()
rectangle = Rectangle(Plane=construct_point, XSize=subtraction, YSize=subtraction_2, Radius=radius)  # -> Rectangle, Length
rectangle_2 = Rectangle(Plane=construct_point, XSize=x_size, YSize=y_size, Radius=radius_2)  # -> Rectangle, Length
# Ring/ear
boundary_surfaces = BoundarySurfaces(Edges=rectangle_2.Rectangle)
boundary_surfaces_2 = BoundarySurfaces(Edges=rectangle.Rectangle)
unit_z = UnitZ(Factor=ringthick)
move = Move(Geometry=boundary_surfaces_2, Motion=construct_point_2)  # -> Geometry, Transform
solid_difference = SolidDifference(BrepsA=boundary_surfaces, BrepsB=move.Geometry)
extrude = Extrude(Base=solid_difference, Direction=unit_z)
radians = Radians(Degrees=Slider(0, range=0..180))
yz_plane = YZPlane(Origin=Point(0, 0, 0))
value = ClusterInput()
rotate = Rotate(Geometry=extrude, Angle=radians, Plane=yz_plane)  # -> Geometry, Transform
mirror = Mirror(Geometry=rotate.Geometry, Plane=PlaneYZ(0, 0, 0))  # -> Geometry, Transform
ghpython_script = GhPythonScript(x=mirror.Geometry, value=value)  # -> out, a
# ---------- ghpython_script: Python ----------
__author__ = "corey chen"
__version__ = "2022.03.13"

import rhinoscriptsyntax as rs

if value:
    a = x
else:
    pass
# ---------- end ghpython_script ----------
# Ring/ear
geometry = Geometry(ghpython_script.a)
solid_union = SolidUnion(Breps=[rotate.Geometry, geometry])
result = ClusterOutput(solid_union)

# ==== cluster T_T
A = ClusterInput()
subtraction = Subtraction(A=A, B="6")
x_coordinate = ClusterInput()
t_thick = Slider(3, range=2..4)
construct_point = ConstructPoint(XCoordinate=x_coordinate, YCoordinate=Slider(0, range=0..10), ZCoordinate=Slider(0, range=0..10))
x_size = ClusterInput()
y_size = ClusterInput()
A_2 = ClusterInput()
rectangle = Rectangle(Plane=construct_point, XSize=x_size, YSize=subtraction, Radius="0.5")  # -> Rectangle, Length
rectangle_2 = Rectangle(Plane=construct_point, XSize=subtraction, YSize=y_size, Radius="0.5")  # -> Rectangle, Length
subtraction_2 = Subtraction(A=A_2, B=subtraction)
division = Division(A=subtraction_2, B="2")
negative = Negative(Value=division)
construct_point_2 = ConstructPoint(XCoordinate=subtraction_2, YCoordinate=negative, ZCoordinate=0)
boundary_surfaces = BoundarySurfaces(Edges=rectangle_2.Rectangle)
# T_T
boundary_surfaces_2 = BoundarySurfaces(Edges=rectangle.Rectangle)
unit_z = UnitZ(Factor=t_thick)
move = Move(Geometry=boundary_surfaces, Motion=construct_point_2)  # -> Geometry, Transform
solid_union = SolidUnion(Breps=[boundary_surfaces_2, move.Geometry])
extrude = Extrude(Base=solid_union, Direction=unit_z)
mirror = Mirror(Geometry=extrude, Plane=PlaneYZ(0, 0, 0))  # -> Geometry, Transform
value = ClusterInput()
ghpython_script = GhPythonScript(x=mirror.Geometry, value=value)  # -> out, a; same code as ghpython_script
geometry = Geometry(ghpython_script.a)
solid_union_2 = SolidUnion(Breps=[extrude, geometry])
result = ClusterOutput(solid_union_2)

# ==== cluster Cluster_2

# ----
# Universal ball
ball_radius = Slider(6, range=5..7)
extended_length_ratio = Slider(1.5, range=0..10)
universal_ball = Universal_ball(ball_radius=ball_radius, extended_length_ratio=extended_length_ratio, ratio_of_ball_holder=Slider(1, range=0.9..1.1))  # -> ball_2, substracted_ball_3, cubic
ghpython_script = GhPythonScript(x=universal_ball.ball_2, y=universal_ball.substracted_ball_3)  # -> out, a; same code as ghpython_script
geometry = Geometry(ghpython_script.a)
geometry_2 = Geometry(universal_ball.ball_2)
explode_tree = ExplodeTree(Data=graft(geometry))  # -> Branch0, Branch1
geometry_3 = Geometry(universal_ball.cubic)
geometry_4 = Geometry(universal_ball.substracted_ball_3)
geometry_5 = Geometry(explode_tree.Branch0)
geometry_6 = Geometry(explode_tree.Branch1)
unit_z = UnitZ(Factor=Slider(20, range=0..100))
move = Move(Geometry=geometry_6, Motion=unit_z)  # -> Geometry, Transform
unit_z_2 = UnitZ(Factor=Slider(0, range=0..100))
move_2 = Move(Geometry=geometry_5, Motion=unit_z_2)  # -> Geometry, Transform
solid_difference = SolidDifference(BrepsA=geometry_3, BrepsB=move.Geometry)

division = Division(A="32", B="2")

# ----
# Guide_T(標準件)
# GuideA
# GuideB
cluster = Cluster(factor="32", A="32")  # -> result, extrusion
geometry_7 = Geometry(cluster.result)
geometry_8 = Geometry(cluster.extrusion)

negative = Negative(Value=division)
yz_plane = YZPlane(Origin=Point(0, 0, 0))
radians = Radians(Degrees=Slider(270, range=0..360))
rotate = Rotate(Geometry=geometry_8, Angle=radians, Plane=yz_plane)  # -> Geometry, Transform
point = Point(Point(1, 0, 0))
geometry_9 = Geometry([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])
ball_or_not = ClusterInput()

# ----
# G+B_標準件_6ball
geometry_10 = Geometry(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)

unit_z_3 = UnitZ(Factor="30")
move_3 = Move(Geometry=geometry_10, Motion=unit_z_3)  # -> Geometry, Transform
point_2 = Point(Point(0, 0, 0))
magnet_radius = Slider(4.9, range=0..10)
magnet_height = Slider(2, range=0..100)
cylinder = Cylinder(Base=point_2, Radius=magnet_radius, Length=magnet_height)
unit_x = UnitX(Factor=expr("x*2+6", magnet_radius))
magnet = CapHoles(Brep=cylinder)
move_4 = Move(Geometry=magnet, Motion=unit_x)  # -> Geometry, Transform
point_3 = Point(Point(0, 0, 0))
addition = Addition(A=magnet_radius, B="3")
unit_y = UnitY(Factor=expr("x*2+6", magnet_radius))
move_5 = Move(Geometry=magnet, Motion=unit_y)  # -> Geometry, Transform
move_6 = Move(Geometry=move_5.Geometry, Motion=unit_x)  # -> Geometry, Transform
geometry_11 = Geometry([magnet, move_4.Geometry, move_5.Geometry, move_6.Geometry])
construct_point = ConstructPoint(XCoordinate=addition, YCoordinate=addition, ZCoordinate=0)
vector_2pt = Vector2Pt(PointA=construct_point, PointB=point_3, Unitize=False)  # -> Vector, Length
move_7 = Move(Geometry=geometry_11, Motion=vector_2pt.Vector)  # -> Geometry, Transform

# ----
# Universal ball holder_round
panel = Panel("1.8")
multiplication = Multiplication(A=ball_radius, B=panel)
rectangle = Rectangle(Plane=PlaneXY(0, 0, 0), XSize="32", YSize="32", Radius=0)  # -> Rectangle, Length
unit_z_4 = UnitZ(Factor=multiplication)
division_2 = Division(A="32", B="2")
division_3 = Division(A="32", B="2")
extrude = Extrude(Base=rectangle.Rectangle, Direction=unit_z_4)
negative_2 = Negative(Value=division_2)
negative_3 = Negative(Value=division_3)
cap_holes = CapHoles(Brep=extrude)
construct_point_2 = ConstructPoint(XCoordinate=negative_2, YCoordinate=negative_3, ZCoordinate=0)
move_8 = Move(Geometry=cap_holes, Motion=construct_point_2)  # -> Geometry, Transform
xy_plane = XYPlane(Origin=Point(0, 0, 0))
radians_2 = Radians(Degrees=Slider(90, range=0..180))
rotate_2 = Rotate(Geometry=geometry_4, Angle=radians_2, Plane=xy_plane)  # -> Geometry, Transform

addition_2 = Addition(A=multiplication, B="4")
construct_point_3 = ConstructPoint(XCoordinate="-7", YCoordinate=negative, ZCoordinate=addition_2)
volume = Volume(Geometry=move_8.Geometry)  # -> Volume, Centroid
rotate_3d = Rotate3D(Geometry=rotate_2.Geometry, Angle=3.141592654, Center=volume.Centroid, Axis=point)  # -> Geometry, Transform
move_9 = Move(Geometry=rotate.Geometry, Motion=construct_point_3)  # -> Geometry, Transform
solid_difference_2 = SolidDifference(BrepsA=move_8.Geometry, BrepsB=geometry_9)
solid_union = SolidUnion(Breps=[move_9.Geometry, solid_difference_2])

solid_difference_3 = SolidDifference(BrepsA=solid_difference_2, BrepsB=rotate_3d.Geometry)

geometry_12 = Geometry(solid_union)
geometry_13 = Geometry(solid_difference_3)
ghpython_script_2 = GhPythonScript(ball_or_not=ball_or_not, guide_with_ball_holder=[geometry_13, move_3.Geometry], guide=geometry_12)  # -> out, geometry; same code as ghpython_script_2
geometry_14 = ClusterOutput(ghpython_script_2.geometry)

# ==== cluster Cluster_3

# ----
# Universal ball
ball_radius = Slider(6, range=5..7)
extended_length_ratio = Slider(1.5, range=0..10)
universal_ball = Universal_ball(ball_radius=ball_radius, extended_length_ratio=extended_length_ratio, ratio_of_ball_holder=Slider(1, range=0.9..1.1))  # -> ball_2, substracted_ball_3, cubic
ghpython_script = GhPythonScript(x=universal_ball.ball_2, y=universal_ball.substracted_ball_3)  # -> out, a; same code as ghpython_script
geometry = Geometry(ghpython_script.a)
geometry_2 = Geometry(universal_ball.ball_2)
explode_tree = ExplodeTree(Data=graft(geometry))  # -> Branch0, Branch1
geometry_3 = Geometry(universal_ball.cubic)
geometry_4 = Geometry(universal_ball.substracted_ball_3)
geometry_5 = Geometry(explode_tree.Branch0)
geometry_6 = Geometry(explode_tree.Branch1)
unit_z = UnitZ(Factor=Slider(20, range=0..100))
move = Move(Geometry=geometry_6, Motion=unit_z)  # -> Geometry, Transform
unit_z_2 = UnitZ(Factor=Slider(0, range=0..100))
move_2 = Move(Geometry=geometry_5, Motion=unit_z_2)  # -> Geometry, Transform
solid_difference = SolidDifference(BrepsA=geometry_3, BrepsB=move.Geometry)

# ----
# Universal ball holder_round
panel = Panel("1.8")
multiplication = Multiplication(A=ball_radius, B=panel)
rectangle = Rectangle(Plane=PlaneXY(0, 0, 0), XSize="32", YSize="32", Radius=0)  # -> Rectangle, Length
unit_z_3 = UnitZ(Factor=multiplication)
division = Division(A="32", B="2")
division_2 = Division(A="32", B="2")
extrude = Extrude(Base=rectangle.Rectangle, Direction=unit_z_3)
negative = Negative(Value=division)
negative_2 = Negative(Value=division_2)
cap_holes = CapHoles(Brep=extrude)
construct_point = ConstructPoint(XCoordinate=negative, YCoordinate=negative_2, ZCoordinate=0)
move_3 = Move(Geometry=cap_holes, Motion=construct_point)  # -> Geometry, Transform
xy_plane = XYPlane(Origin=Point(0, 0, 0))
radians = Radians(Degrees=Slider(90, range=0..180))
rotate = Rotate(Geometry=geometry_4, Angle=radians, Plane=xy_plane)  # -> Geometry, Transform
solid_difference_2 = SolidDifference(BrepsA=move_3.Geometry, BrepsB=rotate.Geometry)

division_3 = Division(A="32", B="2")
addition = Addition(A=multiplication, B="4")

# ----
# Guide_T(標準件)
# GuideA
# GuideB
cluster = Cluster(factor="32", A="32")  # -> result, extrusion
geometry_7 = Geometry(cluster.result)
geometry_8 = Geometry(cluster.extrusion)

negative_3 = Negative(Value=division_3)
yz_plane = YZPlane(Origin=Point(0, 0, 0))
radians_2 = Radians(Degrees=Slider(270, range=0..360))
rotate_2 = Rotate(Geometry=geometry_8, Angle=radians_2, Plane=yz_plane)  # -> Geometry, Transform
construct_point_2 = ConstructPoint(XCoordinate="-7", YCoordinate=negative_3, ZCoordinate=addition)
move_4 = Move(Geometry=rotate_2.Geometry, Motion=construct_point_2)  # -> Geometry, Transform
solid_union = SolidUnion(Breps=[move_3.Geometry, move_4.Geometry])
ball_or_not = ClusterInput()
geometry_9 = Geometry(solid_difference_2)
geometry_10 = Geometry(solid_union)

# ----
# G+B_標準件_6ball
geometry_11 = Geometry(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)

unit_z_4 = UnitZ(Factor="30")
move_5 = Move(Geometry=geometry_11, Motion=unit_z_4)  # -> Geometry, Transform
ghpython_script_2 = GhPythonScript(ball_or_not=ball_or_not, guide_with_ball_holder=[geometry_9, move_5.Geometry], guide=geometry_10)  # -> out, geometry; same code as ghpython_script_2
geometry_12 = ClusterOutput(ghpython_script_2.geometry)

# ==== cluster Stand

# ----
# Guide_T(標準件)
# GuideB
guideheight = Slider(4, range=4..10)
guideholderx = Slider(14, range=10..100)
# 標準件統一參數:35.2
guideholderthick = Slider(35.2, range=0..100)
startz = Slider(0, range=0..100)
starty = Slider(0, range=0..100)
startx = Slider(0, range=0..100)
subtraction = Subtraction(A=guideholderx, B="8")
subtraction_2 = Subtraction(A=guideholderx, B="4")
construct_point = ConstructPoint(XCoordinate=startx, YCoordinate=starty, ZCoordinate=startz)
addition = Addition(A=guideheight, B="2")
subtraction_3 = Subtraction(A=guideheight, B="2")
rectangle = Rectangle(Plane=construct_point, XSize=guideholderx, YSize=addition, Radius=0)  # -> Rectangle, Length
rectangle_2 = Rectangle(Plane=PlaneXY(0, 0, 0), XSize=subtraction_2, YSize="2", Radius=0)  # -> Rectangle, Length
subtraction_4 = Subtraction(A=guideholderx, B=subtraction)
unit_y = UnitY(Factor=subtraction_3)
division = Division(A=subtraction_4, B="2")
division_2 = Division(A="4", B="2")
boundary_surfaces = BoundarySurfaces(Edges=rectangle.Rectangle)
unit_x = UnitX(Factor=division)
rectangle_3 = Rectangle(Plane=PlaneXY(0, 0, 0), XSize=subtraction, YSize=guideheight, Radius=0)  # -> Rectangle, Length
move = Move(Geometry=rectangle_2.Rectangle, Motion=unit_y)  # -> Geometry, Transform
unit_x_2 = UnitX(Factor=division_2)
unit_z = UnitZ(Factor="-2")
unit_z_2 = UnitZ(Factor=guideholderthick)
move_2 = Move(Geometry=rectangle_3.Rectangle, Motion=unit_x)  # -> Geometry, Transform
move_3 = Move(Geometry=move.Geometry, Motion=unit_x_2)  # -> Geometry, Transform
extrude = Extrude(Base=boundary_surfaces, Direction=unit_z)
division_3 = Division(A=guideholderthick, B="2")
division_4 = Division(A="0.5", B="2")
boundary_surfaces_2 = BoundarySurfaces(Edges=move_2.Geometry)
boundary_surfaces_3 = BoundarySurfaces(Edges=move_3.Geometry)
addition_2 = Addition(A=division, B=division_4)
subtraction_5 = Subtraction(A=subtraction, B="0.5")
subtraction_6 = Subtraction(A=guideheight, B=division_4)
subtraction_7 = Subtraction(A=subtraction_2, B="0.5")
subtraction_8 = Subtraction(A="2", B="0.5")
area = Area(Geometry=boundary_surfaces_3)  # -> Area, Centroid
solid_union = SolidUnion(Breps=[boundary_surfaces_2, boundary_surfaces_3])
rectangle_4 = Rectangle(Plane=PlaneXY(0, 0, 0), XSize=subtraction_5, YSize=subtraction_6, Radius=0)  # -> Rectangle, Length
rectangle_5 = Rectangle(Plane=PlaneXY(0, 0, 0), XSize=subtraction_7, YSize=subtraction_8, Radius=0)  # -> Rectangle, Length
subtraction_9 = Subtraction(A="0", B=division_3)
unit_x_3 = UnitX(Factor=addition_2)
division_5 = Division(A=guideholderx, B="2")
negative = Negative(Value=division_5)
solid_difference = SolidDifference(BrepsA=boundary_surfaces, BrepsB=solid_union)
area_2 = Area(Geometry=rectangle_5.Rectangle)  # -> Area, Centroid
move_4 = Move(Geometry=rectangle_4.Rectangle, Motion=unit_x_3)  # -> Geometry, Transform
construct_point_2 = ConstructPoint(XCoordinate=negative, YCoordinate=subtraction_9, ZCoordinate="5")
xz_plane = XZPlane(Origin=Point(0, 0, 0))
vector_2pt = Vector2Pt(PointA=area_2.Centroid, PointB=area.Centroid, Unitize=False)  # -> Vector, Length
boundary_surfaces_4 = BoundarySurfaces(Edges=move_4.Geometry)
move_5 = Move(Geometry=rectangle_5.Rectangle, Motion=vector_2pt.Vector)  # -> Geometry, Transform
boundary_surfaces_5 = BoundarySurfaces(Edges=move_5.Geometry)
extrude_2 = Extrude(Base=solid_difference, Direction=unit_z_2)
orient = Orient(Geometry=extrude_2, Source=xz_plane, Target=PlaneXY(0, 0, 0))  # -> Geometry, Transform
move_6 = Move(Geometry=orient.Geometry, Motion=construct_point_2)  # -> Geometry, Transform
solid_union_2 = SolidUnion(Breps=[boundary_surfaces_4, boundary_surfaces_5])
extrude_3 = Extrude(Base=solid_union_2, Direction=unit_z_2)
solid_union_3 = SolidUnion(Breps=[extrude_3, extrude])

# ----
# Universal ball
ball_radius = Slider(6, range=5..7)
universal_ball = Universal_ball_2(ball_radius=ball_radius, extended_length_ratio="1.5", ratio_of_ball_holder=Slider(1, range=0.9..1.1))  # -> ball_2, substracted_ball_3, cubic
ghpython_script = GhPythonScript(x=universal_ball.ball_2, y=universal_ball.substracted_ball_3)  # -> out, a; same code as ghpython_script
geometry = Geometry(ghpython_script.a)
geometry_2 = Geometry(universal_ball.ball_2)
geometry_3 = Geometry(universal_ball.cubic)
explode_tree = ExplodeTree(Data=graft(geometry))  # -> Branch0, Branch1
geometry_4 = Geometry(universal_ball.substracted_ball_3)
geometry_5 = Geometry(explode_tree.Branch0)
geometry_6 = Geometry(explode_tree.Branch1)
unit_z_3 = UnitZ(Factor=Slider(20, range=0..100))
move_7 = Move(Geometry=geometry_6, Motion=unit_z_3)  # -> Geometry, Transform
unit_z_4 = UnitZ(Factor=Slider(0, range=0..100))
move_8 = Move(Geometry=geometry_5, Motion=unit_z_4)  # -> Geometry, Transform
solid_difference_2 = SolidDifference(BrepsA=geometry_3, BrepsB=move_7.Geometry)

geometry_7 = Geometry(move_6.Geometry)

# ----
# Universal ball holder_stand
# StandB
panel = Panel(guideholderx)
multiplication = Multiplication(A=panel, B="1.4")
multiplication_2 = Multiplication(A=ball_radius, B="1.8")
unit_z_5 = UnitZ(Factor=multiplication_2)
rectangle_6 = Rectangle(Plane=PlaneXY(0, 0, 0), XSize="24", YSize=multiplication, Radius="0")  # -> Rectangle, Length
division_6 = Division(A=multiplication, B="2")
division_7 = Division(A="24", B="2")
extrude_4 = Extrude(Base=rectangle_6.Rectangle, Direction=unit_z_5)
negative_2 = Negative(Value=division_7)
negative_3 = Negative(Value=division_6)
cap_holes = CapHoles(Brep=extrude_4)
radians = Radians(Degrees=Slider(90, range=0..100))
construct_point_3 = ConstructPoint(XCoordinate=negative_2, YCoordinate=negative_3, ZCoordinate=0)
xy_plane = XYPlane(Origin=Point(0, 0, 0))
move_9 = Move(Geometry=cap_holes, Motion=construct_point_3)  # -> Geometry, Transform
xy_plane_2 = XYPlane(Origin=Point(0, 0, 0))
rotate = Rotate(Geometry=geometry_7, Angle=radians, Plane=xy_plane)  # -> Geometry, Transform
unit_z_6 = UnitZ(Factor=unit_z_5)
radians_2 = Radians(Degrees=Slider(0, range=0..180))
rotate_2 = Rotate(Geometry=geometry_4, Angle=radians_2, Plane=xy_plane_2)  # -> Geometry, Transform
division_8 = Division(A="24", B=guideholderthick)
move_10 = Move(Geometry=rotate.Geometry, Motion=unit_z_6)  # -> Geometry, Transform
solid_difference_3 = SolidDifference(BrepsA=move_9.Geometry, BrepsB=rotate_2.Geometry)
scale_nu = ScaleNU(Geometry=move_10.Geometry, Plane=PlaneXY(0, 0, 0), ScaleX=division_8, ScaleY=1, ScaleZ=1)  # -> Geometry, Transform
solid_union_4 = SolidUnion(Breps=[solid_difference_3, scale_nu.Geometry])

factor = ClusterInput()
radius = ClusterInput()
length = ClusterInput()
radius_2 = ClusterInput()
length_2 = ClusterInput()
A = ClusterInput()
B = ClusterInput()
point = Point(Point(30, 0, 30))
move_11 = Move(Geometry=solid_union_4, Motion=point)  # -> Geometry, Transform

# ----
# Stand
# StandA
unit_z_7 = UnitZ(Factor=factor)
cylinder = Cylinder(Base=PlaneXY(0, 0, 0), Radius=radius, Length=length)
cylinder_2 = Cylinder(Base=unit_z_7, Radius=radius_2, Length=length_2)
addition_3 = Addition(A=A, B=B)
cap_holes_2 = CapHoles(Brep=cylinder_2)
cap_holes_3 = CapHoles(Brep=cylinder)
geometry_8 = Geometry(geometry_2)

subtraction_10 = Subtraction(A=addition_3, B="9")

unit_z_8 = UnitZ(Factor=subtraction_10)
move_12 = Move(Geometry=geometry_8, Motion=unit_z_8)  # -> Geometry, Transform
solid_union_5 = SolidUnion(Breps=[cap_holes_3, cap_holes_2, move_12.Geometry])

result = ClusterOutput([solid_union_5, move_11.Geometry])

# ==== cluster Universal_ball
ball_radius = ClusterInput()
ratio_of_ball_holder = ClusterInput()
extended_length_ratio = ClusterInput()
division = Division(A=ball_radius, B="6")
box = Box({Plane=PlaneXY(-10, -10, 0), X=Domain(0, 20), Y=Domain(0, 20), Z=Domain(0, 20)})
cubic = ClusterOutput(box)
scale = Scale(Geometry=box, Center=Point(0, 0, 0), Factor=division)  # -> Geometry, Transform
multiplication = Multiplication(A=ball_radius, B=extended_length_ratio)
deconstruct_brep = DeconstructBrep(Brep=scale.Geometry)  # -> Faces, Edges, Vertices
division_2 = Division(A=ball_radius, B=Slider(1.5, range=0..10))
unit_z = UnitZ(Factor=multiplication)
top_face = Slider(5, range=0..10)
factor_1 = Slider(0.4, range=0..1)
unit_z_2 = UnitZ(Factor=ball_radius)  # -> expr("-x", UnitVector)
box_faces = ListItem(List=deconstruct_brep.Faces, Index=top_face, Wrap=True)
area = Area(Geometry=box_faces)  # -> Area, Centroid
basic_ball = Sphere(Base=area.Centroid, Radius=ball_radius)
multiplication_2 = Multiplication(A=unit_z_2, B=factor_1)

# ---- group: Side balls
unit_x = UnitX(Factor=ball_radius)
scale_0_5x = Scale(Geometry=basic_ball, Center=area.Centroid, Factor=Slider(0.5, range=0..1))  # -> Geometry, Transform
move = Move(Geometry=scale_0_5x.Geometry, Motion=expr("-x", unit_x))  # -> Geometry, Transform
move_2 = Move(Geometry=scale_0_5x.Geometry, Motion=unit_x)  # -> Geometry, Transform

# ----
move_3 = Move(Geometry=basic_ball, Motion=multiplication_2)  # -> Geometry, Transform
area_2 = Area(Geometry=move_3.Geometry)  # -> Area, Centroid
cylinder = Cylinder(Base=area_2.Centroid, Radius=division_2, Length=unit_z)

list_item = ListItem(Index=Slider(2, range=0..10), Wrap=True)
number_slider = Slider(1.5, range=0..10)
need_to_be_para = Slider(1.5, range=0..10)
offset_curve = OffsetCurve(Curve=list_item, Distance=expr("-x", need_to_be_para), Plane=PlaneXY(0, 0, 0), Corners=1)
unit_z_3 = UnitZ(Factor=number_slider)
move_4 = Move(Geometry=offset_curve, Motion=unit_z_3)  # -> flatten(Geometry), Transform
point_on_curve = PointOnCurve(list_item, parameter=0.5)
line_sdl = LineSDL(Start=point_on_curve, Direction=unit_z_3, Length=number_slider)
point_on_curve_2 = PointOnCurve(line_sdl, parameter=1)
point_on_curve_3 = PointOnCurve(move_4.Geometry, parameter=0.5)
polyline = PolyLine(Vertices=flatten([point_on_curve_3, point_on_curve_2, point_on_curve]), Closed=False)
fillet = Fillet(Curve=flatten(polyline), Radius="1")
sweep2 = Sweep2(Rail1=list_item, Rail2=move_4.Geometry, Sections=fillet, SameHeight=False)
cap_holes = CapHoles(Brep=sweep2)

deconstruct_brep_2 = DeconstructBrep(Brep=cylinder)  # -> Faces, Edges, Vertices
list_item_2 = ListItem(List=deconstruct_brep_2.Edges, Index=Slider(0, range=0..10), Wrap=True)
boundary_surfaces = BoundarySurfaces(Edges=list_item_2)
extrude = Extrude(Base=boundary_surfaces, Direction=unit_z)

deconstruct_brep_3 = DeconstructBrep(Brep=extrude)  # -> Faces, Edges, Vertices
list_item_3 = ListItem(List=deconstruct_brep_3.Faces, Index=Slider(5, range=0..10), Wrap=True)
area_3 = Area(Geometry=list_item_3)  # -> Area, Centroid

merge = Merge(Data1=flatten(move_2.Geometry), Data2=flatten(move.Geometry), Data3=flatten(move_3.Geometry))  # -> flatten(Result)
up = SolidDifference(BrepsA=scale.Geometry, BrepsB=[move_3.Geometry, move_2.Geometry, move.Geometry])  # -> flatten(UPPart)
solid_union = SolidUnion(Breps=merge)

solid_union_2 = SolidUnion(Breps=flatten([extrude, move_3.Geometry]))

unit_y = UnitY(Factor=1)
pi = Pi(Factor=Slider(1, range=0..1))
rotate_3d = Rotate3D(Geometry=[solid_union_2, solid_union, up], Angle=pi, Center=area_3.Centroid, Axis=unit_y)  # -> DOWNPart, Transform

point = Point(Point(0, 0, 0))
move_to_point = MoveToPoint(Geometry=rotate_3d.DOWNPart, PointA=area_3.Centroid, PointB=point)  # -> simplify(graft(Moved)), Vector, Transform
explode_tree = ExplodeTree(Data=move_to_point.Moved)  # -> simplify(Branch0), simplify(Branch1), simplify(Branch2)
ball = Geometry(flatten(explode_tree.Branch0))
ball_2 = ClusterOutput(ball)
substracted_ball = Geometry(flatten(explode_tree.Branch1))
cubic_2 = Geometry(explode_tree.Branch2)
deconstruct_brep_4 = DeconstructBrep(Brep=cubic_2)  # -> Faces, Edges, Vertices
list_item_4 = ListItem(List=deconstruct_brep_4.Vertices, Index=Slider(4, range=0..6), Wrap=True)
deconstruct = Deconstruct(Point=list_item_4)  # -> XComponent, YComponent, ZComponent
unit_z_4 = UnitZ(Factor=deconstruct.ZComponent)
reverse = Reverse(Vector=unit_z_4)
move_5 = Move(Geometry=substracted_ball, Motion=reverse)  # -> Geometry, Transform
panel = Panel(ball)
substracted_ball_2 = Geometry(flatten(move_5.Geometry))
scale_2 = Scale(Geometry=substracted_ball_2, Center=Point(0, 0, 0), Factor=ratio_of_ball_holder)  # -> Geometry, Transform
substracted_ball_3 = ClusterOutput(scale_2.Geometry)
panel_2 = Panel(scale_2.Geometry)

# ==== cluster Cluster
guideheight = Slider(4, range=4..10)
guideholderx = Slider(14, range=10..100)
startz = Slider(0, range=0..100)
starty = Slider(0, range=0..100)
startx = Slider(0, range=0..100)
subtraction = Subtraction(A=guideholderx, B="8")
subtraction_2 = Subtraction(A=guideholderx, B="4")
construct_point = ConstructPoint(XCoordinate=startx, YCoordinate=starty, ZCoordinate=startz)
addition = Addition(A=guideheight, B="2")
subtraction_3 = Subtraction(A=guideheight, B="2")
rectangle = Rectangle(Plane=construct_point, XSize=guideholderx, YSize=addition, Radius=0)  # -> Rectangle, Length
rectangle_2 = Rectangle(Plane=PlaneXY(0, 0, 0), XSize=subtraction_2, YSize="2", Radius=0)  # -> Rectangle, Length
subtraction_4 = Subtraction(A=guideholderx, B=subtraction)
unit_y = UnitY(Factor=subtraction_3)
division = Division(A=subtraction_4, B="2")
division_2 = Division(A="4", B="2")
factor = ClusterInput()
boundary_surfaces = BoundarySurfaces(Edges=rectangle.Rectangle)
unit_x = UnitX(Factor=division)
rectangle_3 = Rectangle(Plane=PlaneXY(0, 0, 0), XSize=subtraction, YSize=guideheight, Radius=0)  # -> Rectangle, Length
move = Move(Geometry=rectangle_2.Rectangle, Motion=unit_y)  # -> Geometry, Transform
unit_x_2 = UnitX(Factor=division_2)
unit_z = UnitZ(Factor="-2")
unit_z_2 = UnitZ(Factor=factor)
move_2 = Move(Geometry=rectangle_3.Rectangle, Motion=unit_x)  # -> Geometry, Transform
move_3 = Move(Geometry=move.Geometry, Motion=unit_x_2)  # -> Geometry, Transform
A = ClusterInput()
extrude = Extrude(Base=boundary_surfaces, Direction=unit_z)
division_3 = Division(A=A, B="2")
division_4 = Division(A="0.5", B="2")
boundary_surfaces_2 = BoundarySurfaces(Edges=move_2.Geometry)
boundary_surfaces_3 = BoundarySurfaces(Edges=move_3.Geometry)
addition_2 = Addition(A=division, B=division_4)
subtraction_5 = Subtraction(A=subtraction, B="0.5")
subtraction_6 = Subtraction(A=guideheight, B=division_4)
subtraction_7 = Subtraction(A=subtraction_2, B="0.5")
subtraction_8 = Subtraction(A="2", B="0.5")
area = Area(Geometry=boundary_surfaces_3)  # -> Area, Centroid
solid_union = SolidUnion(Breps=[boundary_surfaces_2, boundary_surfaces_3])
rectangle_4 = Rectangle(Plane=PlaneXY(0, 0, 0), XSize=subtraction_5, YSize=subtraction_6, Radius=0)  # -> Rectangle, Length
rectangle_5 = Rectangle(Plane=PlaneXY(0, 0, 0), XSize=subtraction_7, YSize=subtraction_8, Radius=0)  # -> Rectangle, Length
subtraction_9 = Subtraction(A="0", B=division_3)
unit_x_3 = UnitX(Factor=addition_2)
division_5 = Division(A=guideholderx, B="2")
negative = Negative(Value=division_5)
area_2 = Area(Geometry=rectangle_5.Rectangle)  # -> Area, Centroid
solid_difference = SolidDifference(BrepsA=boundary_surfaces, BrepsB=solid_union)
move_4 = Move(Geometry=rectangle_4.Rectangle, Motion=unit_x_3)  # -> Geometry, Transform
construct_point_2 = ConstructPoint(XCoordinate=negative, YCoordinate=subtraction_9, ZCoordinate="5")
xz_plane = XZPlane(Origin=Point(0, 0, 0))
vector_2pt = Vector2Pt(PointA=area_2.Centroid, PointB=area.Centroid, Unitize=False)  # -> Vector, Length
boundary_surfaces_4 = BoundarySurfaces(Edges=move_4.Geometry)
move_5 = Move(Geometry=rectangle_5.Rectangle, Motion=vector_2pt.Vector)  # -> Geometry, Transform
boundary_surfaces_5 = BoundarySurfaces(Edges=move_5.Geometry)
extrude_2 = Extrude(Base=solid_difference, Direction=unit_z_2)
orient = Orient(Geometry=extrude_2, Source=xz_plane, Target=PlaneXY(0, 0, 0))  # -> Geometry, Transform
move_6 = Move(Geometry=orient.Geometry, Motion=construct_point_2)  # -> Geometry, Transform
solid_union_2 = SolidUnion(Breps=[boundary_surfaces_4, boundary_surfaces_5])
extrude_3 = Extrude(Base=solid_union_2, Direction=unit_z_2)
# GuideA
solid_union_3 = SolidUnion(Breps=[extrude_3, extrude])
extrusion = ClusterOutput(extrude_2)
result = ClusterOutput(solid_union_3)

# ==== cluster Universal_ball_2
ball_radius = ClusterInput()
ratio_of_ball_holder = ClusterInput()
extended_length_ratio = ClusterInput()
division = Division(A=ball_radius, B="6")
box = Box({Plane=PlaneXY(-10, -10, 0), X=Domain(0, 20), Y=Domain(0, 20), Z=Domain(0, 20)})
cubic = ClusterOutput(box)
scale = Scale(Geometry=box, Center=Point(0, 0, 0), Factor=division)  # -> Geometry, Transform
multiplication = Multiplication(A=ball_radius, B=extended_length_ratio)
deconstruct_brep = DeconstructBrep(Brep=scale.Geometry)  # -> Faces, Edges, Vertices
division_2 = Division(A=ball_radius, B=Slider(1.5, range=0..10))
addition = Addition(A=division_2, B="1")
unit_z = UnitZ(Factor=multiplication)
top_face = Slider(5, range=0..10)
factor_1 = Slider(0.4, range=0..1)
unit_z_2 = UnitZ(Factor=ball_radius)  # -> expr("-x", UnitVector)
box_faces = ListItem(List=deconstruct_brep.Faces, Index=top_face, Wrap=True)
area = Area(Geometry=box_faces)  # -> Area, Centroid
basic_ball = Sphere(Base=area.Centroid, Radius=ball_radius)
multiplication_2 = Multiplication(A=unit_z_2, B=factor_1)

# ---- group: Side balls
unit_x = UnitX(Factor=ball_radius)
scale_0_5x = Scale(Geometry=basic_ball, Center=area.Centroid, Factor=Slider(0.5, range=0..1))  # -> Geometry, Transform
move = Move(Geometry=scale_0_5x.Geometry, Motion=expr("-x", unit_x))  # -> Geometry, Transform
move_2 = Move(Geometry=scale_0_5x.Geometry, Motion=unit_x)  # -> Geometry, Transform

# ----
move_3 = Move(Geometry=basic_ball, Motion=multiplication_2)  # -> Geometry, Transform
area_2 = Area(Geometry=move_3.Geometry)  # -> Area, Centroid
cylinder = Cylinder(Base=area_2.Centroid, Radius=addition, Length=multiplication)

list_item = ListItem(Index=Slider(2, range=0..10), Wrap=True)
number_slider = Slider(1.5, range=0..10)
need_to_be_para = Slider(1.5, range=0..10)
offset_curve = OffsetCurve(Curve=list_item, Distance=expr("-x", need_to_be_para), Plane=PlaneXY(0, 0, 0), Corners=1)
unit_z_3 = UnitZ(Factor=number_slider)
move_4 = Move(Geometry=offset_curve, Motion=unit_z_3)  # -> flatten(Geometry), Transform
point_on_curve = PointOnCurve(list_item, parameter=0.5)
line_sdl = LineSDL(Start=point_on_curve, Direction=unit_z_3, Length=number_slider)
point_on_curve_2 = PointOnCurve(line_sdl, parameter=1)
point_on_curve_3 = PointOnCurve(move_4.Geometry, parameter=0.5)
polyline = PolyLine(Vertices=flatten([point_on_curve_3, point_on_curve_2, point_on_curve]), Closed=False)
fillet = Fillet(Curve=flatten(polyline), Radius="1")
sweep2 = Sweep2(Rail1=list_item, Rail2=move_4.Geometry, Sections=fillet, SameHeight=False)
cap_holes = CapHoles(Brep=sweep2)

unit_z_4 = UnitZ(Factor="-3.3")
move_5 = Move(Geometry=move_3.Geometry, Motion=unit_z_4)  # -> Geometry, Transform

deconstruct_brep_2 = DeconstructBrep(Brep=cylinder)  # -> Faces, Edges, Vertices
list_item_2 = ListItem(List=deconstruct_brep_2.Edges, Index=Slider(0, range=0..10), Wrap=True)
boundary_surfaces = BoundarySurfaces(Edges=list_item_2)
extrude = Extrude(Base=boundary_surfaces, Direction=unit_z)

deconstruct_brep_3 = DeconstructBrep(Brep=extrude)  # -> Faces, Edges, Vertices
list_item_3 = ListItem(List=deconstruct_brep_3.Faces, Index=Slider(5, range=0..10), Wrap=True)
area_3 = Area(Geometry=list_item_3)  # -> Area, Centroid

merge = Merge(Data1=flatten(move_2.Geometry), Data2=flatten(move.Geometry), Data3=flatten(move_3.Geometry))  # -> flatten(Result)
up = SolidDifference(BrepsA=scale.Geometry, BrepsB=[move_3.Geometry, move_2.Geometry, move.Geometry])  # -> flatten(UPPart)
solid_union = SolidUnion(Breps=merge)

solid_union_2 = SolidUnion(Breps=flatten([extrude, move_5.Geometry]))

unit_y = UnitY(Factor=1)
pi = Pi(Factor=Slider(1, range=0..1))
rotate_3d = Rotate3D(Geometry=[solid_union_2, solid_union, up], Angle=pi, Center=area_3.Centroid, Axis=unit_y)  # -> DOWNPart, Transform

point = Point(Point(0, 0, 0))
move_to_point = MoveToPoint(Geometry=rotate_3d.DOWNPart, PointA=area_3.Centroid, PointB=point)  # -> simplify(graft(Moved)), Vector, Transform
explode_tree = ExplodeTree(Data=move_to_point.Moved)  # -> simplify(Branch0), simplify(Branch1), simplify(Branch2)
ball = Geometry(flatten(explode_tree.Branch0))
ball_2 = ClusterOutput(ball)
substracted_ball = Geometry(flatten(explode_tree.Branch1))
cubic_2 = Geometry(explode_tree.Branch2)
deconstruct_brep_4 = DeconstructBrep(Brep=cubic_2)  # -> Faces, Edges, Vertices
list_item_4 = ListItem(List=deconstruct_brep_4.Vertices, Index=Slider(4, range=0..6), Wrap=True)
deconstruct = Deconstruct(Point=list_item_4)  # -> XComponent, YComponent, ZComponent
unit_z_5 = UnitZ(Factor=deconstruct.ZComponent)
reverse = Reverse(Vector=unit_z_5)
move_6 = Move(Geometry=substracted_ball, Motion=reverse)  # -> Geometry, Transform
panel = Panel(ball)
substracted_ball_2 = Geometry(flatten(move_6.Geometry))
scale_2 = Scale(Geometry=substracted_ball_2, Center=Point(0, 0, 0), Factor=ratio_of_ball_holder)  # -> Geometry, Transform
substracted_ball_3 = ClusterOutput(scale_2.Geometry)
panel_2 = Panel(scale_2.Geometry)
